# Dynamo graph 01_Армирование стен.dyn (Dynamo 2.5.0.7460)

# group: Ручной выбор
restart = BoolSelector(false)
elements = BoolSelector(true)
выбор = Python(IN[0]=restart, IN[1]=elements)  # frozen
# ---------- выбор.python (29 lines) ----------
# Загрузить стандартную библиотеку Python и библиотеку DesignScript
import sys
import clr
clr.AddReference('ProtoGeometry')
from Autodesk.DesignScript.Geometry import *
clr.AddReference('RevitAPI')
from Autodesk.Revit.DB import *
from Autodesk.Revit.DB.Structure import *
clr.AddReference('RevitServices')
from RevitServices.Persistence import DocumentManager
from RevitServices.Transactions import TransactionManager

# Введенные в этом узле данные сохраняется в виде списка в переменных IN.
restart = IN[0]
elems = IN[1]

doc = DocumentManager.Instance.CurrentDBDocument
uidoc = DocumentManager.Instance.CurrentUIApplication.ActiveUIDocument

if restart:
	if elems:
		sel = [doc.GetElement(id) for id in uidoc.Selection.GetElementIds()]
	else:
		sel = uidoc.Selection.GetElementIds()
else:
	sel = None

# Назначьте вывод переменной OUT.
OUT = sel
# ----------------------------------------

активный_вид = Python()
# ---------- активный_вид.python (11 lines) ----------
# Загрузить стандартную библиотеку Python и библиотеку DesignScript
import sys
import clr
clr.AddReference('RevitAPI')
from Autodesk.Revit.DB import *
clr.AddReference('RevitServices')
from RevitServices.Persistence import DocumentManager

doc = DocumentManager.Instance.CurrentDBDocument

OUT = doc.ActiveView
# ----------------------------------------
активный_вид_2 = Watch(активный_вид)

# group: Выбор стен и сбор данных
select_model_elements = DSModelElementsSelection()  # 1 picked in the model
преобразование_в_список_и = Python(IN[0]=активный_вид)  # "Преобразование в список и фильтрация cтен"
# ---------- преобразование_в_список_и.python (26 lines) ----------
import sys
import clr
clr.AddReference('RevitAPI')
from Autodesk.Revit.DB import *
clr.AddReference('RevitServices')
from RevitServices.Persistence import DocumentManager

data = UnwrapElement(IN[0])

doc = DocumentManager.Instance.CurrentDBDocument

elemFilter = ElementClassFilter(Wall)
viewFilter = LogicalOrFilter(ElementClassFilter(View), ElementClassFilter(View3D))


if data.GetType() == View or data.GetType() == View3D:
	view = data
	filteredElems = FilteredElementCollector(doc, view.Id).WherePasses(elemFilter).ToElements()

else:
	elems = data
	if elems.GetType() == Wall:
		elems = [elems]
	filteredElems = [el for el in elems if elemFilter.PassesFilter(el)]

OUT = filteredElems
# ----------------------------------------
сбор_данных = Python(IN[0]=активный_вид_2, IN[1]=преобразование_в_список_и)
# ---------- сбор_данных.python (199 lines) ----------
# Загрузить стандартную библиотеку Python и библиотеку DesignScript
import sys
import clr
import math
import System
clr.AddReference('RevitAPI')
from Autodesk.Revit.DB import *
from Autodesk.Revit.DB.Structure import *
clr.AddReference('RevitServices')
from RevitServices.Persistence import DocumentManager

doc = DocumentManager.Instance.CurrentDBDocument

def ByElevation(lvl):
	return round(lvl.Elevation*304.8)
	
def ByElevation2(wall):
	return round(doc.GetElement(wall.LevelId).Elevation*304.8)

levels = []
levels2 = sorted(FilteredElementCollector(doc).OfClass(Level).ToElements(), key=ByElevation)
for lvl in levels2:
	if len(lvl.Name.split('.')) == 1:
		levels.append([])
		levels[-1].append(lvl)
	else:
		levels[-1].append(lvl)

workView = UnwrapElement(IN[0])
walls = sorted(UnwrapElement(IN[1]), key=ByElevation2)

#interPoints = UnwrapElement(IN[0][0])

optForWalls = Options()
optForWalls.ComputeReferences = True

class OpeningParameters:
	def __init__(self, wp, open):
		self.Id = open.Id
		self.B = wp.Dir.DotProduct(open.BoundingBox[workView].Max) - wp.Dir.DotProduct(open.BoundingBox[workView].Min)
		self.H = open.BoundingBox[workView].Max.Z - open.BoundingBox[workView].Min.Z
		self.Origin = (open.Location.Point + XYZ.BasisZ*(self.H - wp.H))
		self.SP = self.Origin - wp.Dir*self.B/2
		self.EP = self.Origin + wp.Dir*self.B/2
	
class WallReinforcement:
	def __init__(self, wall):
		self.DX = wall.GetParameters('1Пп_Арм_Горизонтальная_Диаметр')[0].AsDouble()
		self.DY1 = wall.GetParameters('1Пп_Арм_Вертикальная_Диаметр 1')[0].AsDouble()
		self.DY2 = wall.GetParameters('1Пп_Арм_Вертикальная_Диаметр 2')[0].AsDouble()
		self.DY3 = wall.GetParameters('1Пп_Арм_Вертикальная_Диаметр 3')[0].AsDouble()
		self.StepX = wall.GetParameters('1Пп_Арм_Горизонтальная_Шаг')[0].AsDouble()
		self.StepY = wall.GetParameters('1Пп_Арм_Вертикальная_Шаг')[0].AsDouble()
		self.DStud = wall.GetParameters('1Пп_Арм_Шпильки_Диаметр')[0].AsDouble()
		self.CovExt = doc.GetElement(wall.Parameter[BuiltInParameter.CLEAR_COVER_EXTERIOR].AsElementId()).CoverDistance
		self.CovInt = doc.GetElement(wall.Parameter[BuiltInParameter.CLEAR_COVER_INTERIOR].AsElementId()).CoverDistance
		self.CovOth = doc.GetElement(wall.Parameter[BuiltInParameter.CLEAR_COVER_OTHER].AsElementId()).CoverDistance
		self.DStudS = self.DStud * 2.5
		
	def GetDY1RebarType(self):
		for rt in FilteredElementCollector(doc).OfClass(RebarBarType).ToElements():
			name = rt.Parameter[BuiltInParameter.SYMBOL_NAME_PARAM].AsString()
			diameter = round(rt.Parameter[BuiltInParameter.REBAR_BAR_DIAMETER].AsDouble()*304.8)
			inMeteres = rt.get_Parameter(System.Guid('844a01e2-19fc-4dc5-baa0-a4bda30ef1f6')).AsInteger()
			if name.find('A500') != -1 and diameter == round(self.DY1*304.8) and inMeteres == 0:
				break
		else:
			rt = None	
		return rt
		
	def GetDY2RebarType(self):
		for rt in FilteredElementCollector(doc).OfClass(RebarBarType).ToElements():
			name = rt.Parameter[BuiltInParameter.SYMBOL_NAME_PARAM].AsString()
			diameter = round(rt.Parameter[BuiltInParameter.REBAR_BAR_DIAMETER].AsDouble()*304.8)
			inMeteres = rt.get_Parameter(System.Guid('844a01e2-19fc-4dc5-baa0-a4bda30ef1f6')).AsInteger()
			if name.find('A500') != -1 and diameter == round(self.DY2*304.8) and inMeteres == 0:
				break
		else:
			rt = None	
		return rt
		
	def GetDXRebarType(self):
		for rt in FilteredElementCollector(doc).OfClass(RebarBarType).ToElements():
			name = rt.Parameter[BuiltInParameter.SYMBOL_NAME_PARAM].AsString()
			diameter = round(rt.Parameter[BuiltInParameter.REBAR_BAR_DIAMETER].AsDouble()*304.8)
			inMeteres = rt.get_Parameter(System.Guid('844a01e2-19fc-4dc5-baa0-a4bda30ef1f6')).AsInteger()
			if name.find('A500') != -1 and diameter == round(self.DX*304.8) and inMeteres == 0:
				break
		else:
			rt = None	
		return rt
		
class WallParameters:
	def __init__(self, wall):
		self.Id = wall.Id.IntegerValue
		self.T = wall.Width
		self.H = wall.Parameter[BuiltInParameter.WALL_USER_HEIGHT_PARAM].AsDouble()
		self.TopOffset = wall.Parameter[BuiltInParameter.WALL_TOP_OFFSET].AsDouble()
		self.BaseOffset = wall.Parameter[BuiltInParameter.WALL_BASE_OFFSET].AsDouble()
		self.Z = wall.Location.Curve.GetEndPoint(0).Z + self.BaseOffset
		self.Dir = wall.Location.Curve.Direction.Normalize()
		self.Orient = wall.Orientation.Normalize()
		self.CenterLine = wall.Location.Curve
		self.TopLvlId = wall.Parameter[BuiltInParameter.WALL_HEIGHT_TYPE].AsElementId()
		self.BottomLvlId = wall.Parameter[BuiltInParameter.WALL_BASE_CONSTRAINT].AsElementId()		
		self.SP = wall.Location.Curve.GetEndPoint(0)
		self.EP = wall.Location.Curve.GetEndPoint(1)
		self.BClass = wall.GetParameters('1Пп_Класс бетона')[0].AsString()
		self.Solid = [geom for geom in list(wall.Geometry[optForWalls]) if geom.GetType() == Solid and geom.Volume > 0][0]
		self.JoinAllowedAtStart = WallUtils.IsWallJoinAllowedAtEnd(wall, 0)
		self.JoinAllowedAtEnd = WallUtils.IsWallJoinAllowedAtEnd(wall, 1)
		self.JoinedWallsAtStart = list(wall.Location.ElementsAtJoin[0])
		self.JoinedWallsAtEnd = list(wall.Location.ElementsAtJoin[1])
		
		wallLvlId = wall.LevelId.IntegerValue
		for i, lvlSet in enumerate(levels):
			for lvl in lvlSet:
				if lvl.Id.IntegerValue == wallLvlId:
					self.LvlParity = i % 2
	
	def GetPreviousLevel(self):
		if len(doc.GetElement(self.BottomLvlId).Name.split('.')) == 2:
			pLvl = levels2[0]
		else:
			catchPoint = self.CenterLine.ComputeDerivatives(0.5, True).Origin - XYZ.BasisZ* 500/304.8
			filter = BoundingBoxContainsPointFilter(catchPoint)
			lowerWall = list(FilteredElementCollector(doc).OfClass(Wall).WherePasses(filter).ToElements())[0]
			pLvl = doc.GetElement(lowerWall.Parameter[BuiltInParameter.WALL_BASE_CONSTRAINT].AsElementId())
		return pLvl
		
	def GetTopZ(self):
		return doc.GetElement(self.TopLvlId).Elevation + self.TopOffset
		
	def GetBaseZ(self):
	 	return doc.GetElement(self.BottomLvlId).Elevation + self.BaseOffset
	 	
	def GetMidPointOfCenterLine(self):
		return self.CenterLine.ComputeDerivatives(0.5, True).Origin
		
	def GetUpperSlabThickness(self, catchPoint):
		filter = ElementLevelFilter(self.TopLvlId)
		slabs = FilteredElementCollector(doc).OfClass(Floor).WherePasses(filter).ToElements()
		optForSlabs = Options()
		t = 0
		for slab in slabs:
			mainFace = [face for face in list(slab.Geometry[optForSlabs])[0].Faces if face.FaceNormal.Normalize().IsAlmostEqualTo(XYZ.BasisZ)][0]
			if mainFace.Project(catchPoint) is not None:
				t = slab.Parameter[BuiltInParameter.FLOOR_ATTR_THICKNESS_PARAM].AsDouble()
				break
		return t
		
	def GetBottomSlabThickness(self, catchPoint):
		filter = ElementLevelFilter(self.BottomLvlId)
		slabs = FilteredElementCollector(doc).OfClass(Floor).WherePasses(filter).ToElements()
		optForSlabs = Options()
		t = 0
		for slab in slabs:
			mainFace = [face for face in list(slab.Geometry[optForSlabs])[0].Faces if face.FaceNormal.Normalize().IsAlmostEqualTo(XYZ.BasisZ)][0]
			if mainFace.Project(catchPoint) is not None:
				t = slab.Parameter[BuiltInParameter.FLOOR_ATTR_THICKNESS_PARAM].AsDouble()
				break
		return t
		
	def GetFloor(self, catchPoint):
		filter = ElementLevelFilter(self.BottomLvlId)
		slabs = FilteredElementCollector(doc).OfClass(Floor).WherePasses(filter).ToElements()
		floor = None
		optForSlabs = Options()
		for slab in slabs:
			mainFace = [face for face in list(slab.Geometry[optForSlabs])[0].Faces if face.FaceNormal.Normalize().IsAlmostEqualTo(XYZ.BasisZ)][0]
			if mainFace.Project(catchPoint) is not None:
				floor = slab
				break
		return floor
		
	def GetOpenings(self):
		wall = doc.GetElement(ElementId(self.Id))
		filter = LogicalAndFilter(ElementClassFilter(FamilyInstance), ElementCategoryFilter(BuiltInCategory.OST_Windows))
		openings = [doc.GetElement(id) for id in wall.GetDependentElements(filter)]
		return [OpeningParameters(self, open) for open in openings]
		
#	def HasIntersectionWithOtherWall(self):
#		for ip in interPoints[0]:
#			if self.SP.IsAlmostEqualTo(ip, self.T) and not self.EP.IsAlmostEqualTo(ip, self.T):
#				return 'AtStart'
#			elif not self.SP.IsAlmostEqualTo(ip, self.T) and self.EP.IsAlmostEqualTo(ip, self.T):
#				return 'AtEnd'
#			elif self.SP.IsAlmostEqualTo(ip, self.T) and self.EP.IsAlmostEqualTo(ip, self.T):
#				return 'Both'
#			else:
#				return None
				
# Введенные в этом узле данные сохраняется в виде списка в переменных IN.

WPars = [WallParameters(wall) for wall in walls]
WRebs = [WallReinforcement(wall) for wall in walls]
	
# Назначьте вывод переменной OUT
OUT = WPars, WRebs#, WPars[0].HasIntersectionWithOtherWall()
# ----------------------------------------

# group: Ввод исходных данных
расстояние_до_центра = DoubleSlider(35, range=25..50 step 5)  # "Расстояние до центра горизонтальной арматуры"
имя_формы_прямых_стержней = StringInput("01")
минимальное_смещение = DoubleInput(50)  # "Минимальное смещение горизонтальной арматуры от низа стены"
имя_формы_п_шек = StringInput("1П_Ск-1")
имя_рабочего_3d_вида_2 = StringInput("3D - Смирнов - армирование стен_WorkView")
защитный_слой_торцов_стен = DoubleSlider(15, range=10..30 step 5)
имя_формы_шпилек = StringInput("1П_Ш-1")
шаг_шпилек = DoubleInput(400)
имя_рабочего_3d_вида_1 = StringInput("3D - Смирнов - опалубка полностью_WorkView")

# group: Корректировка армирования
поиск_анекеров_и_корректировка = Python(IN[0]=сбор_данных, IN[1]=расстояние_до_центра)  # "Поиск анекеров и корректировка защитного слоя"
# ---------- поиск_анекеров_и_корректировка.python (243 lines) ----------
import sys
import clr
import math
clr.AddReference('RevitAPI')
from Autodesk.Revit.DB import *
from Autodesk.Revit.DB.Structure import *
clr.AddReference('RevitServices')
from RevitServices.Persistence import DocumentManager
from RevitServices.Transactions import TransactionManager

doc = DocumentManager.Instance.CurrentDBDocument

WPars = IN[0][0]
WRebs = IN[0][1]

workView = doc.ActiveView

def VecABS(vec):
	x = abs(vec.X)
	y = abs(vec.Y)
	z = abs(vec.Z)
	return XYZ(x,y,z)

RbtValues = {'B15':0.75, 'B20':0.9, 'B25':1.05, 'B30':1.15, 'B35':1.3, 'B40':1.4, 'B45':1.5}

def ComputeBaseAnchorLength(d, bclass):
	Rbt = RbtValues[bclass]
	Rs = 435
	Rbond = Rbt*2.5*1
	As = (math.pi*d**2)/4
	us = math.pi*d
	l0an = (Rs*As)/(Rbond*us)
	return l0an
	
def ComputeAnchorLength(d, bclass):
	l0an = ComputeBaseAnchorLength(d, bclass)
	lan = 0.75*l0an
	return math.ceil(max([0.3*l0an, 15*d, 200/304.8, lan])*304.8/10)*10/304.8
	
def ComputeOverlapLength(d, bclass):
	l0an = ComputeBaseAnchorLength(d, bclass)
	lan = 0.9*l0an
	return math.ceil(max([0.3*l0an, 15*d, 200/304.8, lan])*304.8/10)*10/304.8
	
def GetRebarLevel(rebar):
	if rebar.GetType() == Rebar:
		host = doc.GetElement(rebar.GetHostId())
		lvl = doc.GetElement(host.LevelId)
	else:
		lvl = None
	return lvl

def GetWallAnchors(wp, wr):
	pLvl = wp.GetPreviousLevel()
	rebars = [rebar for rebar in FilteredElementCollector(doc, workView.Id).OfClass(Rebar).ToElements() if GetRebarLevel(rebar) is not None and GetRebarLevel(rebar).Id.IntegerValue == pLvl.Id.IntegerValue]
	WAncSet = []
	for rebar in rebars:
		wanc = WallAnchor()
		wanc.RefreshData(wp, rebar, wr)
		
#		test.append([wanc.L*304.8, wanc.ForOverlap1, wanc.ForOverlap2])

		if wanc.L is not None and (wanc.ForOverlap1 or wanc.ForOverlap2):
			WAncSet.append(wanc)
	if WAncSet:
		wanc.UpdateRebarAssignment(WAncSet, wp)
	return WAncSet
	
class WallAnchor:
	def __init__(self):
		self.Location = None
		self.L = None
		self.D = None
		self.N = None
		self.Step = None
		self.DistPathDir = None
		self.Assignment = 'Linear'
		self.Reb = None
	
	def RefreshData(self, wp, rebar, wr):
		if rebar.GetType() == Rebar:
			solid = wp.Solid
			centerLines = rebar.GetCenterlineCurves(True, True, True, MultiplanarOption.IncludeOnlyPlanarCurves, 0)
			for item in centerLines:
				if item.GetType() == Line and VecABS(item.Direction.Normalize()).IsAlmostEqualTo(XYZ.BasisZ):
					spotlines = list(solid.IntersectWithCurve(item, None))
					if spotlines:
						sp = spotlines[0].GetEndPoint(0)
						self.Location = XYZ(sp.X, sp.Y, wp.Z)
						self.L = round(spotlines[0].Length*304.8)/304.8
						self.D = rebar.Parameter[BuiltInParameter.REBAR_BAR_DIAMETER].AsDouble()
						self.N = rebar.Parameter[BuiltInParameter.REBAR_ELEM_QUANTITY_OF_BARS].AsInteger()
						self.Step = rebar.Parameter[BuiltInParameter.REBAR_ELEM_BAR_SPACING].AsDouble()
						self.DistPathDir = rebar.GetShapeDrivenAccessor().GetDistributionPath().Direction.Normalize()
						self.Reb = rebar
						break
		
		ol1 = round(ComputeOverlapLength(wr.DY1, wp.BClass)*304.8)
		ol2 = round(ComputeOverlapLength(wr.DY2, wp.BClass)*304.8)
		if wr.DY3 > 0:
			ol3 = round(ComputeOverlapLength(wr.DY3, wp.BClass)*304.8)
		else:
			ol3 = ol1
		minOverlaps = [ol1, ol2, ol3]
		test.append(minOverlaps)

		ol4 = math.ceil(2.3*ComputeOverlapLength(wr.DY1, wp.BClass)*304.8/10)*10
		ol5 = math.ceil(2.3*ComputeOverlapLength(wr.DY2, wp.BClass)*304.8/10)*10
		if wr.DY3 > 0:
			ol6 = math.ceil(2.3*ComputeOverlapLength(wr.DY3, wp.BClass)*304.8/10)*10
		else:
			ol6 = ol4
		maxOverlaps = [ol4, ol5, ol6]
		
		if self.L is not None:
			if round(self.L*304.8, -1) == round(ComputeAnchorLength(self.D, wp.BClass)*304.8):
				self.ForAnchor = True
				self.ForOverlap1 = False
				self.ForOverlap2 = False
			elif round(self.L*304.8, -1) in minOverlaps:
				self.ForAnchor = False
				self.ForOverlap1 = True
				self.ForOverlap2 = False
			elif round(self.L*304.8, -1) in maxOverlaps:
				self.ForAnchor = False
				self.ForOverlap1 = False
				self.ForOverlap2 = True
			else:
				self.ForAnchor = None
				self.ForOverlap1 = None
				self.ForOverlap2 = None

	def UpdateRebarAssignment(self, wancs, wp):
		dstsToSingleSP = []
		dstsToSingleEP = []
		dstsToArray = []

		for wanc in wancs:
			if wanc.N == 1:
				dstsToSingleSP.append(round(wp.SP.DistanceTo(wanc.Location)*304.8))
				dstsToSingleEP.append(round(wp.EP.DistanceTo(wanc.Location)*304.8))		
			else:
				dstsToArray.append(round(wp.SP.DistanceTo(wanc.Location)*304.8))
				dstsToArray.append(round(wp.EP.DistanceTo(wanc.Location)*304.8))		
		dstsToSingleSP = sorted(set(dstsToSingleSP))
		dstsToSingleEP = sorted(set(dstsToSingleEP))
		dstsToArray = sorted(set(dstsToArray))
		for wanc in wancs:
			dst = min([round(wp.SP.DistanceTo(wanc.Location)*304.8), round(wp.EP.DistanceTo(wanc.Location)*304.8)])
			if wanc.N == 1:
				dstSP = round(wp.SP.DistanceTo(wanc.Location)*304.8)
				dstEP = round(wp.EP.DistanceTo(wanc.Location)*304.8)
				if dstSP == dstsToSingleSP[0] or dstSP == dstsToSingleSP[1]:
					wanc.Assignment = 'EdgeStart'
				elif dstEP == dstsToSingleEP[0] or dstEP == dstsToSingleEP[1]: 
					wanc.Assignment = 'EdgeEnd'
			elif dst == dstsToArray[0]:
				wanc.Assignment = 'EdgeLinear'
		
		opens = wp.GetOpenings()
		opens = False
		if opens:
			for open in opens:
				dstsToSingleOpenSP = []
				dstsToSingleOpenEP = []
				for wanc in wancs:
					if wanc.N == 1:
						dstsToSingleOpenSP.append(round(open.SP.DistanceTo(wanc.Location)*304.8))
						dstsToSingleOpenEP.append(round(open.EP.DistanceTo(wanc.Location)*304.8))
				dstsToSingleOpenSP = sorted(set(dstsToSingleOpenSP))
				dstsToSingleOpenEP = sorted(set(dstsToSingleOpenEP))
				for wanc in wancs:
					if wanc.N == 1:
						dst = min([round(open.SP.DistanceTo(wanc.Location)*304.8), round(open.EP.DistanceTo(wanc.Location)*304.8)])
						if dst == dstsToSingleOpenSP[0] or dst == dstsToSingleOpenSP[1] or dst == dstsToSingleOpenEP[0] or dst == dstsToSingleOpenEP[1]: 
							wanc.Assignment = 'NearOpening'

tr1 = Transform.Identity
tr2 = Transform.Identity
WAncs = []
test = []

TransactionManager.Instance.EnsureInTransaction(doc)

for i, wp in enumerate(WPars):
	wr = WRebs[i]
	wancs = GetWallAnchors(wp, wr)
#	wancs = True
	if wancs:
		WAncs.append(wancs)
		wall = doc.GetElement(ElementId(wp.Id))
		wr = WRebs[i]
		tr1.Origin = -wp.SP
		tr2.BasisX = wp.Dir
		tr2.BasisY = wp.Orient
		
		dsts1 = []
		dsts2 = []
		for wanc in wancs:
			y = tr2.OfVector(tr1.OfPoint(wanc.Location)).Y
			if y > 0:
				dsts1.append(wp.T/2 - (y + wanc.D/2))
			else:
				dsts2.append(wp.T/2 - (abs(y) + wanc.D/2))
			
		dst1 = min(dsts1) - wr.DX
		dst2 = min(dsts2) - wr.DX
		dst3 = 15/304.8
		
		covTypes1 = [ct for ct in FilteredElementCollector(doc).OfClass(RebarCoverType).ToElements() if round(ct.CoverDistance*304.8, 1) == round(dst1*304.8, 1)]
		covTypes2 = [ct for ct in FilteredElementCollector(doc).OfClass(RebarCoverType).ToElements() if round(ct.CoverDistance*304.8, 1) == round(dst2*304.8, 1)]
		covTypes3 = [ct for ct in FilteredElementCollector(doc).OfClass(RebarCoverType).ToElements() if round(ct.CoverDistance*304.8, 1) == round(dst3*304.8, 1)]
		if covTypes1:
			covType1 = covTypes1[0]
		else:
			covType1 = RebarCoverType.Create(doc, str(round(dst1*304.8, 1)), dst1)
		if covTypes2:
			covType2 = covTypes2[0]
		else:
			covType2 = RebarCoverType.Create(doc, str(round(dst2*304.8, 1)), dst2)
		if covTypes3:
			covType3 = covTypes3[0]
		else:
			covType3 = RebarCoverType.Create(doc, str(round(dst3*304.8, 1)), dst3)
			
		if wr.CovExt and wr.CovExt != dst1:
			wr.CovExt = dst1
			wall.Parameter[BuiltInParameter.CLEAR_COVER_EXTERIOR].Set(covType1.Id)
		if wr.CovInt and wr.CovInt != dst2:
			wr.CovInt = dst2
			wall.Parameter[BuiltInParameter.CLEAR_COVER_INTERIOR].Set(covType2.Id)
		if wr.CovOth != dst3:
			wr.CovOth = dst3
			wall.Parameter[BuiltInParameter.CLEAR_COVER_OTHER].Set(covType3.Id)
#	else:
#		Wancs.append(None)


TransactionManager.Instance.TransactionTaskDone()

OUT = WPars, WRebs, WAncs
#OUT = doc.GetElement(ElementId(wp.Id)), test, [[wanc.Reb for wanc in wancs] for wancs in WAncs]
#OUT = test
# ----------------------------------------
удаление_шпилек = Python(IN[0]=поиск_анекеров_и_корректировка)
# ---------- удаление_шпилек.python (34 lines) ----------
import sys
import clr
import math
import System
clr.AddReference('RevitAPI')
from Autodesk.Revit.DB import *
from Autodesk.Revit.DB.Structure import *
clr.AddReference('RevitServices')
from RevitServices.Persistence import DocumentManager
from RevitServices.Transactions import TransactionManager

doc = DocumentManager.Instance.CurrentDBDocument

data = IN[0]
WPars = data[0]

rebarsToDelete = []

for wp in WPars:
	wall = doc.GetElement(ElementId(wp.Id))
	rebars = [doc.GetElement(id) for id in wall.GetDependentElements(ElementClassFilter(Rebar))]
	for rebar in rebars:
		rebarPart = rebar.Parameter[BuiltInParameter.NUMBER_PARTITION_PARAM].AsString()
		if rebarPart.find('06_Шпильки') == 0:
			rebarsToDelete.append(rebar.Id)

TransactionManager.Instance.EnsureInTransaction(doc)

for id in rebarsToDelete:
	doc.Delete(id)

TransactionManager.Instance.TransactionTaskDone()

OUT = data
# ----------------------------------------

end = Revit.Transaction.Transaction.End(input=удаление_шпилек)

# group (continued): Корректировка армирования
корректировка_вертикального = Python(IN[0]=end, IN[1]=имя_формы_прямых_стержней)  # "Корректировка вертикального армирования"
# ---------- корректировка_вертикального.python (321 lines) ----------
import sys
import clr
import math
import System
clr.AddReference('System')
from System.Collections.Generic import List
clr.AddReference('RevitAPI')
from Autodesk.Revit.DB import *
from Autodesk.Revit.DB.Structure import *
clr.AddReference('RevitServices')
from RevitServices.Persistence import DocumentManager
from RevitServices.Transactions import TransactionManager

doc = DocumentManager.Instance.CurrentDBDocument

WPars = IN[0][0]
WRebs = IN[0][1]
WAncs = IN[0][2]

def VecABS(vec):
	x = abs(vec.X)
	y = abs(vec.Y)
	z = abs(vec.Z)
	return XYZ(x,y,z)

pars = [0.1, 0.2, 0.3, 0.4, 0.5, 0.6, 0.7, 0.8, 0.9]
RbtValues = {'B15':0.75, 'B20':0.9, 'B25':1.05, 'B30':1.15, 'B35':1.3, 'B40':1.4, 'B45':1.5}

def ByZ(geom):
	return geom.Origin.Z

def ComputeBaseAnchorLength(d, bclass):
	Rbt = RbtValues[bclass]
	Rs = 435
	Rbond = Rbt*2.5*1
	As = (math.pi*d**2)/4
	us = math.pi*d
	l0an = (Rs*As)/(Rbond*us)
	return l0an
	
def ComputeAnchorLength(d, bclass):
	l0an = ComputeBaseAnchorLength(d, bclass)
	lan = 0.75*l0an
	return math.ceil(max([0.3*l0an, 15*d, 200/304.8, lan])*304.8/10)*10/304.8
	
def ComputeOverlapLength(d, bclass):
	l0an = ComputeBaseAnchorLength(d, bclass)
	lan = 0.9*l0an
	return math.ceil(max([0.3*l0an, 15*d, 200/304.8, lan])*304.8/10)*10/304.8
	
def GetNearestFace(rebar, faces):
	line = list(rebar.GetCenterlineCurves(False, True, True, MultiplanarOption.IncludeOnlyPlanarCurves, 0))[0]
	for par in pars:
		p0 = line.ComputeDerivatives(par, True).Origin
		proj = faces[0].Project(p0)
		if proj:
			break
	else:
		return None
	dst1 = p0.DistanceTo(faces[0].Project(p0).XYZPoint)
	dst2 = p0.DistanceTo(faces[1].Project(p0).XYZPoint)
	if dst1 < dst2:
		return faces[0]
	else:
		return faces[1]
		
def GetBottomFace(faces):
	catchPoint = wp.SP + wp.Dir*10/304.8
	floor = wp.GetFloor(catchPoint)
	if not floor:
		catchPoint = wp.EP - wp.Dir*10/304.8
		floor = wp.GetFloor(catchPoint)
	if floor:
		optForSlabs = Options()
		mainFace = [face for face in list(floor.Geometry[optForSlabs])[0].Faces if face.FaceNormal.Normalize().IsAlmostEqualTo(XYZ.BasisZ)][0]
		z = round(mainFace.Origin.Z*304.8)
		bottomFace = [face for face in faces if round(face.Origin.Z*304.8) == z]
		if bottomFace:
			return bottomFace[0]
		else:
			return None
			
def GetUpperWall(wp, point):
	catchPoint = point + XYZ.BasisZ*(wp.BaseOffset + wp.H + 400/304.8)
	filter = ElementLevelFilter(wp.TopLvlId)
	walls = FilteredElementCollector(doc).OfClass(Wall).WherePasses(filter).ToElements()
	upwall = None
	for wall in walls:
		filter = BoundingBoxContainsPointFilter(catchPoint)
		if filter.PassesFilter(wall):
			upwall = wall
			break
	return upwall
			
def GetRebarLocAndDir(rebar, wp):
	centerLine = rebar.GetCenterlineCurves(False, True, True, MultiplanarOption.IncludeOnlyPlanarCurves, 0)[0]
	loc = centerLine.GetEndPoint(0)
	dir = VecABS(centerLine.Direction)
	dir2 = VecABS(rebar.GetShapeDrivenAccessor().Normal.Normalize())
	return loc, dir, dir2
	
def GetNearestRebar(wanc, rebars, wp):
	nearestRebar = None
	dsts = []
	for rebar in rebars:
		sp = GetRebarLocAndDir(rebar, wp)[0]
		loc = XYZ(sp.X, sp.Y, wp.Z)
		dst = loc.DistanceTo(wanc.Location)
		dsts.append(dst)
	if dsts:
		minDst = min(dsts)
		
		for i, rebar in enumerate(rebars):
			sp = GetRebarLocAndDir(rebar, wp)[0]
			loc = XYZ(sp.X, sp.Y, wp.Z)
			dst = loc.DistanceTo(wanc.Location)
			if dst == minDst:
				nearestRebar = rebars.pop(i)
				break
	return nearestRebar
	
def ComputeRebarOffset(wp, wr, wanc):
	if wp.LvlParity == 0:
		token = 1
	else:
		token = -1
	if wanc.Assignment == 'EdgeStart':
		offset = (wanc.D/2+wr.DY2/2)*token
	elif wanc.Assignment == 'EdgeEnd':
		offset = -(wanc.D/2+wr.DY2/2)*token
	else:
		offset = (wanc.D/2+wr.DY1/2)*token
	return offset
	
def GetRebarBarType(wr, wanc):
	if wanc.Assignment.find('Edge') == 0:
		reqD = round(wr.DY2*304.8)
	elif wanc.Assignment == 'NearOpening':
		reqD = round(wanc.D*304.8)
	else:
		reqD = round(wr.DY1*304.8)
	
	for rt in FilteredElementCollector(doc).OfClass(RebarBarType).ToElements():
		name = rt.Parameter[BuiltInParameter.SYMBOL_NAME_PARAM].AsString()
		d = round(rt.Parameter[BuiltInParameter.REBAR_BAR_DIAMETER].AsDouble()*304.8)
		inMeteres = rt.get_Parameter(System.Guid('844a01e2-19fc-4dc5-baa0-a4bda30ef1f6')).AsInteger()
		if name.find('A500') != -1 and d == reqD and inMeteres == 0:
			break
	else:
		return None
	return rt
		
class RebarHandles:
	def __init__(self, rebar):
		conMan = rebar.GetRebarConstraintsManager()
		isSimple = doc.GetElement(rebar.GetShapeId()).SimpleLine
		self.Bottom = [handle for handle in conMan.GetAllHandles() if handle.GetHandleType() == RebarHandleType.StartOfBar][0]
		self.Top = [handle for handle in conMan.GetAllHandles() if handle.GetHandleType() == RebarHandleType.EndOfBar][0]
		self.Plane = [handle for handle in conMan.GetAllHandles() if handle.GetHandleType() == RebarHandleType.RebarPlane][0]
		if isSimple:
			self.S1 = [handle for handle in conMan.GetAllHandles() if handle.GetHandleName() == 'Сегмент стержня 1'][0]
		else:
			self.S1 = None
			
class WallFaces:
	def __init__(self, wp):
		faces = wp.Solid.Faces
		xDir = VecABS(wp.Dir)
		yDir = VecABS(wp.Orient)
		self.Top = sorted([face for face in faces if face.FaceNormal.Normalize().IsAlmostEqualTo(XYZ.BasisZ)], key=ByZ, reverse=True)[0]
		self.Bottom = GetBottomFace([face for face in faces if face.FaceNormal.Normalize().IsAlmostEqualTo(-XYZ.BasisZ)])
		self.Short = [face for face in faces if VecABS(face.FaceNormal.Normalize()).IsAlmostEqualTo(xDir)]
		self.Long = [face for face in faces if VecABS(face.FaceNormal.Normalize()).IsAlmostEqualTo(yDir)]
		
class WallReinforcementConstarints:
	def __init__(self, wp, rebar, wanc):
		wFaces = WallFaces(wp)
		xDir = VecABS(wp.Dir)
		yDir = VecABS(wp.Orient)
		conMan = rebar.GetRebarConstraintsManager()
		self.Hands = RebarHandles(rebar)
		self.Top = [con for con in conMan.GetConstraintCandidatesForHandle(self.Hands.Top, wFaces.Top.Reference) if con.IsFixedDistanceToHostFace()][0]
		rebarOrient = GetRebarLocAndDir(rebar, wp)[2]
		if rebarOrient.IsAlmostEqualTo(xDir):
			self.Plane = [con for con in conMan.GetConstraintCandidatesForHandle(self.Hands.Plane, wanc.Reb.Id) if con.IsToOtherRebar()][0]
			self.Plane.SetToUseClearBarSpacing(False)
			if self.Hands.S1:
				self.S1 = [con for con in conMan.GetConstraintCandidatesForHandle(self.Hands.S1, GetNearestFace(rebar, wFaces.Long).Reference)][0]		
		elif rebarOrient.IsAlmostEqualTo(yDir):
			self.Plane = [con for con in conMan.GetConstraintCandidatesForHandle(self.Hands.Plane, GetNearestFace(rebar, wFaces.Long).Reference)][0]
			if self.Hands.S1:
				self.S1 = [con for con in conMan.GetConstraintCandidatesForHandle(self.Hands.S1, wanc.Reb.Id) if con.IsToOtherRebar()][0]
				self.S1.SetToUseClearBarSpacing(False)
		if wFaces.Bottom:
			self.Bottom = [con for con in conMan.GetConstraintCandidatesForHandle(self.Hands.Bottom, wFaces.Bottom.Reference) if con.IsFixedDistanceToHostFace()][0]
			
shape = [shape for shape in FilteredElementCollector(doc).OfClass(RebarShape).ToElements() if shape.Parameter[BuiltInParameter.SYMBOL_NAME_PARAM].AsString() == IN[1]][0]
		
TransactionManager.Instance.EnsureInTransaction(doc)

updatedRebars = []
for i, wp in enumerate(WPars):	
	catchPoint = wp.SP + wp.Dir*10/304.8
	slabT = wp.GetUpperSlabThickness(catchPoint)
	if not slabT:
		catchPoint = wp.EP - wp.Dir*10/304.8
		slabT = wp.GetUpperSlabThickness(catchPoint)
		if not slabT:
			slabT = 0		

	wr = WRebs[i]
	rebarV1Type = wr.GetDY1RebarType()
	rebarV2Type = wr.GetDY2RebarType()
	overlapBottom1 = ComputeOverlapLength(wr.DY1, wp.BClass)
	overlapBottom2 = ComputeOverlapLength(wr.DY2, wp.BClass)
	
	upWall = GetUpperWall(wp, wp.SP + wp.Dir*10/304.8)
	if not upWall:
		upWall = GetUpperWall(wp, wp.EP - wp.Dir*10/304.8)	
	if upWall:
		upWallDY1 = upWall.GetParameters('1Пп_Арм_Вертикальная_Диаметр 1')[0].AsDouble()
		upWallDY2 = upWall.GetParameters('1Пп_Арм_Вертикальная_Диаметр 2')[0].AsDouble()
		upWallBClass = upWall.GetParameters('1Пп_Класс бетона')[0].AsString()			
		overlapTop1 = ComputeOverlapLength(upWallDY1, upWallBClass)
		overlapTop2 = ComputeOverlapLength(upWallDY2, upWallBClass)
		cutTop = 0
	else:
		overlapTop1 = 0
		overlapTop2 = 0
		cutTop = 15/304.8
	
	wall = doc.GetElement(ElementId(wp.Id))
	rebars = [doc.GetElement(id) for id in wall.GetDependentElements(ElementClassFilter(Rebar))]
	rebarsV = []
	for rebar in rebars:
		dir = GetRebarLocAndDir(rebar, wp)[1]
		isSimple = doc.GetElement(rebar.GetShapeId()).SimpleLine
		if dir.IsAlmostEqualTo(XYZ.BasisZ) and isSimple:
			rebarsV.append(rebar)
			
	updatedRebars.append([])	
	for wanc in WAncs[i]:
		wanc.RefreshData(wp, wanc.Reb, wr)
		rebarOffset = ComputeRebarOffset(wp, wr, wanc)
		if wanc.ForOverlap1 or wanc.ForOverlap2:
			if rebarsV:
				rebar = GetNearestRebar(wanc, rebarsV, wp)
			else:
				rebarType = GetRebarBarType(wr, wanc)
				p0 = wanc.Location
				p1 = wanc.Location + XYZ.BasisZ*wp.H
				line = Line.CreateBound(p0, p1)
				rebar = Rebar.CreateFromCurves(doc, RebarStyle.Standard, rebarType, None, None, wall, wanc.DistPathDir, [line], RebarHookOrientation.Left, RebarHookOrientation.Left, True, False)
				rebar.get_Parameter(System.Guid('b5ef18b4-453e-49bd-b26c-dfb3bd3ca79c')).Set(wp.H)				
			if rebar:
				isSimple = doc.GetElement(rebar.GetShapeId()).SimpleLine
				if isSimple:				
					wrCons = WallReinforcementConstarints(wp, rebar, wanc)
					rebarOrient = GetRebarLocAndDir(rebar, wp)[2]
					if rebarOrient.IsAlmostEqualTo(VecABS(wp.Orient)):
						wrCons.Plane.SetDistanceToTargetCover(-wr.DX)
						wrCons.S1.SetDistanceToTargetRebar(rebarOffset)
							
					if rebarOrient.IsAlmostEqualTo(VecABS(wp.Dir)):
						wrCons.S1.SetDistanceToTargetCover(-wr.DX)						
						wrCons.Plane.SetDistanceToTargetRebar(rebarOffset)
				
					if wanc.Assignment == 'EdgeStart' or wanc.Assignment == 'EdgeEnd':
						rebar.ChangeTypeId(rebarV2Type.Id)
						if wanc.ForOverlap1 and slabT > 0:
							wrCons.Bottom.SetDistanceToTargetHostFace(0)
							wrCons.Top.SetDistanceToTargetHostFace(slabT + overlapTop2 - cutTop)
						elif wanc.ForOverlap2 and slabT > 0:
							wrCons.Bottom.SetDistanceToTargetHostFace(-math.ceil(1.3*overlapBottom2*304.8/10)*10/304.8)
							wrCons.Top.SetDistanceToTargetHostFace(slabT + math.ceil(2.3*overlapTop2*304.8/10)*10/304.8 - cutTop)
					else:
						rebar.ChangeTypeId(rebarV1Type.Id)
						if wanc.ForOverlap1:
							wrCons.Bottom.SetDistanceToTargetHostFace(0)
							if slabT > 0:
								wrCons.Top.SetDistanceToTargetHostFace(slabT + overlapTop1 - cutTop)
						else:
							wrCons.Bottom.SetDistanceToTargetHostFace(-math.ceil(1.3*overlapBottom1*304.8/10)*10/304.8)
							if slabT > 0:
								wrCons.Top.SetDistanceToTargetHostFace(slabT + math.ceil(2.3*overlapTop1*304.8/10)*10/304.8 - cutTop)		
	
					cons = []
					cons.append([wrCons.Hands.Plane, wrCons.Plane])	
					cons.append([wrCons.Hands.Top, wrCons.Top])
					cons.append([wrCons.Hands.Bottom, wrCons.Bottom])
					if wrCons.Hands.S1:
						cons.append([wrCons.Hands.S1, wrCons.S1])

					conMan = rebar.GetRebarConstraintsManager()	
					[conMan.SetPreferredConstraintForHandle(con[0], con[1]) for con in cons]
					doc.Regenerate()
				
					if wanc.N > 1:
						rebar.Parameter[BuiltInParameter.REBAR_ELEM_LAYOUT_RULE].Set(3)
						rebar.Parameter[BuiltInParameter.REBAR_ELEM_QUANTITY_OF_BARS].Set(wanc.N)
						rebar.Parameter[BuiltInParameter.REBAR_ELEM_BAR_SPACING].Set(wanc.Step)
					else:
						rebar.Parameter[BuiltInParameter.REBAR_ELEM_LAYOUT_RULE].Set(0)
						
					distPathDir = rebar.GetShapeDrivenAccessor().GetDistributionPath().Direction.Normalize()
					if VecABS(distPathDir).IsAlmostEqualTo(VecABS(wanc.DistPathDir)) and not distPathDir.IsAlmostEqualTo(wanc.DistPathDir):
						loc = GetRebarLocAndDir(rebar, wp)[0]
						plane = Plane.CreateByNormalAndOrigin(distPathDir, loc)
#						ElementTransformUtils.MirrorElement(doc, rebar.Id, plane)
						ElementTransformUtils.MirrorElements(doc, List[ElementId]([rebar.Id]), plane, False)
	
					rebar.SetSolidInView(doc.ActiveView, True)
					updatedRebars[-1].append(rebar)
					
	if rebarsV:
		for rebar in rebarsV:
			doc.Delete(rebar.Id)
			
TransactionManager.Instance.TransactionTaskDone()

OUT = updatedRebars, WPars, WRebs
# ----------------------------------------
end_2 = Revit.Transaction.Transaction.End(input=корректировка_вертикального)
корректировка_вертикальных_п_шек = Python(IN[0]=end_2, IN[1]=имя_формы_п_шек)
# ---------- корректировка_вертикальных_п_шек.python (166 lines) ----------
import sys
import clr
import math
import System
clr.AddReference('RevitAPI')
from Autodesk.Revit.DB import *
from Autodesk.Revit.DB.Structure import *
clr.AddReference('RevitServices')
from RevitServices.Persistence import DocumentManager
from RevitServices.Transactions import TransactionManager

doc = DocumentManager.Instance.CurrentDBDocument

WPars = IN[0][1]
WRebs = IN[0][2]


def ByElevation(lvl):
	return round(lvl.Elevation*304.8)

levels = []
for lvl in sorted(FilteredElementCollector(doc).OfClass(Level).ToElements(), key=ByElevation):
	if len(lvl.Name.split('.')) == 1:
		levels.append([])
		levels[-1].append(lvl)
	else:
		levels[-1].append(lvl)

optForSlabs = Options()

def VecABS(vec):
	x = abs(vec.X)
	y = abs(vec.Y)
	z = abs(vec.Z)
	return XYZ(x,y,z)
	
def MultiplyVecs(vec1, vec2):
	x = vec1.X * vec2.X
	y = vec1.Y * vec2.Y
	z = vec1.Z * vec2.Z
	return XYZ(x,y,z)
	
def GetNonZeroCoord(vec):
	if round(vec.X*304.8) != 0:
		return vec.X
	elif round(vec.Y*304.8) != 0:
		return vec.Y
	else:
		return vec.Z
		
def GetVecToken(vec):
	return vec.X+vec.Y+vec.Z
	
def GetRebarsForIntSide(allRebarsV, wp):
	rebars = []
	for rebar in allRebarsV:
		extFace = [face for face in wp.Solid.Faces if face.FaceNormal.Normalize().IsAlmostEqualTo(wp.Orient)][0]
		intFace = [face for face in wp.Solid.Faces if face.FaceNormal.Normalize().IsAlmostEqualTo(-wp.Orient)][0]
		line = rebar.GetCenterlineCurves(False, True, True, MultiplanarOption.IncludeOnlyPlanarCurves, 0)[0]
		p0 = line.GetEndPoint(0) + XYZ.BasisZ*10/304.8
		extDst = p0.DistanceTo(extFace.Project(p0).XYZPoint)
		intDst = p0.DistanceTo(intFace.Project(p0).XYZPoint)
		if extDst > intDst:
			rebars.append(rebar)
	return rebars
	
def GetOriginsForUVRebars(allRebarsV, wp):
	rebars =  [r for r in GetRebarsForIntSide(allRebarsV, wp) if r.Parameter[BuiltInParameter.REBAR_BAR_DIAMETER].AsDouble()*304.8 < 20]
	origins = []
	for rebar in rebars:
		line = rebar.GetCenterlineCurves(False, True, True, MultiplanarOption.IncludeOnlyPlanarCurves, 0)[0]
		point = line.GetEndPoint(1)
		n = rebar.Parameter[BuiltInParameter.REBAR_ELEM_QUANTITY_OF_BARS].AsInteger()
		d = rebar.Parameter[BuiltInParameter.REBAR_BAR_DIAMETER].AsDouble()
		if n > 1:
			step = rebar.Parameter[BuiltInParameter.REBAR_ELEM_BAR_SPACING].AsDouble()
		else:
			step = None
		origins.append([point, n, step, d])
	return origins
	
def GetRebarLocAndDir(rebar):
	if rebar.GetType() == RebarInSystem:
		centerLine = rebar.GetCenterlineCurves(False, True, True)[0]
		dir2 = VecABS(rebar.Normal.Normalize())
	else:
		centerLine = rebar.GetCenterlineCurves(False, True, True, MultiplanarOption.IncludeOnlyPlanarCurves, 0)[0]
		dir2 = VecABS(rebar.GetShapeDrivenAccessor().Normal.Normalize())
	loc = centerLine.GetEndPoint(0)
	dir = VecABS(centerLine.Direction)
	return loc, dir, dir2
	
def GetNearestUVRebar(p0, rebars):
	nearestRebar = None
	dsts = []
	for rebar in rebars:
		loc = GetRebarLocAndDir(rebar)[0]
		dst = loc.DistanceTo(p0)
		dsts.append(dst)
	if dsts:
		minDst = min(dsts)
		for i, rebar in enumerate(rebars):
			loc = GetRebarLocAndDir(rebar)[0]
			dst = loc.DistanceTo(p0)
			if dst == minDst:
				nearestRebar = rebars.pop(i)
				break
	return nearestRebar
	
def ModifyUVRebars(rebarsV, rebarsUV, wp, wr):
	host = doc.GetElement(ElementId(wp.Id))
	origins = GetOriginsForUVRebars(rebarsV, wp)
	xvec = -XYZ.BasisZ
	yvec = wp.Orient
	rebars = []
	for p in origins:
		rebarType = [rt for rt in FilteredElementCollector(doc).OfClass(RebarBarType).ToElements() if rt.Parameter[BuiltInParameter.SYMBOL_NAME_PARAM].AsString().find('A500') != -1 and round(rt.Parameter[BuiltInParameter.REBAR_BAR_DIAMETER].AsDouble()*304.8) == round(p[3]*304.8) and rt.get_Parameter(System.Guid('844a01e2-19fc-4dc5-baa0-a4bda30ef1f6')).AsInteger() == 0][0]

		placePoint = p[0] + wp.Dir*(p[3]) - yvec*(p[3]/2)
		
		rebar = GetNearestUVRebar(placePoint, rebarsUV)
		if rebar:
			rebar.GetShapeDrivenAccessor().SetRebarShapeId(shapeUV.Id)			
			rebar.ChangeTypeId(rebarType.Id)
			rebar.Parameter[BuiltInParameter.REBAR_ELEM_LAYOUT_RULE].Set(3)
			rebar.Parameter[BuiltInParameter.REBAR_ELEM_QUANTITY_OF_BARS].Set(p[1])
			if p[1] > 1:
				rebar.Parameter[BuiltInParameter.REBAR_ELEM_BAR_SPACING].Set(p[2])

			xVecBox = xvec*(wp.GetUpperSlabThickness(p[0])*2)
			yVecBox = yvec*(wp.T - wr.CovExt - wr.CovInt-wr.DX*2)
			rebar.GetShapeDrivenAccessor().ScaleToBox(placePoint, xVecBox, yVecBox)
			rebar.SetSolidInView(doc.ActiveView, True)
			rebars.append(rebar)
	doc.Regenerate()
	return rebars, origins
	
shapeUV = [shape for shape in FilteredElementCollector(doc).OfClass(RebarShape).ToElements() if shape.Parameter[BuiltInParameter.SYMBOL_NAME_PARAM].AsString() == IN[1]][0]

TransactionManager.Instance.EnsureInTransaction(doc)

updatedRebars = []

for i, wp in enumerate(WPars):
	wall = doc.GetElement(ElementId(wp.Id))
	rebars = [doc.GetElement(id) for id in wall.GetDependentElements(ElementClassFilter(Rebar))]
	rebarsUV = []
	for rebar in rebars:
		dir = GetRebarLocAndDir(rebar)[1]
		shapeId = rebar.GetShapeId().IntegerValue
		rebarPart = rebar.Parameter[BuiltInParameter.NUMBER_PARTITION_PARAM].AsString()
		if dir.IsAlmostEqualTo(XYZ.BasisZ) and shapeId == shapeUV.Id.IntegerValue and rebarPart == '02_П-образные хомуты':
			rebarsUV.append(rebar)
	if rebarsUV:
		rebarsV = []
		for rebar in rebars:
			dir = GetRebarLocAndDir(rebar)[1]
			isSimple = doc.GetElement(rebar.GetShapeId()).SimpleLine
			if dir.IsAlmostEqualTo(XYZ.BasisZ) and isSimple:
				rebarsV.append(rebar)
		wr = WRebs[i]
		updatedRebars.append(ModifyUVRebars(rebarsV, rebarsUV, wp, wr))

TransactionManager.Instance.TransactionTaskDone()

OUT = updatedRebars
# ----------------------------------------

удаление_армирования_по_площади = Python(IN[0]=end_2)
# ---------- удаление_армирования_по_площади.python (30 lines) ----------
import sys
import clr
import math
import System
clr.AddReference('RevitAPI')
from Autodesk.Revit.DB import *
from Autodesk.Revit.DB.Structure import *
clr.AddReference('RevitServices')
from RevitServices.Persistence import DocumentManager
from RevitServices.Transactions import TransactionManager

doc = DocumentManager.Instance.CurrentDBDocument

data = IN[0]
WPars = data[1]

ARsToDelete = []

for wp in WPars:
	wall = doc.GetElement(ElementId(wp.Id))
	ARsToDelete += list(wall.GetDependentElements(ElementClassFilter(AreaReinforcement)))
	
TransactionManager.Instance.EnsureInTransaction(doc)

for id in ARsToDelete:
	doc.Delete(id)

TransactionManager.Instance.TransactionTaskDone()

OUT = data
# ----------------------------------------
end_3 = Revit.Transaction.Transaction.End(input=удаление_армирования_по_площади)

# group: Расстановка горизонтальной арматуры
расстановка_горизонтальной = Python(IN[0]=end_3, IN[1]=минимальное_смещение)  # "Расстановка горизонтальной арматуры как армирование по площади"
# ---------- расстановка_горизонтальной.python (168 lines) ----------
import sys
import clr
import math
import System
clr.AddReference('System')
from System.Collections.Generic import List
clr.AddReference('RevitAPI')
from Autodesk.Revit.DB import *
from Autodesk.Revit.DB.Structure import *
clr.AddReference('RevitServices')
from RevitServices.Persistence import DocumentManager
from RevitServices.Transactions import TransactionManager

doc = DocumentManager.Instance.CurrentDBDocument

rebars = IN[0][0]
WPars = IN[0][1]
WRebs = IN[0][2]

def ByElevation(lvl):
	return round(lvl.Elevation*304.8)

levels = []
for lvl in sorted(FilteredElementCollector(doc).OfClass(Level).ToElements(), key=ByElevation):
	if len(lvl.Name.split('.')) == 1:
		levels.append([])
		levels[-1].append(lvl)
	else:
		levels[-1].append(lvl)

optForSlabs = Options()

def VecABS(vec):
	x = abs(vec.X)
	y = abs(vec.Y)
	z = abs(vec.Z)
	return XYZ(x,y,z)
	
def GetVecToken(vec):
	return vec.X + vec.Y + vec.Z
	
def GetSlabThickness(lvl, catchPoint):
	filter = ElementLevelFilter(lvl.Id)
	slabs = FilteredElementCollector(doc).OfClass(Floor).WherePasses(filter).ToElements()
	t = -15/304.8
	for slab in slabs:
		mainFace = [face for face in list(slab.Geometry[optForSlabs])[0].Faces if face.FaceNormal.Normalize().IsAlmostEqualTo(XYZ.BasisZ)][0]
		if mainFace.Project(catchPoint) is not None:
			t = slab.Parameter[BuiltInParameter.FLOOR_ATTR_THICKNESS_PARAM].AsDouble()
			break
	return t

def CreateCutline(wp, lvlBot, botSlabT):
	sp = wp.CenterLine.GetEndPoint(0)
	ep = wp.CenterLine.GetEndPoint(1)
	p0 = XYZ(sp.X, sp.Y, lvlBot.Elevation + botSlabT)
	p1 = XYZ(ep.X, ep.Y, lvlBot.Elevation + botSlabT)
	return Line.CreateBound(p0, p1)
	
def GetJoinedWallThickness(wp, point):
	catchPoint = point + XYZ.BasisZ * wp.H/2
	filter = BoundingBoxContainsPointFilter(catchPoint)
	walls = FilteredElementCollector(doc).OfClass(Wall).WherePasses(filter).Excluding(List[ElementId]([ElementId(wp.Id)])).ToElements()
	if walls:
		cutline = Line.CreateBound(catchPoint, catchPoint + XYZ.BasisZ * 10/304.8)
		wall = walls[0]
		solid = list(wall.Geometry[Options()])[0]		
		if list(solid.IntersectWithCurve(cutline, None)):
			return walls[0].Width
		else:
			return float(0)
	else:
		return float(0)	

def CreateHRebars(wp, wr, lvlBot, lvlTop):

	ARType = FilteredElementCollector(doc).OfClass(AreaReinforcementType).ToElementIds()[0]
	
	rebarType = [rt for rt in FilteredElementCollector(doc).OfClass(RebarBarType).ToElements() if rt.Parameter[BuiltInParameter.SYMBOL_NAME_PARAM].AsString().find('A500') != -1 and round(rt.Parameter[BuiltInParameter.REBAR_BAR_DIAMETER].AsDouble()*304.8) == round(wr.DX*304.8) and rt.get_Parameter(System.Guid('844a01e2-19fc-4dc5-baa0-a4bda30ef1f6')).AsInteger() == 1][0]

	botSlabT = GetSlabThickness(lvlBot, wp.GetMidPointOfCenterLine())
	offsetMin =  IN[1]/304.8
	N = int(math.floor((lvlTop.Elevation-(lvlBot.Elevation+botSlabT)-2*offsetMin)/wr.StepX))+1
	offsetStart = (lvlTop.Elevation - (lvlBot.Elevation+botSlabT) - wr.StepX*(N-1))/2
	
	if VecABS(wp.Dir).IsAlmostEqualTo(XYZ.BasisY) and wp.JoinedWallsAtStart and wp.JoinedWallsAtEnd:
		additOffset = wr.DX
	else:
		additOffset = 0
	
	cutline = CreateCutline(wp, lvlBot, botSlabT).CreateOffset(offsetStart, XYZ.BasisZ.CrossProduct(wp.Dir))
	
	for n in range(N):
		spotlines = list(wp.Solid.IntersectWithCurve(cutline, None))
		if spotlines:
			mainFace = [face for face in wp.Solid.Faces if face.FaceNormal.Normalize().IsAlmostEqualTo(wp.Orient)][0]
			
			baseOffset = -float(spotlines[0].Origin.Z - wp.GetBaseZ() - wr.DX/2 - additOffset) #* GetVecToken(wp.Orient) 
			topOffset = -(wp.H - abs(baseOffset) - math.floor((wp.H - (abs(baseOffset) + wr.DX/2)) / wr.StepX) * wr.StepX - wr.DX) #* GetVecToken(wp.Orient) 
			
			ARCurveLoops = []
			
			wallCurveLoops = mainFace.GetEdgesAsCurveLoops()
			offsets = []
			
			for curves in wallCurveLoops:
				offsets.append([])
				for cur in curves:
					if cur.Direction.Normalize().IsAlmostEqualTo(-wp.Dir):
						offsets[-1].append(baseOffset)
					elif cur.Direction.Normalize().IsAlmostEqualTo(wp.Dir):	
						offsets[-1].append(topOffset)
					elif cur.Direction.Normalize().IsAlmostEqualTo(XYZ.BasisZ) and wp.JoinAllowedAtStart and abs(wp.Dir.DotProduct(cur.Origin) - wp.Dir.DotProduct(wp.SP)) <= wp.T/2:	
						offsets[-1].append(GetJoinedWallThickness(wp, wp.SP)-20/304.8)
					elif cur.Direction.Normalize().IsAlmostEqualTo(-XYZ.BasisZ) and wp.JoinAllowedAtEnd and abs(wp.Dir.DotProduct(wp.EP) - wp.Dir.DotProduct(cur.Origin)) <= wp.T/2:	
						offsets[-1].append(GetJoinedWallThickness(wp, wp.EP)-20/304.8)
					else:
						offsets[-1].append(float(0))
				
			for i, cl in enumerate(wallCurveLoops):
				ARCurveLoops.append(CurveLoop.CreateViaOffset(cl, offsets[i], wp.Orient))
			break			
		cutline = cutline.CreateOffset(wr.StepX, XYZ.BasisZ.CrossProduct(wp.Dir))
	
	ARs = []
	for cl in ARCurveLoops:
		ARext = AreaReinforcement.Create(doc, doc.GetElement(ElementId(wp.Id)), list(cl), wp.Dir, ARType, rebarType.Id, ElementId.InvalidElementId)
		ARext.Parameter[BuiltInParameter.REBAR_SYSTEM_ACTIVE_TOP_DIR_1_GENERIC].Set(True)
		ARext.Parameter[BuiltInParameter.REBAR_SYSTEM_ACTIVE_TOP_DIR_2_GENERIC].Set(False)
		ARext.Parameter[BuiltInParameter.REBAR_SYSTEM_ACTIVE_BOTTOM_DIR_1_GENERIC].Set(False)
		ARext.Parameter[BuiltInParameter.REBAR_SYSTEM_ACTIVE_BOTTOM_DIR_2_GENERIC].Set(False)
		ARext.Parameter[BuiltInParameter.REBAR_SYSTEM_SPACING_TOP_DIR_1_GENERIC].Set(wr.StepX)
		ARext.Parameter[BuiltInParameter.NUMBER_PARTITION_PARAM].Set('01_Расположение_Горизонтальная_Наружняя')
		doc.Regenerate()
		[rebar.SetSolidInView(doc.ActiveView, True) for rebar in [doc.GetElement(id) for id in ARext.GetRebarInSystemIds()]]
	
		ARint = AreaReinforcement.Create(doc, doc.GetElement(ElementId(wp.Id)), list(cl), wp.Dir, ARType, rebarType.Id, ElementId.InvalidElementId)
		ARint.Parameter[BuiltInParameter.REBAR_SYSTEM_ACTIVE_TOP_DIR_1_GENERIC].Set(False)
		ARint.Parameter[BuiltInParameter.REBAR_SYSTEM_ACTIVE_TOP_DIR_2_GENERIC].Set(False)
		ARint.Parameter[BuiltInParameter.REBAR_SYSTEM_ACTIVE_BOTTOM_DIR_1_GENERIC].Set(True)
		ARint.Parameter[BuiltInParameter.REBAR_SYSTEM_ACTIVE_BOTTOM_DIR_2_GENERIC].Set(False)
		ARint.Parameter[BuiltInParameter.REBAR_SYSTEM_SPACING_BOTTOM_DIR_1_GENERIC].Set(wr.StepX)
		ARint.Parameter[BuiltInParameter.NUMBER_PARTITION_PARAM].Set('01_Расположение_Горизонтальная_Внутренняя')
		doc.Regenerate()
		[rebar.SetSolidInView(doc.ActiveView, True) for rebar in [doc.GetElement(id) for id in ARint.GetRebarInSystemIds()]]
		
		ARs.append(ARint)
	
	doc.Regenerate()
	return ARs

TransactionManager.Instance.EnsureInTransaction(doc)

newARs = []

for i, wp in enumerate(WPars):
	for j in range(len(levels)-1):
		baseLvl = levels[j][0]
		topLvl = levels[j+1][0]
		if wp.GetBaseZ() >= baseLvl.Elevation and wp.GetBaseZ() <= topLvl.Elevation: 
			wr = WRebs[i]
			ARs = CreateHRebars(wp, wr, baseLvl, topLvl)
			newARs.append(ARs)
			break

TransactionManager.Instance.TransactionTaskDone()

OUT = rebars, WPars, WRebs, newARs
# ----------------------------------------
end_4 = Revit.Transaction.Transaction.End(input=расстановка_горизонтальной)
расстановка_горизонтальных_п_шек = Python(IN[0]=end_4, IN[1]=имя_формы_п_шек)  # frozen
# ---------- расстановка_горизонтальных_п_шек.python (81 lines) ----------
# Загрузить стандартную библиотеку Python и библиотеку DesignScript
import sys
import clr
import math
import System
clr.AddReference('RevitAPI')
from Autodesk.Revit.DB import *
from Autodesk.Revit.DB.Structure import *
clr.AddReference('RevitServices')
from RevitServices.Persistence import DocumentManager
from RevitServices.Transactions import TransactionManager
clr.AddReference('RevitNodes')
import Revit
clr.ImportExtensions(Revit.Elements)
clr.ImportExtensions(Revit.GeometryConversion)

doc = DocumentManager.Instance.CurrentDBDocument

ARs = UnwrapElement(IN[0][4])
WPars = IN[0][1]
WRebs = IN[0][2]
	
def GetOriginsForUHRebars(AR, wp):
	rebars = [doc.GetElement(id) for id in AR.GetRebarInSystemIds()]
	lines = [rebar.GetCenterlineCurves(False, True, True)[0] for rebar in rebars] 
	origins = []
	for i, line in enumerate(lines):
		points = [line.GetEndPoint(0), line.GetEndPoint(1)]
		for j, p in enumerate(points):
			n = rebars[i].Parameter[BuiltInParameter.REBAR_ELEM_QUANTITY_OF_BARS].AsInteger()
			if n > 1:
				step = rebars[i].Parameter[BuiltInParameter.REBAR_ELEM_BAR_SPACING].AsDouble()
			else:
				step = None
			if j == 0:
				token = 1
			else:
				token = -1
			origins.append([p, n, step, token])
	return origins
	
def CreateUHRebars(AR, wp, wr):
	rebarType = [rt for rt in FilteredElementCollector(doc).OfClass(RebarBarType).ToElements() if rt.Parameter[BuiltInParameter.SYMBOL_NAME_PARAM].AsString().find('A500') != -1 and round(rt.Parameter[BuiltInParameter.REBAR_BAR_DIAMETER].AsDouble()*304.8) == round(wr.DX*304.8) and rt.get_Parameter(System.Guid('844a01e2-19fc-4dc5-baa0-a4bda30ef1f6')).AsInteger() == 0][0]
	shape = [shape for shape in FilteredElementCollector(doc).OfClass(RebarShape).ToElements() if shape.Parameter[BuiltInParameter.SYMBOL_NAME_PARAM].AsString() == IN[1]][0]
	host = doc.GetElement(AR.GetHostId())
	origins = GetOriginsForUHRebars(AR, wp) 
	xvec = wp.Dir
	yvec = wp.Orient
	rebars = []
	for p in origins:
		placePoint = p[0] + XYZ.BasisZ*wr.DX/2*p[3] - xvec*wr.DX/2*p[3] 
		rebar = Rebar.CreateFromRebarShape(doc, shape, rebarType, host, placePoint, xvec*p[3], yvec)
		doc.Regenerate()
		rebar.Parameter[BuiltInParameter.REBAR_ELEM_LAYOUT_RULE].Set(3)
		rebar.Parameter[BuiltInParameter.REBAR_ELEM_QUANTITY_OF_BARS].Set(p[1])
		if p[1] > 1:
			rebar.Parameter[BuiltInParameter.REBAR_ELEM_BAR_SPACING].Set(p[2])
		rebar.get_Parameter(System.Guid('b10d2260-5080-470d-be69-e136df3b45f6')).Set(wp.T*2)
		rebar.get_Parameter(System.Guid('f4e10dbb-3a1c-4567-972d-b36679e122ad')).Set(wp.T - wr.CovExt - wr.CovInt)
		rebar.Parameter[BuiltInParameter.NUMBER_PARTITION_PARAM].Set('02_П-образные хомуты')
		rebars.append(rebar)
	doc.Regenerate()
	return rebars
	
# Введенные в этом узле данные сохраняется в виде списка в переменных IN.

TransactionManager.Instance.EnsureInTransaction(doc)

newRebars = []
test = []

for i, ARset in enumerate(ARs):
	wp = WPars[i]
	wr = WRebs[i]
	for AR in ARset:	
		newRebars.append(CreateUHRebars(AR, wp, wr))

TransactionManager.Instance.TransactionTaskDone()

# Назначьте вывод переменной OUT
OUT = newRebars
# ----------------------------------------

# group: Расстоновка вертикальной арматуры по наличию арматурных выпусков
расстановка_вертикальной = Python(IN[0]=сбор_данных, IN[1]=имя_рабочего_3d_вида_2)  # "Расстановка вертикальной арматуры"; frozen
# ---------- расстановка_вертикальной.python (351 lines) ----------
# Загрузить стандартную библиотеку Python и библиотеку DesignScript
import sys
import clr
import math
import System
clr.AddReference('RevitAPI')
from Autodesk.Revit.DB import *
from Autodesk.Revit.DB.Structure import *
clr.AddReference('RevitServices')
from RevitServices.Persistence import DocumentManager
from RevitServices.Transactions import TransactionManager
clr.AddReference('RevitNodes')
import Revit
clr.ImportExtensions(Revit.Elements)
clr.ImportExtensions(Revit.GeometryConversion)

doc = DocumentManager.Instance.CurrentDBDocument

WPars = IN[0][0]
WRebs = IN[0][1]

workView = [view for view in FilteredElementCollector(doc).OfClass(View3D).ToElements() if view.Name == IN[1]][0]

def ByElevation(lvl):
	return round(lvl.Elevation*304.8)

levels = []
for lvl in sorted(FilteredElementCollector(doc).OfClass(Level).ToElements(), key=ByElevation):
	if len(lvl.Name.split('.')) == 1:
		levels.append([])
		levels[-1].append(lvl)
	else:
		levels[-1].append(lvl)

optForSlabs = Options()
optForRebars = Options()
optForRebars.View = workView

def VecABS(vec):
	x = abs(vec.X)
	y = abs(vec.Y)
	z = abs(vec.Z)
	return XYZ(x,y,z)

RbtValues = {'B15':0.75, 'B20':0.9, 'B25':1.05, 'B30':1.15, 'B35':1.3, 'B40':1.4, 'B45':1.5}

def ComputeBaseAnchorLength(d, bclass):
	Rbt = RbtValues[bclass]
	Rs = 435
	Rbond = Rbt*2.5*1
	As = (math.pi*d**2)/4
	us = math.pi*d
	l0an = (Rs*As)/(Rbond*us)
	return l0an
	
def ComputeAnchorLength(d, bclass):
	l0an = ComputeBaseAnchorLength(d, bclass)
	lan = 0.75*l0an
	return math.ceil(max([0.3*l0an, 15*d, 200/304.8, lan])*304.8/10)*10/304.8
	
def ComputeOverlapLength(d, bclass):
	l0an = ComputeBaseAnchorLength(d, bclass)
	lan = 0.9*l0an
	return math.ceil(max([0.3*l0an, 15*d, 200/304.8, lan])*304.8/10)*10/304.8
	
class WallAnchor:
	def __init__(self):
		self.Location = None
		self.L = None
		self.D = None
		self.N = None
		self.Step = None
		self.DistPathDir = None
		self.Assignment = 'Linear'
	
	def RefreshData(self, wp, rebar):
		solid = wp.Solid
		if rebar.GetType() == Rebar:
			for item in rebar.GetCenterlineCurves(False, True, True, MultiplanarOption.IncludeOnlyPlanarCurves, 0):
				if item.GetType() == Line and VecABS(item.Direction.Normalize()).IsAlmostEqualTo(XYZ.BasisZ):
					spotlines = list(solid.IntersectWithCurve(item, None))
					if len(list(spotlines)) > 0:
						sp = spotlines[0].GetEndPoint(0)
						self.Location = XYZ(sp.X, sp.Y, wp.Z)
						self.L = round(spotlines[0].Length*304.8)/304.8
						self.D = rebar.Parameter[BuiltInParameter.REBAR_BAR_DIAMETER].AsDouble()
						self.N = rebar.Parameter[BuiltInParameter.REBAR_ELEM_QUANTITY_OF_BARS].AsInteger()
						self.Step = rebar.Parameter[BuiltInParameter.REBAR_ELEM_BAR_SPACING].AsDouble()
						self.DistPathDir = rebar.GetShapeDrivenAccessor().GetDistributionPath().Direction.Normalize()
						break
		elif rebar.GetType() == FamilyInstance:
			for item in list(list(rebar.Geometry[optForRebars])[0].GetInstanceGeometry()):
				if item.GetType() == Line and VecABS(item.Direction.Normalize()).IsAlmostEqualTo(XYZ.BasisZ) and item.GraphicsStyleId.IntegerValue != 4062406:
					spotlines = list(solid.IntersectWithCurve(item, None))
					if len(list(spotlines)) > 0:
						sp = spotlines[0].GetEndPoint(0)
						self.Location = XYZ(sp.X, sp.Y, wp.Z)
						self.L = round(spotlines[0].Length*304.8)/304.8
						self.D = rebar.get_Parameter(System.Guid('9b679ab7-ea2e-49ce-90ab-0549d5aa36ff')).AsDouble()
						self.N = 1
						self.DistPathDir = -rebar.FacingOrientation.Normalize()
						break
		if self.L is not None:
			if round(self.L*304.8, -1) == round(ComputeAnchorLength(self.D, wp.BClass)*304.8):
				self.ForAnchor = True
				self.ForOverlap = False
			elif round(self.L*304.8, -1) == round(ComputeOverlapLength(self.D, wp.BClass)*304.8) or round(self.L*304.8, -1) == math.ceil(2.3*ComputeOverlapLength(self.D, wp.BClass)*304.8/10)*10:
				self.ForAnchor = False
				self.ForOverlap = True
			else:
				self.ForAnchor = None
				self.ForOverlap = None

	def UpdateRebarAssignment(self, wancs, wp):
		dstsToSingleSP = []
		dstsToSingleEP = []
		dstsToArray = []

		for wanc in wancs:
			if wanc.N == 1:
				dstsToSingleSP.append(round(wp.SP.DistanceTo(wanc.Location)*304.8))
				dstsToSingleEP.append(round(wp.EP.DistanceTo(wanc.Location)*304.8))		
			else:
				dstsToArray.append(round(wp.SP.DistanceTo(wanc.Location)*304.8))
				dstsToArray.append(round(wp.EP.DistanceTo(wanc.Location)*304.8))		
		dstsToSingleSP = sorted(set(dstsToSingleSP))
		dstsToSingleEP = sorted(set(dstsToSingleEP))
		dstsToArray = sorted(set(dstsToArray))
		for wanc in wancs:
			dst = min([round(wp.SP.DistanceTo(wanc.Location)*304.8), round(wp.EP.DistanceTo(wanc.Location)*304.8)])
			if wanc.N == 1:
				if dst == dstsToSingleSP[0] or dst == dstsToSingleSP[1] or dst == dstsToSingleEP[0] or dst == dstsToSingleEP[1]: 
					wanc.Assignment = 'Edge'
			elif dst == dstsToArray[0]:
				wanc.Assignment = 'EdgeLinear'
		
		opens = wp.GetOpenings()		
		if opens:
			for open in opens:
				dstsToSingleOpenSP = []
				dstsToSingleOpenEP = []
				for wanc in wancs:
					if wanc.N == 1:
						dstsToSingleOpenSP.append(round(open.SP.DistanceTo(wanc.Location)*304.8))
						dstsToSingleOpenEP.append(round(open.EP.DistanceTo(wanc.Location)*304.8))
				dstsToSingleOpenSP = sorted(set(dstsToSingleOpenSP))
				dstsToSingleOpenEP = sorted(set(dstsToSingleOpenEP))
				for wanc in wancs:
					if wanc.N == 1:
						dst = min([round(open.SP.DistanceTo(wanc.Location)*304.8), round(open.EP.DistanceTo(wanc.Location)*304.8)])
						if dst == dstsToSingleOpenSP[0] or dst == dstsToSingleOpenSP[1] or dst == dstsToSingleOpenEP[0] or dst == dstsToSingleOpenEP[1]: 
							wanc.Assignment = 'NearOpening'
				
#		return dstsToSingleSP, dstsToSingleEP, dstsToArray, [wanc.Assignment for wanc in wancs]
				
def GetRebarLevel(rebar):
	if rebar.GetType() == Rebar:
		host = doc.GetElement(rebar.GetHostId())
		lvl = doc.GetElement(host.LevelId)
	elif rebar.GetType() == FamilyInstance:	
		lvl = doc.GetElement(rebar.LevelId)
	else:
		lvl = None
	return lvl

def GetWallAnchors(wp):
	pLvl = wp.GetPreviousLevel()
	rebars = [rebar for rebar in FilteredElementCollector(doc, workView.Id).OfCategory(BuiltInCategory.OST_Rebar).ToElements() if GetRebarLevel(rebar) is not None and GetRebarLevel(rebar).Id.IntegerValue == pLvl.Id.IntegerValue]
	WAncSet = []
	for rebar in rebars:
		wanc = WallAnchor()
		wanc.RefreshData(wp, rebar)
		if wanc.L is not None and wanc.ForOverlap:
			WAncSet.append(wanc)
	if WAncSet:
		wanc.UpdateRebarAssignment(WAncSet, wp)
	else:
		WAncSet.append(WallAnchor())
	return WAncSet#, rebars
	
def GetToken(wp, point):
	if point.IsAlmostEqualTo(wp.EP):
		token = -1
	else:
		token = 1
	return token
	
#def GetUpperSlabThickness(wp, catchPoint):
#	filter = ElementLevelFilter(wp.TopLvlId)
#	slabs = FilteredElementCollector(doc).OfClass(Floor).WherePasses(filter).ToElements()
#	t = 0
#	for slab in slabs:
#		mainFace = [face for face in list(slab.Geometry[optForSlabs])[0].Faces if face.FaceNormal.Normalize().IsAlmostEqualTo(XYZ.BasisZ)][0]
#		if mainFace.Project(catchPoint) is not None:
#			t = slab.Parameter[BuiltInParameter.FLOOR_ATTR_THICKNESS_PARAM].AsDouble()
#			break
#	return t
	
#def GetBottomSlabThickness(wp, catchPoint):
#	filter = ElementLevelFilter(wp.BottomLvlId)
#	slabs = FilteredElementCollector(doc).OfClass(Floor).WherePasses(filter).ToElements()
#	t = 0
#	for slab in slabs:
#		mainFace = [face for face in list(slab.Geometry[optForSlabs])[0].Faces if face.FaceNormal.Normalize().IsAlmostEqualTo(XYZ.BasisZ)][0]
#		if mainFace.Project(catchPoint) is not None:
#			t = slab.Parameter[BuiltInParameter.FLOOR_ATTR_THICKNESS_PARAM].AsDouble()
#			break
#	return t
	
def GetUpperWall(wp, point):
	catchPoint = point + XYZ.BasisZ*(wp.BaseOffset + wp.H + 400/304.8)
	filter = ElementLevelFilter(wp.TopLvlId)
	walls = FilteredElementCollector(doc).OfClass(Wall).WherePasses(filter).ToElements()
	upwall = None
	for wall in walls:
		filter = BoundingBoxContainsPointFilter(catchPoint)
		if filter.PassesFilter(wall):
			upwall = wall
			break
	return upwall
	
def CreateVRebars(wp, wr, wancs):
#	allAncLs = [round(wanc.L*304.8) for wanc in wancs]
	solid = wp.Solid
	lines = []
	additLines = []
	test = []
	for wanc in wancs:
		if wanc.Assignment == 'Edge':
			D = wr.DY2
		elif wanc.Assignment == 'NearOpening':
			D = wanc.D
		else:
			D = wr.DY1
#		if wp.BaseOffset == 0:
#			offset = GetBottomSlabThickness(wp, wanc.Location)
#		else:
#			offset = 0
		sp = wanc.Location# + offset
		cutline = Line.CreateBound(sp, sp + XYZ.BasisZ * wp.H)
		spotlines = list(solid.IntersectWithCurve(cutline, None))

		
		
		if len(spotlines) == 1: 
			upslabT = wp.GetUpperSlabThickness(wanc.Location)
			if wp.TopOffset == upslabT:
				upslabT = 0
			if wp.LvlParity == 1:
				rebarOffsetX = D/2 + wanc.D/2
			else:
				rebarOffsetX = -(D/2 + wanc.D/2)
			p0 = XYZ(sp.X, sp.Y, wp.Z) + wanc.DistPathDir*rebarOffsetX
			p1 = p0 + XYZ.BasisZ*(wp.H + upslabT)
			
			L0min = round(ComputeOverlapLength(wanc.D, wp.BClass)*304.8)
			L0max = math.ceil(ComputeOverlapLength(wanc.D, wp.BClass)*2.3/10*304.8)*10
			L = round(wanc.L*304.8, -1)
			
			rebarType = [rt for rt in FilteredElementCollector(doc).OfClass(RebarBarType).ToElements() if rt.Parameter[BuiltInParameter.SYMBOL_NAME_PARAM].AsString().find('A500') != -1 and round(rt.Parameter[BuiltInParameter.REBAR_BAR_DIAMETER].AsDouble()*304.8) == round(D*304.8) and rt.get_Parameter(System.Guid('844a01e2-19fc-4dc5-baa0-a4bda30ef1f6')).AsInteger() == 0 and rt.Parameter[BuiltInParameter.SYMBOL_NAME_PARAM].AsElementId() == ElementId.InvalidElementId][0]
#			uw = GetUpperWall(wp, p0)
#			test.append(uw)
			if GetUpperWall(wp, p0) is not None:
				placeTo = None
				uwpBClass = GetUpperWall(wp, p0).GetParameters('1Пп_Класс бетона')[0].AsString()
				
				test.append([D*304.8, L, L0min, L0max])
				
				if L == L0min:
					p1 = p1 + XYZ.BasisZ*ComputeOverlapLength(D, uwpBClass)
				elif L == L0max:
					p0 = p0 + XYZ.BasisZ*math.ceil(ComputeOverlapLength(D, wp.BClass)*1.3/10*304.8)*10/304.8
					p1 = p1 + XYZ.BasisZ*math.ceil(ComputeOverlapLength(D, uwpBClass)*2.3/10*304.8)*10/304.8
				
				upwallStep = GetUpperWall(wp, p0).GetParameters('1Пп_Арм_Вертикальная_Шаг')[0].AsDouble()
				if round(upwallStep*304.8) != round(wr.StepY*304.8) and wanc.N > 1:
					ancN = wanc.N - 1
					ancStep = wanc.Step
					wanc.N = math.ceil(float(wanc.N)/2)
					wanc.Step = upwallStep*2
					if wanc.Assignment != 'EdgeLinear':
						if L == L0min:
							p0 = p0 + wanc.DistPathDir*upwallStep/2 + XYZ.BasisZ*math.ceil(ComputeOverlapLength(D, wp.BClass)*1.3/10*304.8)*10/304.8
						elif L == L0max:
							p0 = p0 + wanc.DistPathDir*upwallStep/2 - XYZ.BasisZ*math.ceil(ComputeOverlapLength(D, wp.BClass)*1.3/10*304.8)*10/304.8
						p1 = p1 + wanc.DistPathDir*upwallStep/2
					elif wanc.Assignment == 'EdgeLinear':
						if L == L0min:
							p0a = p0 + wanc.DistPathDir*wr.StepY + XYZ.BasisZ*math.ceil(ComputeOverlapLength(D, wp.BClass)*1.3/10*304.8)*10/304.8
							p1a = p1 + wanc.DistPathDir*wr.StepY - XYZ.BasisZ*ComputeOverlapLength(D, uwpBClass) + XYZ.BasisZ*ComputeAnchorLength(D, uwpBClass)
						elif L == L0max:
							p0a = p0 + wanc.DistPathDir*wr.StepY - XYZ.BasisZ*math.ceil(ComputeOverlapLength(D, wp.BClass)*1.3/10*304.8)*10/304.8
							p1a = p1 + wanc.DistPathDir*wr.StepY - XYZ.BasisZ*math.ceil(ComputeOverlapLength(D, uwpBClass)*2.3/10*304.8)*10/304.8 + XYZ.BasisZ*ComputeAnchorLength(D, uwpBClass)
						additLines.append([[Line.CreateBound(p0a, p1a)], ancN, ancStep, rebarType, wanc.DistPathDir])
			else:
				placeTo = 'shortRebars'

				p1 = p1 - XYZ.BasisZ*15/304.8
				if L == L0max:
					p0 = p0 + XYZ.BasisZ*math.ceil(ComputeOverlapLength(D, wp.BClass)*1.3/10*304.8)*10/304.8
								
			lines.append([[Line.CreateBound(p0, p1)], placeTo, rebarType, wanc.DistPathDir])
					
	

	rebars = []
	shortRebars = []
	for i, line in enumerate(lines):
		rebar = Rebar.CreateFromCurves(doc, RebarStyle.Standard, line[2], None, None, doc.GetElement(ElementId(wp.Id)), line[3], line[0], RebarHookOrientation.Left, RebarHookOrientation.Left, True, False)
#		rebar.Parameter[BuiltInParameter.ALL_MODEL_INSTANCE_COMMENTS].Set(wancs[i].Assignment)
		rebar.Parameter[BuiltInParameter.REBAR_ELEM_LAYOUT_RULE].Set(3)
		rebar.Parameter[BuiltInParameter.REBAR_ELEM_QUANTITY_OF_BARS].Set(wancs[i].N)
		if wancs[i].N > 1:
			rebar.Parameter[BuiltInParameter.REBAR_ELEM_BAR_SPACING].Set(wancs[i].Step)
		rebars.append(rebar)
		if line[1] == 'shortRebars':
			shortRebars.append(rebar)
		
	for line in additLines:
		rebar = Rebar.CreateFromCurves(doc, RebarStyle.Standard, line[3], None, None, doc.GetElement(ElementId(wp.Id)), line[4], line[0], RebarHookOrientation.Left, RebarHookOrientation.Left, True, False)
		rebar.Parameter[BuiltInParameter.REBAR_ELEM_LAYOUT_RULE].Set(3)
		rebar.Parameter[BuiltInParameter.REBAR_ELEM_QUANTITY_OF_BARS].Set(line[1])
		if line[1] > 1:
			rebar.Parameter[BuiltInParameter.REBAR_ELEM_BAR_SPACING].Set(line[2])
		rebars.append(rebar)	
	
	doc.Regenerate()
	return rebars, shortRebars, test
	
# Введенные в этом узле данные сохраняется в виде списка в переменных IN.

TransactionManager.Instance.EnsureInTransaction(doc)

newRebars = []
newShortRebars = []

for i, wp in enumerate(WPars):
	wr = WRebs[i]
	wancs = GetWallAnchors(wp)
	RebarSet = CreateVRebars(wp, wr, wancs)
	newRebars.append(RebarSet[0])
	if RebarSet[1]:	
		newShortRebars.append(RebarSet[1])
	else:
		newShortRebars.append([None])

TransactionManager.Instance.TransactionTaskDone()


# Назначьте вывод переменной OUT
OUT = newRebars, WPars, WRebs, newShortRebars, RebarSet[2], wancs
# ----------------------------------------
настройка_защитного_слоя = Python(IN[0]=расстановка_вертикальной, IN[1]=расстояние_до_центра, IN[2]=защитный_слой_торцов_стен)
# ---------- настройка_защитного_слоя.python (101 lines) ----------
# Загрузить стандартную библиотеку Python и библиотеку DesignScript
import sys
import clr
clr.AddReference('RevitAPI')
from Autodesk.Revit.DB import *
from Autodesk.Revit.DB.Structure import *
clr.AddReference('RevitServices')
from RevitServices.Persistence import DocumentManager
from RevitServices.Transactions import TransactionManager

# Введенные в этом узле данные сохраняется в виде списка в переменных IN.
doc = DocumentManager.Instance.CurrentDBDocument

rebars = UnwrapElement(IN[0][0])
WPars = IN[0][1]
WRebs = IN[0][2]
shortRebars = IN[0][3]

def GetSide(rebar, wp):
	extFace = [face for face in wp.Solid.Faces if face.FaceNormal.Normalize().IsAlmostEqualTo(wp.Orient)][0]
	intFace = [face for face in wp.Solid.Faces if face.FaceNormal.Normalize().IsAlmostEqualTo(-wp.Orient)][0]
	line = rebar.GetCenterlineCurves(False, True, True, MultiplanarOption.IncludeOnlyPlanarCurves, 0)[0]
	p0 = line.GetEndPoint(0) + XYZ.BasisZ*300/304.8
	extDst = p0.DistanceTo(extFace.Project(p0).XYZPoint)
	intDst = p0.DistanceTo(intFace.Project(p0).XYZPoint)
	if extDst < intDst:
		return RebarConstraintTargetHostFaceType.Side0, '01_Расположение_Вертикальная_Наружняя'
	else:
		return RebarConstraintTargetHostFaceType.Side1, '01_Расположение_Вертикальная_Внутренняя'

TransactionManager.Instance.EnsureInTransaction(doc)

doc.Regenerate()

test = []

for i, wp in enumerate(WPars):
	wall = doc.GetElement(ElementId(wp.Id))
	wr = WRebs[i]
	dst1 = float(IN[1])/304.8 - wr.DX/2
	dst2 = float(IN[2])/304.8
	covTypes1 = [ct1 for ct1 in FilteredElementCollector(doc).OfClass(RebarCoverType).ToElements() if round(ct1.CoverDistance*304.8) == round(dst1*304.8)]
	if covTypes1:
		covType1 = covTypes1[0]
	else:
		covType1 = RebarCoverType.Create(doc, str(round(dst1*304.8)), dst1)
		
	covTypes2 = [ct2 for ct2 in FilteredElementCollector(doc).OfClass(RebarCoverType).ToElements() if round(ct2.CoverDistance*304.8) == round(dst2*304.8)]
	if covTypes2:
		covType2 = covTypes2[0]
	else:
		covType2 = RebarCoverType.Create(doc, str(round(dst2*304.8)), dst2)
		
	if wr.CovExt != dst1:
		wr.CovExt = dst1
		wall.Parameter[BuiltInParameter.CLEAR_COVER_EXTERIOR].Set(covType1.Id)
	if wr.CovInt != dst1:
		wr.CovInt = dst1
		wall.Parameter[BuiltInParameter.CLEAR_COVER_INTERIOR].Set(covType1.Id)
	if wr.CovOth != dst2:
		wr.CovOth = dst2
		wall.Parameter[BuiltInParameter.CLEAR_COVER_OTHER].Set(covType2.Id)


for i, rebarSet in enumerate(rebars):
	DH = WRebs[i].DX
	wp = WPars[i]
	for rebar in rebarSet:
		
#		DV = doc.GetElement(rebar.GetTypeId()).Parameter[BuiltInParameter.REBAR_BAR_DIAMETER].AsDouble()
#		covDst = doc.GetElement(doc.GetElement(rebar.GetHostId()).Parameter[BuiltInParameter.CLEAR_COVER_EXTERIOR].AsElementId()).Parameter[BuiltInParameter.COVER_TYPE_LENGTH].AsDouble()
		conMan = rebar.GetRebarConstraintsManager()
		handles = [con for con in conMan.GetAllHandles() if con.GetHandleName() == 'Сегмент стержня 1']
		
		for hand in handles:
#			const = conMan.GetCurrentConstraintOnHandle(hand)
#			if const:
#				if const.IsToHostFaceOrCover() and not const.IsToCover():
#					const.SetDistanceToTargetHostFace(-(covDst+DH+DV/2))
#				elif const.IsToCover():
#					const.SetDistanceToTargetCover(-DH)
#				else:
#					continue
#			else:
			consts = conMan.GetConstraintCandidatesForHandle(hand)
			const = [const for const in consts if const.GetRebarConstraintTargetHostFaceType() == GetSide(rebar, wp)[0] and const.IsToCover()][0]
			const.SetDistanceToTargetCover(-DH)
				
			conMan.SetPreferredConstraintForHandle(hand, const)
			
		part = GetSide(rebar, wp)[1]
		rebar.Parameter[BuiltInParameter.NUMBER_PARTITION_PARAM].Set(part)
		

	
doc.Regenerate()

TransactionManager.Instance.TransactionTaskDone()

# Назначьте вывод переменной OUT.
OUT = rebars, WPars, WRebs, shortRebars
# ----------------------------------------
end_5 = Revit.Transaction.Transaction.End(input=настройка_защитного_слоя)
расстановка_вертикальных_п_шек = Python(IN[0]=end_5, IN[1]=имя_формы_п_шек)
# ---------- расстановка_вертикальных_п_шек.python (123 lines) ----------
# Загрузить стандартную библиотеку Python и библиотеку DesignScript
import sys
import clr
import math
import System
clr.AddReference('RevitAPI')
from Autodesk.Revit.DB import *
from Autodesk.Revit.DB.Structure import *
clr.AddReference('RevitServices')
from RevitServices.Persistence import DocumentManager
from RevitServices.Transactions import TransactionManager

doc = DocumentManager.Instance.CurrentDBDocument

WPars = IN[0][1]
WRebs = IN[0][2]
rebars = UnwrapElement(IN[0][3])

def ByElevation(lvl):
	return round(lvl.Elevation*304.8)

levels = []
for lvl in sorted(FilteredElementCollector(doc).OfClass(Level).ToElements(), key=ByElevation):
	if len(lvl.Name.split('.')) == 1:
		levels.append([])
		levels[-1].append(lvl)
	else:
		levels[-1].append(lvl)

optForSlabs = Options()

def VecABS(vec):
	x = abs(vec.X)
	y = abs(vec.Y)
	z = abs(vec.Z)
	return XYZ(x,y,z)
	
def MultiplyVecs(vec1, vec2):
	x = vec1.X * vec2.X
	y = vec1.Y * vec2.Y
	z = vec1.Z * vec2.Z
	return XYZ(x,y,z)
	
def GetNonZeroCoord(vec):
	if round(vec.X*304.8) != 0:
		return vec.X
	elif round(vec.Y*304.8) != 0:
		return vec.Y
	else:
		return vec.Z
		
def GetVecToken(vec):
	return vec.X+vec.Y+vec.Z
	
def GetRebarsForIntSide(allRebarsV, wp):
	rebars = []
	for rebar in allRebarsV:
		extFace = [face for face in wp.Solid.Faces if face.FaceNormal.Normalize().IsAlmostEqualTo(wp.Orient)][0]
		intFace = [face for face in wp.Solid.Faces if face.FaceNormal.Normalize().IsAlmostEqualTo(-wp.Orient)][0]
		line = rebar.GetCenterlineCurves(False, True, True, MultiplanarOption.IncludeOnlyPlanarCurves, 0)[0]
		p0 = line.GetEndPoint(0) + XYZ.BasisZ*10/304.8
		extDst = p0.DistanceTo(extFace.Project(p0).XYZPoint)
		intDst = p0.DistanceTo(intFace.Project(p0).XYZPoint)
		if extDst > intDst:
			rebars.append(rebar)
	return rebars
	
def GetOriginsForUVRebars(allRebarsV, wp):
	rebars =  [r for r in GetRebarsForIntSide(allRebarsV, wp) if r.Parameter[BuiltInParameter.REBAR_BAR_DIAMETER].AsDouble()*304.8 < 20]
	origins = []
	for rebar in rebars:
		line = rebar.GetCenterlineCurves(False, True, True, MultiplanarOption.IncludeOnlyPlanarCurves, 0)[0]
		point = line.GetEndPoint(1)
		n = rebar.Parameter[BuiltInParameter.REBAR_ELEM_QUANTITY_OF_BARS].AsInteger()
		d = rebar.Parameter[BuiltInParameter.REBAR_BAR_DIAMETER].AsDouble()
		if n > 1:
			step = rebar.Parameter[BuiltInParameter.REBAR_ELEM_BAR_SPACING].AsDouble()
		else:
			step = None
		origins.append([point, n, step, d])
	return origins
	
def CreateUVRebars(rebarsV, wp, wr):
	shape = [shape for shape in FilteredElementCollector(doc).OfClass(RebarShape).ToElements() if shape.Parameter[BuiltInParameter.SYMBOL_NAME_PARAM].AsString() == IN[1]][0]
	Bdef = shape.get_Parameter(System.Guid('f4e10dbb-3a1c-4567-972d-b36679e122ad')).AsDouble()
	Breq = wp.T - wr.CovExt - wr.CovInt-wr.DX*2
	host = doc.GetElement(ElementId(wp.Id))
	origins = GetOriginsForUVRebars(rebarsV, wp)
	xvec = -XYZ.BasisZ
	yvec = wp.Orient
	rebars = []
	for p in origins:
		rebarType = [rt for rt in FilteredElementCollector(doc).OfClass(RebarBarType).ToElements() if rt.Parameter[BuiltInParameter.SYMBOL_NAME_PARAM].AsString().find('A500') != -1 and round(rt.Parameter[BuiltInParameter.REBAR_BAR_DIAMETER].AsDouble()*304.8) == round(p[3]*304.8) and rt.get_Parameter(System.Guid('844a01e2-19fc-4dc5-baa0-a4bda30ef1f6')).AsInteger() == 0][0]
		placePoint = p[0] + wp.Dir*p[3]/2 - yvec*(p[3]/2+(Bdef-Breq)) #+ XYZ.BasisZ*p[3]/2
		rebar = Rebar.CreateFromRebarShape(doc, shape, rebarType, host, placePoint, xvec, yvec)
		doc.Regenerate()
		rebar.Parameter[BuiltInParameter.REBAR_ELEM_LAYOUT_RULE].Set(3)
		rebar.Parameter[BuiltInParameter.REBAR_ELEM_QUANTITY_OF_BARS].Set(p[1])
		if p[1] > 1:
			rebar.Parameter[BuiltInParameter.REBAR_ELEM_BAR_SPACING].Set(p[2])
		rebar.get_Parameter(System.Guid('b10d2260-5080-470d-be69-e136df3b45f6')).Set(wp.GetUpperSlabThickness(p[0])*2)
		rebar.get_Parameter(System.Guid('f4e10dbb-3a1c-4567-972d-b36679e122ad')).Set(Breq)
		rebar.Parameter[BuiltInParameter.NUMBER_PARTITION_PARAM].Set('02_П-образные хомуты')
		rebars.append(rebar)
	doc.Regenerate()
	return rebars, origins
	
# Введенные в этом узле данные сохраняется в виде списка в переменных IN.

TransactionManager.Instance.EnsureInTransaction(doc)

newRebars = []

for i, rebarSet in enumerate(rebars):
	if rebarSet[0]:
		wp = WPars[i]
		wr = WRebs[i]
		newRebars.append(CreateUVRebars(rebarSet, wp, wr))

TransactionManager.Instance.TransactionTaskDone()

# Назначьте вывод переменной OUT
OUT = newRebars
# ----------------------------------------

расстановка_шпилек = Python(IN[0]=end_4, IN[1]=имя_формы_шпилек, IN[2]=шаг_шпилек)
# ---------- расстановка_шпилек.python (170 lines) ----------
import sys
import clr
import math
import System
clr.AddReference('RevitAPI')
from Autodesk.Revit.DB import *
from Autodesk.Revit.DB.Structure import *
clr.AddReference('RevitServices')
from RevitServices.Persistence import DocumentManager
from RevitServices.Transactions import TransactionManager

doc = DocumentManager.Instance.CurrentDBDocument

rebars = UnwrapElement(IN[0][0])
WPars = IN[0][1]
WRebs = IN[0][2]
ARs = UnwrapElement(IN[0][3])

optForSlabs = Options()

def VecABS(vec):
	x = abs(vec.X)
	y = abs(vec.Y)
	z = abs(vec.Z)
	return XYZ(x,y,z)

def ByZ(rebar):
	line = rebar.GetCenterlineCurves(False, True, True, MultiplanarOption.IncludeOnlyPlanarCurves, 0)[0]
	midpoint = line.ComputeDerivatives(0.5, True).Origin
	return midpoint.Z
	
def GetRebarsForIntSide(allRebarsV, wp):
	rebars = []
	for rebar in allRebarsV:
		extFace = [face for face in wp.Solid.Faces if face.FaceNormal.Normalize().IsAlmostEqualTo(wp.Orient)][0]
		intFace = [face for face in wp.Solid.Faces if face.FaceNormal.Normalize().IsAlmostEqualTo(-wp.Orient)][0]
		line = rebar.GetCenterlineCurves(False, True, True, MultiplanarOption.IncludeOnlyPlanarCurves, 0)[0]
		p0 = line.GetEndPoint(0) + XYZ.BasisZ*10/304.8
		extDst = p0.DistanceTo(extFace.Project(p0).XYZPoint)
		intDst = p0.DistanceTo(intFace.Project(p0).XYZPoint)
		if extDst > intDst:
			rebars.append(rebar)
	return rebars
	
def RebarIsOnFloor(rebar, wp):
	line = rebar.GetCenterlineCurves(False, True, True, MultiplanarOption.IncludeOnlyPlanarCurves, 0)[0]
	p0 = line.GetEndPoint(0)
	floor = wp.GetFloor(p0)
	if floor:
		mainFace = [face for face in list(floor.Geometry[optForSlabs])[0].Faces if face.FaceNormal.Normalize().IsAlmostEqualTo(XYZ.BasisZ)][0]
		projection = mainFace.Project(p0)
	else:
		bottomFaces = [face for face in wp.Solid.Faces if face.FaceNormal.Normalize().IsAlmostEqualTo(-XYZ.BasisZ)]
		for bf in bottomFaces:
			projection = bf.Project(p0)
			if projection:
				break				
	dst = round(p0.DistanceTo(projection.XYZPoint)*304.8)
	if dst == 0:
		return True, dst
	else:
		return False, dst
	
def GetOriginsForSRebars(AR, allRebarsV, wp):
	rebarsH = [doc.GetElement(id) for id in AR.GetRebarInSystemIds()]
	Zs = []
	for rebar in rebarsH:
		locZ = GetRebarLocAndDir(rebar)[0].Z
		Zs += [rebar.GetBarPositionTransform(i).Origin.Z + locZ for i in range(rebar.NumberOfBarPositions)]
	Zs = sorted(set(Zs))
	Zs1 = []
	Zs2 = []
	for i, z in enumerate(Zs):
		if i%2 == 0:
			Zs1.append(z)
		else:
			Zs2.append(z)
	rebarsV = [rebar for rebar in GetRebarsForIntSide(allRebarsV, wp) if rebar.LayoutRule != RebarLayoutRule.Single]
	origins = []
	for rebar in rebarsV:
		line = rebar.GetCenterlineCurves(False, True, True, MultiplanarOption.IncludeOnlyPlanarCurves, 0)[0]
		x = line.Origin.X
		y = line.Origin.Y
		if RebarIsOnFloor(rebar, wp)[0]:
			points = [XYZ(x,y,z) for z in Zs1]
			part = '06_Шпильки_Нечетный ряд'
		else:
			points = [XYZ(x,y,z) for z in Zs2]
			part = '06_Шпильки_Четный ряд'
		stepV = round(rebar.Parameter[BuiltInParameter.REBAR_ELEM_BAR_SPACING].AsDouble()*304.8)
		K = float(IN[2])/stepV
		n = int(math.ceil(float(rebar.Parameter[BuiltInParameter.REBAR_ELEM_QUANTITY_OF_BARS].AsInteger())/K))
		if n > 1:
			step = IN[2]/304.8
		else:
			step = None
		origins.append([points, n, step, part])
	return origins

def GetRebarLocAndDir(rebar):
	if rebar.GetType() == RebarInSystem:
		centerLine = rebar.GetCenterlineCurves(False, True, True)[0]
		dir2 = VecABS(rebar.Normal.Normalize())
	else:
		centerLine = rebar.GetCenterlineCurves(False, True, True, MultiplanarOption.IncludeOnlyPlanarCurves, 0)[0]
		dir2 = VecABS(rebar.GetShapeDrivenAccessor().Normal.Normalize())
	loc = centerLine.GetEndPoint(0)
	dir = VecABS(centerLine.Direction)
	return loc, dir, dir2

def EditConstrains(rebar):
	conMan = rebar.GetRebarConstraintsManager()
	handle = [con for con in conMan.GetAllHandles() if con.GetHandleName() == 'Начало стержня'][0]
	consts = conMan.GetConstraintCandidatesForHandle(handle)
	const = [const for const in consts if const.GetRebarConstraintTargetHostFaceType() == RebarConstraintTargetHostFaceType.Side0 and const.IsToCover()][0]
	const.SetDistanceToTargetCover(0)
	conMan.SetPreferredConstraintForHandle(handle, const)
	handle = [con for con in conMan.GetAllHandles() if con.GetHandleName() == 'Конец стержня'][0]
	consts = conMan.GetConstraintCandidatesForHandle(handle)
	const = [const for const in consts if const.GetRebarConstraintTargetHostFaceType() == RebarConstraintTargetHostFaceType.Side1 and const.IsToCover()][0]
	const.SetDistanceToTargetCover(0)
	conMan.SetPreferredConstraintForHandle(handle, const)
	doc.Regenerate()

def CreateSRebars(AR, rebarsV, wp, wr):
	
	shape = [shape for shape in FilteredElementCollector(doc).OfClass(RebarShape).ToElements() if shape.Parameter[BuiltInParameter.SYMBOL_NAME_PARAM].AsString() == IN[1]][0]
	rebarType = [rt for rt in FilteredElementCollector(doc).OfClass(RebarBarType).ToElements() if rt.Parameter[BuiltInParameter.SYMBOL_NAME_PARAM].AsString().find('A240') != -1 and round(rt.Parameter[BuiltInParameter.REBAR_BAR_DIAMETER].AsDouble()*304.8) == round(wr.DStud*304.8) and rt.get_Parameter(System.Guid('844a01e2-19fc-4dc5-baa0-a4bda30ef1f6')).AsInteger() == 0][0]
	host = doc.GetElement(ElementId(wp.Id))
	origins = GetOriginsForSRebars(AR, rebarsV, wp)
	rebars = []
	for pSet in origins:
		for p in pSet[0]:
			rsp = RebarSParameters(wp, wr, p)
			placePoint = rsp.Origin + wp.Dir*((wr.DY1)/2+wr.DStud)
			rebar = Rebar.CreateFromRebarShape(doc, shape, rebarType, host, placePoint, rsp.XVec, rsp.YVec)
			doc.Regenerate()
			rebar.Parameter[BuiltInParameter.REBAR_ELEM_LAYOUT_RULE].Set(3)
			rebar.Parameter[BuiltInParameter.REBAR_ELEM_QUANTITY_OF_BARS].Set(pSet[1])
			if pSet[1] > 1:
				rebar.Parameter[BuiltInParameter.REBAR_ELEM_BAR_SPACING].Set(pSet[2])
			rebar.Parameter[BuiltInParameter.NUMBER_PARTITION_PARAM].Set(pSet[3])
				
			EditConstrains(rebar)
			rebar.SetSolidInView(doc.ActiveView, True)
			rebars.append(rebar)

		doc.Regenerate()
	return rebars, origins
	
class RebarSParameters:
	def __init__(self, wp, wr, startPoint):
		self.Angle = math.asin((wr.DStudS + wr.DStud)/(wp.T-wr.CovExt-wr.CovInt-wr.DX))
		self.XVec = wp.Orient - XYZ.BasisZ * math.tan(self.Angle)
		self.YVec = XYZ.BasisZ + wp.Orient * math.tan(self.Angle)
		self.Origin = startPoint - self.XVec*(wr.DStudS/2 + wr.DStud*1.5) + self.YVec*wr.DStudS/2 - wp.Orient*(wr.DY1/2+wr.DX/2)
	
TransactionManager.Instance.EnsureInTransaction(doc)

newRebars = []

for i, ARset in enumerate(ARs):
	rebarsV = rebars[i]
	wp = WPars[i]
	wr = WRebs[i]
	newRebars.append(CreateSRebars(ARset[0], rebarsV, wp, wr))

TransactionManager.Instance.TransactionTaskDone()

OUT = newRebars
# ----------------------------------------
разборка_сборок = Python(IN[0]=активный_вид)  # frozen
# ---------- разборка_сборок.python (22 lines) ----------
import sys
import clr
clr.AddReference('RevitAPI')
from Autodesk.Revit.DB import *
clr.AddReference('RevitServices')
from RevitServices.Persistence import DocumentManager
from RevitServices.Transactions import TransactionManager

view = UnwrapElement(IN[0])

doc = DocumentManager.Instance.CurrentDBDocument

AIs = FilteredElementCollector(doc, view.Id).OfClass(AssemblyInstance).ToElements()

TransactionManager.Instance.EnsureInTransaction(doc)

for ai in AIs:
	ai.Disassemble()
	
TransactionManager.Instance.TransactionTaskDone()

OUT = 'выполнено'
# ----------------------------------------

# group (continued): Корректировка армирования
корректировка_горизонтальных_п = Python(IN[0]=end_4, IN[1]=имя_формы_п_шек)  # "Корректировка горизонтальных П-шек"
# ---------- корректировка_горизонтальных_п.python (127 lines) ----------
import sys
import clr
import math
import System
clr.AddReference('RevitAPI')
from Autodesk.Revit.DB import *
from Autodesk.Revit.DB.Structure import *
clr.AddReference('RevitServices')
from RevitServices.Persistence import DocumentManager
from RevitServices.Transactions import TransactionManager

doc = DocumentManager.Instance.CurrentDBDocument

data = IN[0]
WPars = data[1]
WRebs = data[2]
ARs = UnwrapElement(data[3])

def VecABS(vec):
	x = abs(vec.X)
	y = abs(vec.Y)
	z = abs(vec.Z)
	return XYZ(x,y,z)

def GetOriginsForUHRebars(AR, wp):
	rebars = [doc.GetElement(id) for id in AR.GetRebarInSystemIds()]
	lines = [rebar.GetCenterlineCurves(False, True, True)[0] for rebar in rebars] 
	origins = []
	for i, line in enumerate(lines):
		locZ = GetRebarLocAndDir(rebars[i])[0].Z
		Z = locZ + min([rebars[i].GetBarPositionTransform(j).Origin.Z for j in range(rebar.NumberOfBarPositions)])
		sp = XYZ(line.GetEndPoint(0).X, line.GetEndPoint(0).Y, Z)
		ep = XYZ(line.GetEndPoint(1).X, line.GetEndPoint(1).Y, Z)
		points = [sp, ep]
		for j, p in enumerate(points):
			n = rebars[i].Parameter[BuiltInParameter.REBAR_ELEM_QUANTITY_OF_BARS].AsInteger()
			if n > 1:
				step = rebars[i].Parameter[BuiltInParameter.REBAR_ELEM_BAR_SPACING].AsDouble()
			else:
				step = None
			if j == 0:
				token = 1
			else:
				token = -1
			origins.append([p, n, step, token])
	return origins
	
def GetRebarLocAndDir(rebar):
	if rebar.GetType() == RebarInSystem:
		centerLine = rebar.GetCenterlineCurves(False, True, True)[0]
		dir2 = VecABS(rebar.Normal.Normalize())
	else:
		centerLine = rebar.GetCenterlineCurves(False, True, True, MultiplanarOption.IncludeOnlyPlanarCurves, 0)[0]
		dir2 = VecABS(rebar.GetShapeDrivenAccessor().Normal.Normalize())
	loc = centerLine.GetEndPoint(0)
	dir = VecABS(centerLine.Direction)
	return loc, dir, dir2
	
def GetNearestUHRebar(p0, rebars):
	nearestRebar = None
	dsts = []
	for rebar in rebars:
		loc = GetRebarLocAndDir(rebar)[0]
		dst = loc.DistanceTo(p0)
		dsts.append(dst)
	if dsts:
		minDst = min(dsts)
		for i, rebar in enumerate(rebars):
			loc = GetRebarLocAndDir(rebar)[0]
			dst = loc.DistanceTo(p0)
			if dst == minDst:
				nearestRebar = rebars.pop(i)
				break
	return nearestRebar
	
def ModifyUHRebars(AR, wp, wr):
	host = doc.GetElement(AR.GetHostId())
	existUHRebars = []
	for id in host.GetDependentElements(ElementClassFilter(Rebar)):
		rebar = doc.GetElement(id)
		rebarPart = rebar.Parameter[BuiltInParameter.NUMBER_PARTITION_PARAM].AsString()
		rebarDir = GetRebarLocAndDir(rebar)[2]
		if rebarPart == '02_П-образные хомуты' and rebarDir.IsAlmostEqualTo(XYZ.BasisZ):
			existUHRebars.append(rebar)
			
	if existUHRebars:			
		rebarType = [rt for rt in FilteredElementCollector(doc).OfClass(RebarBarType).ToElements() if rt.Parameter[BuiltInParameter.SYMBOL_NAME_PARAM].AsString().find('A500') != -1 and round(rt.Parameter[BuiltInParameter.REBAR_BAR_DIAMETER].AsDouble()*304.8) == round(wr.DX*304.8) and rt.get_Parameter(System.Guid('844a01e2-19fc-4dc5-baa0-a4bda30ef1f6')).AsInteger() == 0][0]
		origins = GetOriginsForUHRebars(AR, wp) 
		xvec = wp.Dir
		yvec = wp.Orient
		rebars = []
		for p in origins:
			placePoint = p[0] + XYZ.BasisZ*wr.DX*p[3] - xvec*wr.DX/2*p[3] - yvec*wr.DX/2
			rebar = GetNearestUHRebar(placePoint, existUHRebars) 
			if rebar:
				rebar.GetShapeDrivenAccessor().SetRebarShapeId(shape.Id)			
				rebar.ChangeTypeId(rebarType.Id)
				rebar.Parameter[BuiltInParameter.REBAR_ELEM_LAYOUT_RULE].Set(3)
				rebar.Parameter[BuiltInParameter.REBAR_ELEM_LAYOUT_RULE].Set(3)
				rebar.Parameter[BuiltInParameter.REBAR_ELEM_QUANTITY_OF_BARS].Set(p[1])
				if p[1] > 1:
					rebar.Parameter[BuiltInParameter.REBAR_ELEM_BAR_SPACING].Set(p[2])

				xVecBox = xvec*(wp.T*2+wr.DX/2)*p[3] 
				yVecBox = yvec*(wp.T - wr.CovExt - wr.CovInt) 
				rebar.GetShapeDrivenAccessor().ScaleToBox(placePoint, xVecBox, yVecBox)
				rebar.SetSolidInView(doc.ActiveView, True)
				rebars.append(rebar)
		return rebars
	else:
		return None
		
shape = [shape for shape in FilteredElementCollector(doc).OfClass(RebarShape).ToElements() if shape.Parameter[BuiltInParameter.SYMBOL_NAME_PARAM].AsString() == IN[1]][0]
	
TransactionManager.Instance.EnsureInTransaction(doc)

updatedRebars = []

for i, ARset in enumerate(ARs):
	wp = WPars[i]
	wr = WRebs[i]
	for AR in ARset:	
		updatedRebars.append(ModifyUHRebars(AR, wp, wr))

TransactionManager.Instance.TransactionTaskDone()

OUT = updatedRebars
# ----------------------------------------

корректировка_шпилек = Python()  # frozen
# ---------- корректировка_шпилек.python (185 lines) ----------
import sys
import clr
import math
import System
clr.AddReference('RevitAPI')
from Autodesk.Revit.DB import *
from Autodesk.Revit.DB.Structure import *
clr.AddReference('RevitServices')
from RevitServices.Persistence import DocumentManager
from RevitServices.Transactions import TransactionManager

doc = DocumentManager.Instance.CurrentDBDocument

WPars = IN[0][0]
WRebs = IN[0][1]
ARs = UnwrapElement(IN[0][2])
rebars = UnwrapElement(IN[0][3])

#workView = [view for view in FilteredElementCollector(doc).OfClass(View3D).ToElements() if view.Name == IN[3]][0]

optForSlabs = Options()
#optForRebars = Options()
#optForRebars.View = workView

def ByZ(rebar):
	line = rebar.GetCenterlineCurves(False, True, True, MultiplanarOption.IncludeOnlyPlanarCurves, 0)[0]
	midpoint = line.ComputeDerivatives(0.5, True).Origin
	return midpoint.Z
	
def GetRebarsForIntSide(allRebarsV, wp):
	rebars = []
	for rebar in allRebarsV:
		extFace = [face for face in wp.Solid.Faces if face.FaceNormal.Normalize().IsAlmostEqualTo(wp.Orient)][0]
		intFace = [face for face in wp.Solid.Faces if face.FaceNormal.Normalize().IsAlmostEqualTo(-wp.Orient)][0]
		line = rebar.GetCenterlineCurves(False, True, True, MultiplanarOption.IncludeOnlyPlanarCurves, 0)[0]
		p0 = line.GetEndPoint(0) + XYZ.BasisZ*10/304.8
		extDst = p0.DistanceTo(extFace.Project(p0).XYZPoint)
		intDst = p0.DistanceTo(intFace.Project(p0).XYZPoint)
		if extDst > intDst:
			rebars.append(rebar)
	return rebars
	
def RebarIsOnFloor(rebar, wp):
	line = rebar.GetCenterlineCurves(False, True, True, MultiplanarOption.IncludeOnlyPlanarCurves, 0)[0]
	p0 = line.GetEndPoint(0)
	floor = wp.GetFloor(p0)
	if floor:
		mainFace = [face for face in list(floor.Geometry[optForSlabs])[0].Faces if face.FaceNormal.Normalize().IsAlmostEqualTo(XYZ.BasisZ)][0]
		projection = mainFace.Project(p0)
	else:
		bottomFaces = [face for face in wp.Solid.Faces if face.FaceNormal.Normalize().IsAlmostEqualTo(-XYZ.BasisZ)]
		for bf in bottomFaces:
			projection = bf.Project(p0)
			if projection:
				break				
	dst = round(p0.DistanceTo(projection.XYZPoint)*304.8)
	if dst == 0:
		return True, dst
	else:
		return False, dst
	
def GetOriginsForSRebars(AR, allRebarsV, wp):
	rebarsH = [doc.GetElement(id) for id in AR.GetRebarInSystemIds()]
	Zs = []
	for rebar in rebarsH:
		locZ = GetRebarLocAndDir(rebar)[0].Z
		Zs += [rebar.GetBarPositionTransform(j).Origin.Z + loc.Z for j in range(rebar.NumberOfBarPositions)])
	Zs = sorted(set(Zs))
	Zs1 = []
	Zs2 = []
	for i, z in enumerate(Zs):
		if i%2 == 0:
			Zs1.append(z)
		else:
			Zs2.append(z)
	rebarsV = [rebar for rebar in GetRebarsForIntSide(allRebarsV, wp) if rebar.LayoutRule != RebarLayoutRule.Single]
	origins = []
	for rebar in rebarsV:
		line = rebar.GetCenterlineCurves(False, True, True, MultiplanarOption.IncludeOnlyPlanarCurves, 0)[0]
		x = line.Origin.X
		y = line.Origin.Y
		if RebarIsOnFloor(rebar, wp)[0]:
			points = [XYZ(x,y,z) for z in Zs1]
			part = '06_Шпильки_Нечетный ряд'
		else:
			points = [XYZ(x,y,z) for z in Zs2]
			part = '06_Шпильки_Четный ряд'
		stepV = round(rebar.Parameter[BuiltInParameter.REBAR_ELEM_BAR_SPACING].AsDouble()*304.8)
		K = float(IN[2])/stepV
		n = int(math.ceil(float(rebar.Parameter[BuiltInParameter.REBAR_ELEM_QUANTITY_OF_BARS].AsInteger())/K))
		if n > 1:
			step = IN[2]/304.8
		else:
			step = None
		origins.append([points, n, step, part])
	return origins
	
def GetRebarLocAndDir(rebar):
	if rebar.GetType() == RebarInSystem:
		centerLine = rebar.GetCenterlineCurves(False, True, True)[0]
		dir2 = VecABS(rebar.Normal.Normalize())
	else:
		centerLine = rebar.GetCenterlineCurves(False, True, True, MultiplanarOption.IncludeOnlyPlanarCurves, 0)[0]
		dir2 = VecABS(rebar.GetShapeDrivenAccessor().Normal.Normalize())
	loc = centerLine.GetEndPoint(0)
	dir = VecABS(centerLine.Direction)	
	
def EditConstrains(rebar):
	conMan = rebar.GetRebarConstraintsManager()
	handle = [con for con in conMan.GetAllHandles() if con.GetHandleName() == 'Начало стержня'][0]
	consts = conMan.GetConstraintCandidatesForHandle(handle)
	const = [const for const in consts if const.GetRebarConstraintTargetHostFaceType() == RebarConstraintTargetHostFaceType.Side0 and const.IsToCover()][0]
	const.SetDistanceToTargetCover(0)
	conMan.SetPreferredConstraintForHandle(handle, const)
	handle = [con for con in conMan.GetAllHandles() if con.GetHandleName() == 'Конец стержня'][0]
	consts = conMan.GetConstraintCandidatesForHandle(handle)
	const = [const for const in consts if const.GetRebarConstraintTargetHostFaceType() == RebarConstraintTargetHostFaceType.Side1 and const.IsToCover()][0]
	const.SetDistanceToTargetCover(0)
	conMan.SetPreferredConstraintForHandle(handle, const)
	doc.Regenerate()

def ModifySRebars(AR, rebarsV, wp, wr):
	host = doc.GetElement(AR.GetHostId())
	existSRebars = []
	for id in host.GetDependentElements(ElementClassFilter(Rebar)):
		rebar = doc.GetElement(id)
		rebarPart = rebar.Parameter[BuiltInParameter.NUMBER_PARTITION_PARAM].AsString()
		if rebarPart.find('06_Шпильки':
			existSRebars.append(rebar)
	if existSRebars:
		shape = [shape for shape in FilteredElementCollector(doc).OfClass(RebarShape).ToElements() if shape.Parameter[BuiltInParameter.SYMBOL_NAME_PARAM].AsString() == IN[1]][0]
		rebarType = [rt for rt in FilteredElementCollector(doc).OfClass(RebarBarType).ToElements() if rt.Parameter[BuiltInParameter.SYMBOL_NAME_PARAM].AsString().find('A240') != -1 and round(rt.Parameter[BuiltInParameter.REBAR_BAR_DIAMETER].AsDouble()*304.8) == round(wr.DStud*304.8) and rt.get_Parameter(System.Guid('844a01e2-19fc-4dc5-baa0-a4bda30ef1f6')).AsInteger() == 0][0]
		rebar.GetShapeDrivenAccessor().SetRebarShapeId(shape.Id)			
		rebar.ChangeTypeId(rebarType.Id)
		EditConstrains(rebar)
		existSRebars = sorted(existSRebars, key=ByZ)
		
		origins = GetOriginsForSRebars(AR, rebarsV, wp)
		rebars = []
		for pSet in origins[0]:
			for p in pSet[0]:
			
			
			
			
			
			
			rsp = RebarSParameters(wp, wr, p)
			placePoint = rsp.Origin + wp.Dir*(wr.DY1)/2

			rebar = Rebar.CreateFromRebarShape(doc, shape, rebarType, host, placePoint, rsp.XVec, rsp.YVec)
			doc.Regenerate()
			rebar.Parameter[BuiltInParameter.REBAR_ELEM_LAYOUT_RULE].Set(3)
			rebar.Parameter[BuiltInParameter.REBAR_ELEM_QUANTITY_OF_BARS].Set(pSet[1])
			if pSet[1] > 1:
				rebar.Parameter[BuiltInParameter.REBAR_ELEM_BAR_SPACING].Set(pSet[2])
			rebar.Parameter[BuiltInParameter.NUMBER_PARTITION_PARAM].Set(pSet[3])
				
			

			rebars.append(rebar)

		doc.Regenerate()
	return rebars, origins
	
class RebarSParameters:
	def __init__(self, wp, wr, startPoint):
		self.Angle = math.asin((wr.DStudS + wr.DStud)/(wp.T-wr.CovExt-wr.CovInt-wr.DX))
		self.XVec = wp.Orient - XYZ.BasisZ * math.tan(self.Angle)
		self.YVec = XYZ.BasisZ + wp.Orient * math.tan(self.Angle)
		self.Origin = startPoint - self.XVec*(wr.DStudS/2 + wr.DStud*1.5) + self.YVec*wr.DStudS/2 - wp.Orient*(wr.DY1/2+wr.DX/2)

TransactionManager.Instance.EnsureInTransaction(doc)

updatedRebars = []

for i, wp in enumerate(WPars):
	wr = WRebs[i]
	ARset = ARs[i]
	rebars = rebarsV[i]
	updatedRebars.append(ModifySRebars(ARset[0], rebars, wp, wr))

TransactionManager.Instance.TransactionTaskDone()

OUT = updatedRebars
# ----------------------------------------
корректировка_горизонтального = Python(IN[0]=end_2, IN[1]=минимальное_смещение)  # "Корректировка горизонтального армирования"; frozen
# ---------- корректировка_горизонтального.python (126 lines) ----------
import sys
import clr
import math
import System
clr.AddReference('System')
from System.Collections.Generic import List
clr.AddReference('RevitAPI')
from Autodesk.Revit.DB import *
from Autodesk.Revit.DB.Structure import *
clr.AddReference('RevitServices')
from RevitServices.Persistence import DocumentManager
from RevitServices.Transactions import TransactionManager

doc = DocumentManager.Instance.CurrentDBDocument

data = IN[0]
WPars = data[1]
WRebs = data[2]

optForSlabs = Options()

def VecABS(vec):
	x = abs(vec.X)
	y = abs(vec.Y)
	z = abs(vec.Z)
	return XYZ(x,y,z)

def GetSlabThickness(lvl, catchPoint):
	filter = ElementLevelFilter(lvl.Id)
	slabs = FilteredElementCollector(doc).OfClass(Floor).WherePasses(filter).ToElements()
	t = -15/304.8
	for slab in slabs:
		mainFace = [face for face in list(slab.Geometry[optForSlabs])[0].Faces if face.FaceNormal.Normalize().IsAlmostEqualTo(XYZ.BasisZ)][0]
		if mainFace.Project(catchPoint) is not None:
			t = slab.Parameter[BuiltInParameter.FLOOR_ATTR_THICKNESS_PARAM].AsDouble()
			break
	return t
	
ARsInt = []
tr = Transform.Identity
test = []

TransactionManager.Instance.EnsureInTransaction(doc)

for i, wp in enumerate(WPars):
	wall = doc.GetElement(ElementId(wp.Id))
	ARs = [doc.GetElement(id) for id in wall.GetDependentElements(ElementClassFilter(AreaReinforcement))]
	ARsInt.append([])
	if ARs:
		wr = WRebs[i]
		lvlBot = doc.GetElement(wp.BottomLvlId)
		lvlTop = doc.GetElement(wp.TopLvlId)
		botSlabT = GetSlabThickness(lvlBot, wp.GetMidPointOfCenterLine())
		offsetMin =  IN[1]/304.8
		N = int(math.floor((lvlTop.Elevation-(lvlBot.Elevation+botSlabT)-2*offsetMin)/wr.StepX))+1
		offsetStart = (lvlTop.Elevation - (lvlBot.Elevation+botSlabT) - wr.StepX*(N-1))/2
	
		if VecABS(wp.Dir).IsAlmostEqualTo(XYZ.BasisY) and wp.JoinedWallsAtStart and wp.JoinedWallsAtEnd:
			additOffset = wr.DX
		else:
			additOffset = 0
		baseOffset = offsetStart - wr.DX/2 - additOffset
		topOffset = (wp.H - abs(baseOffset) - math.floor((wp.H - (abs(baseOffset) + wr.DX/2)) / wr.StepX) * wr.StepX - wr.DX)
		
		rebarType = [rt for rt in FilteredElementCollector(doc).OfClass(RebarBarType).ToElements() if rt.Parameter[BuiltInParameter.SYMBOL_NAME_PARAM].AsString().find('A500') != -1 and round(rt.Parameter[BuiltInParameter.REBAR_BAR_DIAMETER].AsDouble()*304.8) == round(wr.DX*304.8) and rt.get_Parameter(System.Guid('844a01e2-19fc-4dc5-baa0-a4bda30ef1f6')).AsInteger() == 0][0]		
		
		for AR in ARs:
			rebars = [doc.GetElement(id) for id in AR.GetRebarInSystemIds()]
			[rebar.SetSolidInView(doc.ActiveView, True) for rebar in rebars]
			
			arCurves = [doc.GetElement(id) for id in AR.GetBoundaryCurveIds()]
			Zs = [arCurve.Curve.ComputeDerivatives(0.5,True).Origin.Z for arCurve in arCurves]
			
			for i, arCurve in enumerate(arCurves):
				
				oldCur = arCurve.Curve
				dir = VecABS(oldCur.Direction.Normalize())
				if dir.IsAlmostEqualTo(VecABS(wp.Dir)):
					z = oldCur.Origin.Z
					if z == min(Zs):
						delta = (baseOffset + wp.Z) - z
					elif z == max(Zs):
						delta = (wp.Z + wp.H - topOffset) - z
					
					tr.Origin = XYZ(0,0, delta)				
					newCur = oldCur.CreateTransformed(tr)
					
					if i == 0:
						prev = len(arCurves)-1
					else:
						prev = i-1
					if i == len(arCurves)-1:
						next = 0
					else:
						next = i+1
					
					oldPrevCur = arCurves[prev].Curve
					newPrevCur = Line.CreateBound(oldPrevCur.GetEndPoint(0), oldPrevCur.GetEndPoint(1) - oldPrevCur.Direction*delta)
					oldNextCur = arCurves[next].Curve
					newNextCur = Line.CreateBound(oldNextCur.GetEndPoint(0) + oldNextCur.Direction*delta, oldNextCur.GetEndPoint(1))
					
					arCurves[prev].SetGeometryCurve(newPrevCur, False)
					arCurves[next].SetGeometryCurve(newNextCur, False)
#					arCurve.SetGeometryCurve(newCur, True)

					
					
#					test.append(arCurve.GetAdjoinedCurveElements(0))
		
			if AR.Parameter[BuiltInParameter.REBAR_SYSTEM_ACTIVE_BOTTOM_DIR_1_GENERIC].AsInteger() == 1:
				AR.Parameter[BuiltInParameter.REBAR_SYSTEM_BAR_TYPE_BOTTOM_DIR_1_GENERIC].Set(rebarType.Id)
				AR.Parameter[BuiltInParameter.REBAR_SYSTEM_SPACING_BOTTOM_DIR_1_GENERIC].Set(wr.StepX)
				AR.Parameter[BuiltInParameter.NUMBER_PARTITION_PARAM].Set('01_Расположение_Горизонтальная_Внутренняя')
				ARsInt[-1].append(AR)
			
			if AR.Parameter[BuiltInParameter.REBAR_SYSTEM_ACTIVE_TOP_DIR_1_GENERIC].AsInteger() == 1:
				AR.Parameter[BuiltInParameter.REBAR_SYSTEM_BAR_TYPE_TOP_DIR_1_GENERIC].Set(rebarType.Id)
				AR.Parameter[BuiltInParameter.REBAR_SYSTEM_SPACING_TOP_DIR_1_GENERIC].Set(wr.StepX)
				AR.Parameter[BuiltInParameter.NUMBER_PARTITION_PARAM].Set('01_Расположение_Горизонтальная_Наружняя')
				
TransactionManager.Instance.TransactionTaskDone()

data.append(ARsInt)

OUT = data
#OUT = test
# ----------------------------------------
watch = Watch(корректировка_горизонтального)
корректировка_эскизов = Python()  # "Корректировка эскизов армирования по площади"; frozen
# ---------- корректировка_эскизов.python (35 lines) ----------
import sys
import clr
import math
import System
clr.AddReference('System')
from System.Collections.Generic import List
clr.AddReference('RevitAPI')
from Autodesk.Revit.DB import *
from Autodesk.Revit.DB.Structure import *
clr.AddReference('RevitServices')
from RevitServices.Persistence import DocumentManager
from RevitServices.Transactions import TransactionManager

doc = DocumentManager.Instance.CurrentDBDocument

data = IN[0]
WPars = data[1]

TransactionManager.Instance.EnsureInTransaction(doc)

for i, wp in enumerate(WPars):
	wall = doc.GetElement(ElementId(wp.Id))
	ARs = [doc.GetElement(id) for id in wall.GetDependentElements(ElementClassFilter(AreaReinforcement))]
	for AR in ARs:		
		arCurves = [doc.GetElement(id) for id in AR.GetBoundaryCurveIds()]
#		JoinGeometryUtils.JoinGeometry(doc, arCurves[0], arCurves[3])
		for arCurve in arCurves:
			cur = arCurve.Curve
			arCurve.SetGeometryCurve(cur, True)
#			arCurve.SetGeometryCurve(cur, False)
			

TransactionManager.Instance.TransactionTaskDone()

OUT = data
# ----------------------------------------
end_6 = Revit.Transaction.Transaction.End(input=корректировка_эскизов)
проверка = Python(IN[0]=end_6)
# ---------- проверка.python (32 lines) ----------
import sys
import clr
import math
import System
clr.AddReference('System')
from System.Collections.Generic import List
clr.AddReference('RevitAPI')
from Autodesk.Revit.DB import *
from Autodesk.Revit.DB.Structure import *
clr.AddReference('RevitServices')
from RevitServices.Persistence import DocumentManager
from RevitServices.Transactions import TransactionManager

doc = DocumentManager.Instance.CurrentDBDocument

data = IN[0]
WPars = data[1]

isAdjoined = []

TransactionManager.Instance.EnsureInTransaction(doc)

for i, wp in enumerate(WPars):
	wall = doc.GetElement(ElementId(wp.Id))
	ARs = [doc.GetElement(id) for id in wall.GetDependentElements(ElementClassFilter(AreaReinforcement))]
	for AR in ARs:		
		arCurves = [doc.GetElement(id) for id in AR.GetBoundaryCurveIds()]
		isAdjoined.append([[arCurve.GetAdjoinedCurveElements(0), arCurve.GetAdjoinedCurveElements(1)] for arCurve in arCurves])

TransactionManager.Instance.TransactionTaskDone()

OUT = isAdjoined
# ----------------------------------------
watch_2 = Watch(поиск_анекеров_и_корректировка)
