# Dynamo custom node АктивныйВид.dyf (Dynamo 2.13.1.3887)
# category: 1П.Виды
# Активный вид активного документа

активный_вид = Python()  # IronPython2
# ---------- активный_вид.python (10 lines) ----------
import clr
clr.AddReference('RevitAPI')
from Autodesk.Revit.DB import *
clr.AddReference('RevitServices')
from RevitServices.Persistence import DocumentManager

doc = DocumentManager.Instance.CurrentDBDocument
view = doc.ActiveView

OUT = [view]
# ----------------------------------------
view = Output(активный_вид)  # "[view]"
