# Dynamo custom node ВизуализацияГеометрии.dyf (Dynamo 2.13.1.3887)
# category: 1П.Отладка
# Для отладки. Отображает в пространстве Revit геометрию типа точек, кривых, поверхностей и объемов

revitGeoms = Input(revitGeoms: var[]..[])  # Список геометрических объектов, генерированных Revit API
визуализация = Python(IN[0]=revitGeoms)  # IronPython2
# ---------- визуализация.python (25 lines) ----------
# Загрузить стандартную библиотеку Python и библиотеку DesignScript
import sys
import clr
clr.AddReference('RevitAPI')
from Autodesk.Revit.DB import *
clr.AddReference('ProtoGeometry')
from Autodesk.DesignScript.Geometry import *
clr.AddReference('RevitNodes')
import Revit
clr.ImportExtensions(Revit.GeometryConversion)


# Введенные в этом узле данные сохраняется в виде списка в переменных IN.
revitGeoms = IN[0]
dsGeoms = []
for revitGeom in revitGeoms:
	if revitGeom.GetType() == XYZ:
		dsGeom = Point.ByCoordinates(revitGeom.X*304.8, revitGeom.Y*304.8, revitGeom.Z*304.8)
	else:
		dsGeom = revitGeom.ToProtoType(True)
	dsGeoms.append(dsGeom)
# Разместите код под этой строкой

# Назначьте вывод переменной OUT.
OUT = dsGeoms
# ----------------------------------------
dsGeoms = Output(визуализация)
