# Dynamo custom node ВыборЧерезПодсветку.dyf (Dynamo 2.13.1.3887)
# category: 1П.Выбор
# Распознает выбранные (подсвеченные) элементы в документе Revit

выбор = Python()  # IronPython2
# ---------- выбор.python (14 lines) ----------
import clr
clr.AddReference('RevitAPI')
from Autodesk.Revit.DB import *
from Autodesk.Revit.DB.Structure import *
clr.AddReference('RevitServices')
from RevitServices.Persistence import DocumentManager

uidoc = DocumentManager.Instance.CurrentUIApplication.ActiveUIDocument
doc = DocumentManager.Instance.CurrentDBDocument

elemIds = uidoc.Selection.GetElementIds()
elems = [doc.GetElement(id) for id in elemIds]

OUT = elemIds, elems
# ----------------------------------------
firstItem = List.FirstItem(list=выбор)
elemIds = Output(firstItem)
lastItem = List.LastItem(list=выбор)
elems = Output(lastItem)
