# Dynamo custom node ЗаменаСистемногоОбозначенияОсиАннотацией.dyf (Dynamo 2.13.1.3887)
# category: 1П.Чертежи
# Скрывает системное обозначение строительной оси на чертеже и размещает вместо него типовую аннотацию

views = Input(views: var[]..[])  # Список видов
фильтрацияОсей = Custom[ФильтрацияОсей](views=views)  # Фильтрация всех осей в пределах активного документа
параметрыОсей = Custom[ПараметрыОсей](gridSets=фильтрацияОсей.viewGridSets)  # Сведения и методы, связанные со строительными осями
имя_семейства = StringInput("030_Обозначение оси (ТиповАннот)")
тип_семейства = StringInput("Стандарт")
семейство = List.Create(item0=имя_семейства, item1=тип_семейства)
расстановка_аннотаций_для_осей = Python(IN[0]=параметрыОсей, IN[1]=views, IN[2]=семейство)  # IronPython2
# ---------- расстановка_аннотаций_для_осей.python (81 lines) ----------
import clr
clr.AddReference('System')
from System.Collections.Generic import List
clr.AddReference('RevitAPI')
from Autodesk.Revit.DB import *
clr.AddReference('RevitServices')
from RevitServices.Persistence import DocumentManager
from RevitServices.Transactions import TransactionManager

def SetGridAnnotationInsteadBubble(gp):
	dirs = []
	for i in range(2):
		if gp.HasBubbles[i]:
			gp.Grid.HideBubbleInView(des[i], gp.View)
			point = gp.Lines[1].GetEndPoint(i)
			ann = doc.Create.NewFamilyInstance(point, gridAnnotationType, gp.View)
			doc.Regenerate()
			SetGridAnnotationParameters(ann, gp)
						
def SetGridAnnotationParameters(ann, gp):
	annDirs = [ann.GetTransform().BasisX.Normalize(), ann.GetTransform().BasisY.Normalize()]
	ann.GetParameters('Ось_Название')[0].Set(gp.Names[0])
	if gp.Directions[0].IsAlmostEqualTo(gp.View.RightDirection) or gp.Directions[0].IsAlmostEqualTo(-gp.View.RightDirection):
		ann.GetParameters('Вертикально')[0].Set(1)
		doc.Regenerate()
	nearGPs = gp.GetNearGridPars()
	for i in range(2):
		if nearGPs[i]:
			if ann.GetParameters('Вертикально')[0].AsInteger() == 1:
				if nearGPs[i].RayWhereGridHasBeenCatchedDir.IsAlmostEqualTo(annDirs[1]):
					ann.GetParameters('Стрелка_Сверху')[0].Set(1)
					ann.GetParameters('Ось_Название_Сверху')[0].Set(nearGPs[i].Names[0])
				if nearGPs[i].RayWhereGridHasBeenCatchedDir.IsAlmostEqualTo(-annDirs[1]):
					ann.GetParameters('Стрелка_Снизу')[0].Set(1)
					ann.GetParameters('Ось_Название_Снизу')[0].Set(nearGPs[i].Names[0])
			else:
				if nearGPs[i].RayWhereGridHasBeenCatchedDir.IsAlmostEqualTo(annDirs[0]):
					ann.GetParameters('Стрелка_Справа')[0].Set(1)
					ann.GetParameters('Ось_Название_Справа')[0].Set(nearGPs[i].Names[0])
				if nearGPs[i].RayWhereGridHasBeenCatchedDir.IsAlmostEqualTo(-annDirs[0]):
					ann.GetParameters('Стрелка_Слева')[0].Set(1)
					ann.GetParameters('Ось_Название_Слева')[0].Set(nearGPs[i].Names[0])
					
def CalculateAmountOfGrids(GPs, view):
	n = [0, 0, 0]
	for gp in GPs:
		if gp.Directions[0].IsAlmostEqualTo(view.RightDirection) or gp.Directions[0].IsAlmostEqualTo(-view.RightDirection):
			n[0] += 1
		elif gp.Directions[0].IsAlmostEqualTo(view.UpDirection) or gp.Directions[0].IsAlmostEqualTo(-view.UpDirection):
			n[1] += 1
		else:
			n[2] += 1
	return n

def AllowToSetGridAnnotation(gp, n, view):
	condition1 = (gp.Directions[0].IsAlmostEqualTo(view.RightDirection) or gp.Directions[0].IsAlmostEqualTo(-view.RightDirection)) and n[0] == 1
	condition2 = (gp.Directions[0].IsAlmostEqualTo(view.UpDirection) or gp.Directions[0].IsAlmostEqualTo(-view.UpDirection)) and n[1] == 1
	return (condition1 or condition2)
	
doc = DocumentManager.Instance.CurrentDBDocument

GPSets = IN[0]
views = UnwrapElement(IN[1])
des = [DatumEnds.End0, DatumEnds.End1]

gridAnnotationType = [sym for sym in FilteredElementCollector(doc).OfClass(FamilySymbol).ToElements() if sym.FamilyName == IN[2][0] and sym.Parameter[BuiltInParameter.ALL_MODEL_TYPE_NAME].AsValueString() == IN[2][1]][0]

TransactionManager.Instance.EnsureInTransaction(doc)

for i, view in enumerate(views):
	if view.ViewDirection.IsAlmostEqualTo(XYZ.BasisZ) or view.ViewDirection.IsAlmostEqualTo(-XYZ.BasisZ):
		GPs = GPSets[i]
		n = CalculateAmountOfGrids(GPs, view)
		for gp in GPs:
			if AllowToSetGridAnnotation(gp, n, view):
				gp.UpdateViewGeometrics(view)
				SetGridAnnotationInsteadBubble(gp)
		
TransactionManager.Instance.TransactionTaskDone()
				
OUT = ''
# ----------------------------------------
