# Dynamo custom node ЗаполнениеВедомостиСпецификаций.dyf (Dynamo 2.13.1.3887)
# category: 1П.Ведомости и спецификации
# Заполняет существующую ведомость спецификации в активном документе Revit для заданной марки комплекта рабочих чертежей. Поиск спецификаций осуществляется по ключевому слову "Спецификация" в заголовках.

# group: Исходные данные
sheetSetName = Input(sheetSetName: string)  # Марка комплекта чертежей
использовать_номер_листа = BoolSelector(false)  # graph input
наименование_параметра = StringInput("1П_Штамп_Раздел проекта")
наименование_параметра_2 = StringInput("1П_Штамп_Номер листа")

поиск_спецификаций_и_сбор_данных = Python(IN[0]=sheetSetName, IN[1]=использовать_номер_листа, IN[2]=наименование_параметра, IN[3]=наименование_параметра_2)  # IronPython2
# ---------- поиск_спецификаций_и_сбор_данных.python (44 lines) ----------
# Загрузить стандартную библиотеку Python и библиотеку DesignScript
import sys
import clr
clr.AddReference('RevitAPI')
from Autodesk.Revit.DB import *
clr.AddReference('RevitServices')
from RevitServices.Persistence import DocumentManager
from RevitServices.Transactions import TransactionManager

doc = DocumentManager.Instance.CurrentDBDocument

def ByNumber(sheet):
	if IN[1] or not sheet.GetParameters(IN[3]):
		return float(sheet.SheetNumber.split('-')[-1])
	else:
		return float(sheet.GetParameters(IN[3])[0].AsString())

sheets = []
for sheet in FilteredElementCollector(doc).OfClass(ViewSheet).ToElements():
	if sheet.GetParameters(IN[2]):
		sheetSet = sheet.GetParameters(IN[2])[0].AsString()
		if sheetSet == IN[0]:
			sheets.append(sheet)
			
sheets = sorted(sheets, key=ByNumber)

data = []
for sheet in sheets:
	ssis = [doc.GetElement(id) for id in sheet.GetDependentElements(ElementClassFilter(ScheduleSheetInstance))]
	if ssis:
		for ssi in ssis:
			if not ssi.IsTitleblockRevisionSchedule:
				sheetNumber = ByNumber(sheet)
				schedule = doc.GetElement(ssi.ScheduleId)
				if schedule.Definition.ShowTitle:
					name = schedule.GetCellText(SectionType.Header, 0, 0)
				elif schedule.Definition.ShowHeaders:
					name = schedule.GetCellText(SectionType.Body, 0, 0)
				else:
					name = None
				if name and name.find('Спецификация') == 0:
					data.append([int(sheetNumber), name])	
	
OUT = data
# ----------------------------------------
спецификации_и_номера_листов = Watch(поиск_спецификаций_и_сбор_данных)  # graph output

# group: Исходные данные
tosName = Input(tosName: string)  # Имя существующей ведомости спецификации в активном документе Revit
стиль_сплошной_толстой_линии = StringInput("1П_Сплошная_Толстая_Черная")

заполнение__существующей_ = Python(IN[0]=sheetSetName, IN[1]=наименование_параметра, IN[2]=поиск_спецификаций_и_сбор_данных, IN[3]=tosName, IN[4]=стиль_сплошной_толстой_линии)  # "Заполнение _существующей_ ведомости спецификации"; IronPython2
# ---------- заполнение__существующей_.python (58 lines) ----------
import sys
import clr
clr.AddReference('RevitAPI')
from Autodesk.Revit.DB import *
clr.AddReference('RevitServices')
from RevitServices.Persistence import DocumentManager
from RevitServices.Transactions import TransactionManager

doc = DocumentManager.Instance.CurrentDBDocument
lineStyles = Category.GetCategory(doc, BuiltInCategory.OST_Lines).SubCategories

tos = [vs for vs in FilteredElementCollector(doc).OfClass(ViewSchedule).ToElements() if not vs.IsTemplate and vs.Name.find(IN[3]) == 0][0]

TransactionManager.Instance.EnsureInTransaction(doc)

if tos.GetParameters(IN[1]):
	tos.GetParameters(IN[1])[0].Set(IN[0])

tosData = tos.GetTableData().GetSectionData(SectionType.Header)

overrides = TableCellStyleOverrideOptions()
overrides.BorderLeftLineStyle = True
overrides.BorderRightLineStyle = True
overrides.HorizontalAlignment = True
overrides.VerticalAlignment = True
overrides.Font = True
overrides.FontSize = True
overrides.Bold = True
overrides.Italics = True
overrides.Underline = True

tosStyle = TableCellStyle()
tosStyle.SetCellStyleOverrideOptions(overrides)
tosStyle.FontVerticalAlignment = VerticalAlignmentStyle.Middle
tosStyle.BorderLeftLineStyle = [ls.Id for ls in lineStyles if ls.Name == IN[4]][0]
tosStyle.BorderRightLineStyle = [ls.Id for ls in lineStyles if ls.Name == IN[4]][0]
tosStyle.FontName = 'Mipgost'
tosStyle.TextSize = 9.448223734
tosStyle.IsFontBold = True
tosStyle.IsFontItalic = False
tosStyle.IsFontUnderline = False

 
for i, data in enumerate(IN[2]):
	tosData.InsertRow(2+i)
	tosData.SetRowHeight(2+i, 0.02625)
	tosStyle.FontHorizontalAlignment = HorizontalAlignmentStyle.Center
	tosData.SetCellStyle(2+i, 0, tosStyle)
	tosStyle.FontHorizontalAlignment = HorizontalAlignmentStyle.Left
	tosData.SetCellStyle(2+i, 1, tosStyle)
	tosStyle.FontHorizontalAlignment = HorizontalAlignmentStyle.Center
	tosData.SetCellStyle(2+i, 2, tosStyle)
	tosData.SetCellText(2+i, 0, str(data[0]))
	tosData.SetCellText(2+i, 1, data[1])
		
TransactionManager.Instance.TransactionTaskDone()

OUT = ''
# ----------------------------------------
