# Dynamo custom node ЗаполнениеПараметровСборок.dyf (Dynamo 2.13.1.3887)
# category: 1П.Параметры
# Заполнение параметров сборок для корректной работы спецификаций

# group: Параметры
значение_параметра = StringInput("Каркас")
значение_параметра_2 = StringInput("Сетка")
значение_параметра_3 = StringInput("Каркас плоский")
значение_параметра_4 = StringInput("Каркас лестничный ")
имя_параметра = StringInput("1П_Обозначение")
имя_параметра_2 = StringInput("1П_Наименование")
значение_параметра_5 = StringInput("Фрагмент")
наименование = List.Create(item0=имя_параметра_2, item1=значение_параметра_5)
имя_параметра_3 = StringInput("1П_Масса")
имя_параметра_4 = StringInput("1П_Штамп_Номер листа")
имя_параметра_5 = StringInput("1П_Штамп_Раздел проекта")
имя_параметра_6 = StringInput("1П_Марка конструкции")
имя_параметра_7 = StringInput("1Пп_Марка основы")
имя_параметра_8 = StringInput("1П_Зона")
список_параметров = List.Create(item0=имя_параметра, item1=наименование, item2=имя_параметра_3, item3=имя_параметра_4, item4=имя_параметра_5, item5=имя_параметра_6, item6=имя_параметра_7, item7=имя_параметра_8)

ATs = Input(ATs: var[]..[])  # Список типов сборок
заполнение_параметров_сборок = Python(IN[0]=ATs, IN[1]=список_параметров)  # IronPython2
# ---------- заполнение_параметров_сборок.python (96 lines) ----------
import sys
import clr
clr.AddReference('RevitAPI')
from Autodesk.Revit.DB import *
from Autodesk.Revit.DB.Structure import *
clr.AddReference('RevitServices')
from RevitServices.Persistence import DocumentManager
from RevitServices.Transactions import TransactionManager

doc = DocumentManager.Instance.CurrentDBDocument
projInfo = FilteredElementCollector(doc).OfClass(ProjectInfo).FirstElement()
projNumber = projInfo.Parameter[BuiltInParameter.PROJECT_NUMBER].AsString()

def GetHostMark(rebar):
	host = doc.GetElement(rebar.GetHostId())
	if host.GetParameters(IN[1][5]) and host.GetParameters(IN[1][5])[0].HasValue and host.GetParameters(IN[1][5])[0].AsString() != '':
		hostMark = host.GetParameters(IN[1][5])[0].AsString()
	else:
		hostMark = rebar.Parameter[BuiltInParameter.REBAR_ELEM_HOST_MARK].AsString()
	return hostMark
	
def GetHostZone(rebar):
	host = doc.GetElement(rebar.GetHostId())
	if host.GetParameters(IN[1][7]) and host.GetParameters(IN[1][7])[0].HasValue and host.GetParameters(IN[1][7])[0].AsString() != '':
		hostZone = host.GetParameters(IN[1][7])[0].AsString()
	else:
		hostZone = ''
	return hostZone

def GetATMark():
	atName = None
	atMark = None
	if IN[1][1][1].find('Каркас') == 0 or IN[1][1][1].find('Сетка') == 0:
		atMark = at.Parameter[BuiltInParameter.ALL_MODEL_TYPE_NAME].AsString().split('_')[-1]
	elif IN[1][1][1] == 'Фрагмент':
		atName = members[0].Parameter[BuiltInParameter.NUMBER_PARTITION_PARAM].AsString()
		atMark = atName.split(' ')[-1]
	return [atName, atMark]

ATs = UnwrapElement(IN[0])

TransactionManager.Instance.EnsureInTransaction(doc)

for at in ATs:
	AIs = [doc.GetElement(id) for id in at.GetDependentElements(ElementClassFilter(AssemblyInstance))]
	members = [doc.GetElement(id) for id in AIs[0].GetMemberIds()]
	data = GetATMark()
	atName = data[0]
	atMark = data[1]
		
	mass = 0
	for elem in members:
		if elem.GetType() == Rebar or elem.GetType() == RebarInSystem:
			mass += 7850*(elem.Volume*304.8**3)/10**9
		elif elem.GetParameters(IN[1][2]):
			mass += elem.GetParameters(IN[1][2])[0].AsDouble()	

	if at.GetParameters(IN[1][0]):
		vp = None
		vps1 = [doc.GetElement(id) for id in at.GetDependentElements(ElementClassFilter(Viewport)) if doc.GetElement(id).OwnerViewId.IntegerValue != -1]
		if vps1:
			vp = vps1[0]
		elif atName:
			vps2 = [vp for vp in FilteredElementCollector(doc).OfClass(Viewport).ToElements() if vp.Parameter[BuiltInParameter.VIEW_NAME].AsString().split(' - ')[-1] == atName]
			if vps2:
				vp = vps2[0]
		if vp:
			sheet = doc.GetElement(vp.OwnerViewId)
			if sheet and sheet.GetParameters(IN[1][3]) and sheet.GetParameters(IN[1][4]):
				sheetNumber = sheet.GetParameters(IN[1][3])[0].AsString()
				sheetSet = sheet.GetParameters(IN[1][4])[0].AsString()
				ref = projNumber + '-' + sheetSet + '-' + sheetNumber
				at.GetParameters(IN[1][0])[0].Set(ref)
						
	if at.GetParameters(IN[1][1][0]):
		at.GetParameters(IN[1][1][0])[0].Set(IN[1][1][1])
		
	at.Parameter[BuiltInParameter.WINDOW_TYPE_ID].Set(atMark)
		
	for ai in AIs:
		if ai.GetParameters(IN[1][2]):			
			ai.GetParameters(IN[1][2])[0].Set(mass)
		if ai.GetParameters(IN[1][5]):
			members = [doc.GetElement(id) for id in ai.GetMemberIds()]			
			hostMark = GetHostMark(members[0])
			ai.GetParameters(IN[1][5])[0].Set(hostMark)
			if ai.GetParameters(IN[1][6]):
				ai.GetParameters(IN[1][6])[0].Set(hostMark)
		if ai.GetParameters(IN[1][7]):
			members = [doc.GetElement(id) for id in ai.GetMemberIds()]			
			hostZone = GetHostZone(members[0])
			ai.GetParameters(IN[1][7])[0].Set(hostZone)
			
TransactionManager.Instance.TransactionTaskDone()
				
OUT = ATs
# ----------------------------------------
ATs_2 = Output(заполнение_параметров_сборок)  # "ATs"; Список типов сборок
