# Dynamo custom node КорректировкаЗащитногоСлоя.dyf (Dynamo 2.13.1.3887)
# category: 1П.Армирование
# Корректирует защитные слои для железобетонных элементов по заданным значениям

concreteElems = Input(concreteElems: var[]..[])  # Список железобетонных элементов
rebarCoverDistances = Input(rebarCoverDistances: var[]..[] = [0, 0, 0, 0, 0, 0])  # Список расстояний, включающий в себя: 0. Единый защитный слой 1. Защитный слой от верхней грани 2. Защитный слой от нижней грани 3. Защитный слой от других граней 4. Защитный слой от внутренней грани 5. Защитный слой от наружной грани
редактирование_защитного_слоя = Python(IN[0]=concreteElems, IN[1]=rebarCoverDistances)  # IronPython2
# ---------- редактирование_защитного_слоя.python (32 lines) ----------
import clr
clr.AddReference('RevitAPI')
from Autodesk.Revit.DB import *
from Autodesk.Revit.DB.Structure import *
clr.AddReference('RevitServices')
from RevitServices.Persistence import DocumentManager
from RevitServices.Transactions import TransactionManager

def GetRebarCoverType(dst):
	for rct in FilteredElementCollector(doc).OfClass(RebarCoverType).ToElements():
		if round(rct.CoverDistance*304.8) == dst:
			return rct
	else:
		return RebarCoverType.Create(doc, str(int(round(dst))), dst/304.8)

doc = DocumentManager.Instance.CurrentDBDocument

elems = UnwrapElement(IN[0])

parName = [BuiltInParameter.CLEAR_COVER, BuiltInParameter.CLEAR_COVER_BOTTOM, BuiltInParameter.CLEAR_COVER_TOP, BuiltInParameter.CLEAR_COVER_OTHER, BuiltInParameter.CLEAR_COVER_INTERIOR, BuiltInParameter.CLEAR_COVER_EXTERIOR]

TransactionManager.Instance.EnsureInTransaction(doc)

for elem in elems:
	for i in range(6):
		covType = GetRebarCoverType(IN[1][i])
		if elem.Parameter[parName[i]] and not elem.Parameter[parName[i]].IsReadOnly:
			elem.Parameter[parName[i]].Set(covType.Id)

TransactionManager.Instance.TransactionTaskDone()

OUT = ''
# ----------------------------------------
