# Dynamo custom node КорректировкаХостаДляАрматуры.dyf (Dynamo 2.13.1.3887)
# category: 1П.Отладка
# Проверяет и корректирует хост арматурных стержней или арматурных контейнеров.

rebarsOrRebarContainers = Input(rebarsOrRebarContainers: var[]..[])  # Список арматуры или контейнеров
параметрыАрматуры = Custom[ПараметрыАрматуры](rebarsOrRebarContainers=rebarsOrRebarContainers)  # Сведения и методы, связанные с арматурными стержнями и арматурными контейнерами
фильтрацияЖБК = Custom[ФильтрацияЖБК]()  # Фильтрация железобетонных конструкций, изделий в пределах активного документа Revit
фильтрация_подходящих_хостов = Python(IN[0]=параметрыАрматуры.rebarContainerParameters, IN[1]=фильтрацияЖБК.allConcreteIds)  # IronPython2
# ---------- фильтрация_подходящих_хостов.python (21 lines) ----------
import sys
import clr
clr.AddReference('System')
from System.Collections.Generic import List
clr.AddReference('RevitAPI')
from Autodesk.Revit.DB import *
clr.AddReference('RevitServices')
from RevitServices.Persistence import DocumentManager

doc = DocumentManager.Instance.CurrentDBDocument

RCPs = IN[0]
allConcreteIds = IN[1]

filteredConcreteIds = []

for rcp in RCPs:
	filter = BoundingBoxContainsPointFilter(rcp.Center)
	filteredConcreteIds += list(FilteredElementCollector(doc, List[ElementId](allConcreteIds)).WherePasses(filter).ToElementIds())

OUT = filteredConcreteIds
# ----------------------------------------
получитьРеальныйСолид = Custom[ПолучитьРеальныйСолид](elemsId=фильтрация_подходящих_хостов)  # Обрабатывает элементы для получения "реальной" объемной геометрии - данный скрипт используется для перевода свойства HasModifiedGeometry в положение "True" и получения геометрии типа "Solid" напрямую, без посредства "GeometryInstance" (см. примечания для класса "GeometryInstance" в Revit SDK)

# group: Параметры
имя_параметра = StringInput("1П_Марка конструкции")
список_имен_параметров = List.Create(item0=имя_параметра)

корректировка_хоста = Python(IN[0]=параметрыАрматуры.rebarContainerParameters, IN[1]=получитьРеальныйСолид.elemIds, IN[2]=список_имен_параметров)  # IronPython2
# ---------- корректировка_хоста.python (66 lines) ----------
import sys
import clr
clr.AddReference('System')
from System.Collections.Generic import List
clr.AddReference('RevitAPI')
from Autodesk.Revit.DB import *
from Autodesk.Revit.DB.Structure import *
clr.AddReference('RevitServices')
from RevitServices.Persistence import DocumentManager
from RevitServices.Transactions import TransactionManager

def GetSolid(elem):
	if elem.GetType() == FamilyInstance and elem.Symbol.Family.IsInPlace:
		geomInst = [geom for geom in list(elem.Geometry[opt]) if geom.GetType() == GeometryInstance][0]
		solid = [geom for geom in geomInst.GetInstanceGeometry() if geom.GetType() == Solid and geom.Volume > 0][0]
	else:
		solid = [geom for geom in list(elem.Geometry[opt]) if geom.GetType() == Solid and geom.Volume > 0][0]
	return solid
	
def SetContainerParameters(rcp):
	phase = rcp.Host.Parameter[BuiltInParameter.PHASE_CREATED].AsElementId()
	rcp.Elem.Parameter[BuiltInParameter.PHASE_CREATED].Set(phase)
	if rcp.Host.Parameter[BuiltInParameter.ALL_MODEL_MARK].HasValue:
		hostMark = rcp.Host.Parameter[BuiltInParameter.ALL_MODEL_MARK].AsString()
		if hostMark:
			rcp.Elem.GetParameters(IN[2][0])[0].Set(hostMark)

doc = DocumentManager.Instance.CurrentDBDocument

RCPs = IN[0]
allConcreteIds = IN[1]
opt = Options()

monitoring = []

TransactionManager.Instance.EnsureInTransaction(doc)

for rcp in RCPs:
	oldHost = rcp.Host
	filter = BoundingBoxContainsPointFilter(rcp.Center)
	concretes = FilteredElementCollector(doc, List[ElementId](allConcreteIds)).WherePasses(filter).ToElements()
	lines = []
	for rci in rcp.RPs:
		lines += rci.Lines
	newHost = None
	for	elem in concretes:
		solid = GetSolid(elem)
		for line in lines:
			cutLines = solid.IntersectWithCurve(line, None)
			if cutLines:
				newHost = elem
				rcp.Elem.SetHostId(doc, newHost.Id)
				rcp.Host = newHost
				break
		if newHost:
			break
	else:
		newHost = oldHost
		
	SetContainerParameters(rcp)

	monitoring.append(['Старый хост: ' + str(oldHost.Id.IntegerValue), 'Новый хост: ' + str(newHost.Id.IntegerValue)])
	
TransactionManager.Instance.TransactionTaskDone()

OUT = monitoring, RCPs
# ----------------------------------------
firstItem = List.FirstItem(list=корректировка_хоста)
monitoring = Output(firstItem)  # Мониторинг
lastItem = List.LastItem(list=корректировка_хоста)
RCPs = Output(lastItem)  # Параметры контейнеров
