# Dynamo custom node НанесениеЛинийОбрыва.dyf (Dynamo 2.13.1.3887)
# category: 1П.Чертежи
# Нанесение аннотативных линий обрыва (категория "Элемент узла") по границе обрезки вида

фильтрация_жбк_на_видах = Python()  # IronPython2; frozen; unwired: IN[0], IN[1]
# ---------- фильтрация_жбк_на_видах.python (17 lines) ----------
import clr
clr.AddReference('System')
from System.Collections.Generic import List
clr.AddReference('RevitAPI')
from Autodesk.Revit.DB import *
clr.AddReference('RevitServices')
from RevitServices.Persistence import DocumentManager

doc = DocumentManager.Instance.CurrentDBDocument
views = UnwrapElement(IN[0])

ids = []
for view in views:
	filter = VisibleInViewFilter(doc, view.Id)
	ids += list(FilteredElementCollector(doc, List[ElementId](IN[1])).WherePasses(filter).ToElementIds())

OUT = ids
# ----------------------------------------
получитьРеальныйСолид = Custom[ПолучитьРеальныйСолид](elemsId=фильтрация_жбк_на_видах)  # Обрабатывает элементы для получения "реальной" объемной геометрии - данный скрипт используется для перевода свойства HasModifiedGeometry в положение "True" и получения геометрии типа "Solid" напрямую, без посредства "GeometryInstance" (см. примечания для класса "GeometryInstance" в Revit SDK)

# group: Расстояния для схема армирования и опалубочных чертежей
смещение_линий_обрыва_внутрь = DoubleSlider(100, range=0..2000 step 10)  # "Смещение линий обрыва внутрь границ обрезки вида"
глубина_маскировки = DoubleSlider(250, range=0..2000 step 10)
выступы_маскировки = DoubleSlider(150, range=0..2000 step 10)
расстояния = List.Create(item0=смещение_линий_обрыва_внутрь, item1=глубина_маскировки, item2=выступы_маскировки)

views = Input(views: var[]..[])  # Список видов
параметрыВида = Custom[ПараметрыВида](views=views)  # Сбор исходных данных, свзяанных с видами
имя_семейства = StringInput("011_Линия обрыва (ЭлУзла_Линия)")
тип_семейства = StringInput("Стандарт")
семейство = List.Create(item0=имя_семейства, item1=тип_семейства)
dimensions = Input(dimensions: var[]..[])  # Список расстояний, включа.щий в себя: 0. Смещение линий обрыва внутрь границ обрезки вида 1. Глубина маскировки 2. Выступы маскировки
фильтрацияЖБК = Custom[ФильтрацияЖБК]()  # Фильтрация железобетонных конструкций, изделий в пределах активного документа Revit
нанесение_линий_обрыва_по = Python(IN[0]=параметрыВида, IN[1]=семейство, IN[2]=dimensions, IN[3]=фильтрацияЖБК.allConcreteIds)  # "Нанесение линий обрыва по границе обрезки вида"; IronPython2
# ---------- нанесение_линий_обрыва_по.python (56 lines) ----------
import clr
clr.AddReference('System')
from System.Collections.Generic import List
clr.AddReference('RevitAPI')
from Autodesk.Revit.DB import *
clr.AddReference('RevitServices')
from RevitServices.Persistence import DocumentManager
from RevitServices.Transactions import TransactionManager

def CreateCropCurveLoop(lines, vp):
	cl = CurveLoop.Create(lines)
	cl = CurveLoop.CreateViaOffset(cl, IN[2][0]/304.8, vp.Dirs[2])
	transform = Transform.CreateTranslation(vp.Dirs[2]*(vp.CropBox.H))
	cl = CurveLoop.CreateViaTransform(cl, transform)
	return cl
	
def CreateConcreteViewSolid(vp):
	filter = VisibleInViewFilter(doc, vp.View.Id)
	concrete = FilteredElementCollector(doc, List[ElementId](IN[3])).WherePasses(filter).ToElements()
	viewSolid = vp.CropBox.CreateViewSolid(vp.CropBox.H)
	solids = []
	for elem in concrete:
		elemSolids = [geom for geom in list(elem.Geometry[opt]) if geom.GetType() == Solid and geom.Volume > 0]
		for elemSolid in elemSolids:
			solids.append(BooleanOperationsUtils.ExecuteBooleanOperation(viewSolid, elemSolid, BooleanOperationsType.Intersect))
	for solid in solids[1:]:
		BooleanOperationsUtils.ExecuteBooleanOperationModifyingOriginalSolid(solids[0], solid, BooleanOperationsType.Union)
	return solids[0]

doc = DocumentManager.Instance.CurrentDBDocument

VPs = IN[0]

cropLineAnnotationType = [sym for sym in FilteredElementCollector(doc).OfClass(FamilySymbol).ToElements() if sym.FamilyName == IN[1][0] and sym.Parameter[BuiltInParameter.ALL_MODEL_TYPE_NAME].AsValueString() == IN[1][1]][0]

opt = Options()

TransactionManager.Instance.EnsureInTransaction(doc)

for vp in VPs:
	lines = [vp.CropBox.LeftLine, vp.CropBox.TopLine, vp.CropBox.RightLine.CreateReversed(), vp.CropBox.BotLine.CreateReversed()]
	cl = CreateCropCurveLoop(lines, vp)
	solid = CreateConcreteViewSolid(vp)
	transform = Transform.CreateTranslation(-vp.Dirs[2]*vp.CropBox.H/2)
	for line in list(cl):
		line = line.CreateTransformed(transform)
		spotlines = list(solid.IntersectWithCurve(line, None))
		for line in spotlines:
			line = line.CreateTransformed(transform.Inverse)
			ann = doc.Create.NewFamilyInstance.Overloads[Line, FamilySymbol, View](line, cropLineAnnotationType, vp.View)
			ann.GetParameters('Глубина')[0].Set(IN[2][1]/304.8)
			ann.GetParameters('Выступы области')[0].Set(IN[2][2]/304.8)
		
TransactionManager.Instance.TransactionTaskDone()
				
OUT = ''
# ----------------------------------------
