# Dynamo custom node НанесениеМарокЗакладныхДеталей.dyf (Dynamo 2.13.1.3887)
# category: 1П.Чертежи
# Нанесение марки закладных деталей при оформлении опалубочных чертежей

views = Input(views: var[]..[])  # Список видов

# group: Вариант 1
имя_семейства = StringInput("040_Общ_Имя типа (ВсеКатегории)")
тип_семейства = StringInput("С линией")
семейство_общей_марки = List.Create(item0=имя_семейства, item1=тип_семейства)

тип_семейства_закладных_деталей = StringInput("220_")  # "Тип семейства закладных деталей начинается с"
семейства = List.Create(item0=семейство_общей_марки, item1=тип_семейства_закладных_деталей)
смещение_от_закладной_детали_abs = DoubleSlider(400, range=0..1000 step 10)
смещение_вбок_abs = DoubleSlider(220, range=0..1000 step 10)
смещение_колена_abs = DoubleSlider(200, range=0..1000 step 10)
расстояния = List.Create(item0=смещение_от_закладной_детали_abs, item1=смещение_вбок_abs, item2=смещение_колена_abs)
нанесение_марок_закладных = Python(IN[0]=views, IN[1]=семейства, IN[2]=расстояния)  # "Нанесение марок закладных деталей"; IronPython2
# ---------- нанесение_марок_закладных.python (52 lines) ----------
import clr
clr.AddReference('System')
from System.Collections.Generic import List
clr.AddReference('RevitAPI')
from Autodesk.Revit.DB import *
from Autodesk.Revit.DB.Structure import *
clr.AddReference('RevitServices')
from RevitServices.Persistence import DocumentManager
from RevitServices.Transactions import TransactionManager

def GetDirections(emb, view):
	embDir = emb.GetTransform().BasisZ
	if embDir.IsAlmostEqualTo(view.ViewDirection) or embDir.IsAlmostEqualTo(-view.ViewDirection):
		dir1 = view.UpDirection
		dir2 = view.RightDirection
		dir3 = -dir2
	else:
		dir1 = emb.GetTransform().BasisZ
		dir2 = dir1.CrossProduct(view.ViewDirection)
		dir3 = -dir1 if dir1.IsAlmostEqualTo(view.RightDirection) or dir1.IsAlmostEqualTo(-view.RightDirection) else -dir2
	return [dir1, dir2, dir3]

doc = DocumentManager.Instance.CurrentDBDocument
views = UnwrapElement(IN[0])

tagType = [sym for sym in FilteredElementCollector(doc).OfClass(FamilySymbol).ToElements() if sym.FamilyName == IN[1][0][0] and sym.Parameter[BuiltInParameter.SYMBOL_NAME_PARAM].AsString() == IN[1][0][1]][0]
filter1 = LogicalAndFilter(ElementClassFilter(FamilyInstance), ElementCategoryFilter(BuiltInCategory.OST_Rebar))
filter2 = LogicalAndFilter(ElementClassFilter(FamilyInstance), ElementCategoryFilter(BuiltInCategory.OST_GenericModel))
comFilter = LogicalOrFilter(filter1, filter2)
	
TransactionManager.Instance.EnsureInTransaction(doc)

for view in views:
	embedments = [elem for elem in FilteredElementCollector(doc, view.Id).WherePasses(comFilter).ToElements() if elem.Symbol.FamilyName.find(IN[1][1]) == 0]

	for emb in embedments:
		dirs = GetDirections(emb, view)
		embLocPoint = emb.Location.Point
		
		insPoint = embLocPoint + dirs[0]*IN[2][0]/304.8 + dirs[1]*IN[2][1]/304.8
		elbowPoint = insPoint + dirs[2]*IN[2][2]/304.8
		
		embRef = Reference(emb)
		tag = IndependentTag.Create(doc, tagType.Id, view.Id, embRef, False, TagOrientation.Horizontal, insPoint)
		tag.HasLeader = True
		tag.LeaderEndCondition = LeaderEndCondition.Attached
		#tag.SetLeaderEnd(embRef, emLocPoint)
		tag.SetLeaderElbow(embRef, elbowPoint)

TransactionManager.Instance.TransactionTaskDone()

OUT = ''
# ----------------------------------------

# group: Вариант 2
имя_семейства_2 = StringInput("044_М_Изделия (НескКатегорий)")
тип_семейства_2 = StringInput("Марка")
семейство_общей_марки_2 = List.Create(item0=имя_семейства_2, item1=тип_семейства_2)
