# Dynamo custom node НастройкаГраницОсей.dyf (Dynamo 2.13.1.3887)
# category: 1П.Чертежи
# Настройка отображения строительных осей на видах: удлинение строительных осей за границы обрезки вида, отображение "круглешков" (номер оси)

views = Input(views: var[]..[])  # Список видов
параметрыВида = Custom[ПараметрыВида](views=views)  # Сбор исходных данных, свзяанных с видами
виды_наборы_строительных_осей = Python(IN[0]=views)  # IronPython2
# ---------- виды_наборы_строительных_осей.python (12 lines) ----------
import clr
clr.AddReference('RevitAPI')
from Autodesk.Revit.DB import *
clr.AddReference('RevitServices')
from RevitServices.Persistence import DocumentManager

doc = DocumentManager.Instance.CurrentDBDocument
views = UnwrapElement(IN[0])

gridSets = [list(FilteredElementCollector(doc, view.Id).OfClass(Grid).ToElements()) for view in views]
				
OUT = gridSets
# ----------------------------------------
параметрыОсей = Custom[ПараметрыОсей](gridSets=виды_наборы_строительных_осей)  # Сведения и методы, связанные со строительными осями
длина_хвоста_осей = DoubleSlider(100, range=0..2000 step 10)
настройка_границ_осей = Python(IN[0]=параметрыВида, IN[1]=параметрыОсей, IN[2]=длина_хвоста_осей)  # IronPython2
# ---------- настройка_границ_осей.python (40 lines) ----------
import clr
clr.AddReference('RevitAPI')
from Autodesk.Revit.DB import *
clr.AddReference('RevitServices')
from RevitServices.Persistence import DocumentManager
from RevitServices.Transactions import TransactionManager

def GetViewGridLine(vp, gp):
	solid = vp.CropBox.CreateViewSolid(vp.CropBox.H)
	spotlines = list(solid.IntersectWithCurve(gp.Lines[1], None))
	if spotlines:
		line = spotlines[0]
		dir = line.Direction
		p0 = line.GetEndPoint(0) - IN[2]/304.8*dir
		p1 = line.GetEndPoint(1) + IN[2]/304.8*dir
		line = Line.CreateBound(p0, p1)
		return line
	else:
		return None

doc = DocumentManager.Instance.CurrentDBDocument
VPs = IN[0]
GPSets = IN[1]

TransactionManager.Instance.EnsureInTransaction(doc)

for i, vp in enumerate(VPs):
	GPs = GPSets[i]
	for gp in GPs:
		gp.UpdateViewGeometrics(vp.View)
		line = GetViewGridLine(vp, gp)
		if line:
			gp.Grid.SetCurveInView(DatumExtentType.ViewSpecific, vp.View, line)
		if vp.ShouldHideGridBubbles():
			gp.Grid.HideBubbleInView(DatumEnds.End0, vp.View)
			gp.Grid.HideBubbleInView(DatumEnds.End1, vp.View)
		
TransactionManager.Instance.TransactionTaskDone()		
				
OUT = ''
# ----------------------------------------
