# Dynamo custom node НастройкаОтображенияАрматурыДляСхем.dyf (Dynamo 2.13.1.3887)
# category: 1П.Чертежи
# Переопределяет графику арматурных стержней на схемах армирования. Прорисовывает границы распространения арматрных стержней. Скрывает стержни на заднем плане вида.

views = Input(views: var[]..[])  # Список видов
параметрыВида = Custom[ПараметрыВида](views=views)  # Сбор исходных данных, свзяанных с видами
имя_образца_штриховой_линии = StringInput("1П_Штриховая (2 мм)")
имя_стиля_линии_для_границ_зон = StringInput("1П_Штриховая (4 мм)_Фиолетовая")  # "Имя стиля линии для границ зон рскладки арматуры"
определение_главного_элемента = Python(IN[0]=параметрыВида)  # "Определение главного элемента, извлечение контейнеров"; IronPython2
# ---------- определение_главного_элемента.python (40 lines) ----------
import clr
clr.AddReference('RevitAPI')
from Autodesk.Revit.DB import *
from Autodesk.Revit.DB.Structure import *
clr.AddReference('RevitServices')
from RevitServices.Persistence import DocumentManager

def GetMainElementFromView(walls, vp):
	for wall in walls:	
		solid = [geom for geom in list(wall.Geometry[optForElems]) if geom.GetType() == Solid and geom.Volume > 0][0]
		voids = [doc.GetElement(id) for id in wall.GetDependentElements(voidFilter)]
		for i in [-0.25, 0, 0.25]:
			transform = Transform.CreateTranslation(vp.Dirs[0]*vp.CropBox.L*i)
			line = vp.CropBox.CentroidDepthLine.CreateTransformed(transform)
			filter = LogicalOrFilter([BoundingBoxContainsPointFilter(line.Evaluate(j*0.1, True)) for j in range(10)])
			if list(solid.IntersectWithCurve(line, None)) or [void for void in voids if filter.PassesFilter(void)]:
				return wall
	else:
		return None	

doc = DocumentManager.Instance.CurrentDBDocument

VPs = IN[0]

filter1 = LogicalAndFilter(ElementClassFilter(FamilyInstance), ElementCategoryFilter(BuiltInCategory.OST_Windows))
filter2 = LogicalAndFilter(ElementClassFilter(FamilyInstance), ElementCategoryFilter(BuiltInCategory.OST_Doors))
voidFilter = LogicalOrFilter(filter1, filter2)

optForElems = Options()

mainElements = []
containers = []
for vp in VPs:
	optForElems.View = vp.View
	walls = vp.Collectors.Walls.ToElements()
	mainElement = GetMainElementFromView(walls, vp)
	mainElements.append(mainElement)
	containers += [doc.GetElement(id) for id in mainElement.GetDependentElements(ElementClassFilter(RebarContainer))] if mainElement else [None]
	
OUT = mainElements, containers
# ----------------------------------------
firstItem = List.FirstItem(list=определение_главного_элемента)
lastItem = List.LastItem(list=определение_главного_элемента)
разборкаКонтейнеров = Custom[РазборкаКонтейнеров](rebarContainers=lastItem)  # Заменяет арматурные контейнеры арматурными стержнями идентичными наполнению контейнера.
end = Revit.Transaction.Transaction.End(input=разборкаКонтейнеров.extractedRebars)
настройка_видимости_арматуры_на = Python(IN[0]=параметрыВида, IN[1]=имя_образца_штриховой_линии, IN[2]=имя_стиля_линии_для_границ_зон, IN[3]=firstItem, IN[4]=end)  # "Настройка видимости арматуры на схемах"; IronPython2
# ---------- настройка_видимости_арматуры_на.python (98 lines) ----------
import math
import clr
clr.AddReference('System')
from System.Collections.Generic import List
clr.AddReference('RevitAPI')
from Autodesk.Revit.DB import *
from Autodesk.Revit.DB.Structure import *
clr.AddReference('RevitServices')
from RevitServices.Persistence import DocumentManager
from RevitServices.Transactions import TransactionManager

def DivideVisibleInvisibleRebarIds(rebars, wall, vp):
	solid = vp.CropBox.CreateViewSolid(vp.CropBox.H/2)
	visibleRebarIds = []
	for rebar in rebars:
		centerLines = rebar.GetTransformedCenterlineCurves(False, True, True, MultiplanarOption.IncludeOnlyPlanarCurves, 0)
		for line in centerLines:
			cutLines = list(solid.IntersectWithCurve(line, None))
			if cutLines:
				visibleRebarIds.append(rebar.Id.IntegerValue)
				break
	invisibleRebarIds = [rebar.Id for rebar in rebars if rebar.Id.IntegerValue not in visibleRebarIds]
	return [ElementId(intId) for intId in visibleRebarIds], invisibleRebarIds

def RebarIsOutOfViewPlane(rebar, vp):
	lines = rebar.GetTransformedCenterlineCurves(False, True, True, MultiplanarOption.IncludeOnlyPlanarCurves, 0)
	for line in lines:
		angle = round(line.Direction.AngleTo(vp.Dirs[2]), 3)
		if not angle == round(math.pi/2, 3) and not angle == round(math.pi/2, 3):
			return True
	else:
		return False

def CreateRebarBounds(rebar, vp):
	view = vp.View
	condition1 = doc.GetElement(rebar.GetShapeId()).SimpleLine
	condition2 = not RebarIsOutOfViewPlane(rebar, vp)
	condition3 = not doc.GetElement(rebar.GetShapeId()).Parameter[BuiltInParameter.ALL_MODEL_TYPE_NAME].AsString().find('_Ш') != -1
	condition4 = not doc.GetElement(rebar.GetShapeId()).Parameter[BuiltInParameter.ALL_MODEL_TYPE_NAME].AsString().find('_Хм') != -1
	lines = []
	if condition1 and condition2:
		rebar.SetPresentationMode(view, RebarPresentationMode.All)
		doc.Regenerate()
		lines = [rebar.GetTransformedCenterlineCurves(False, True, True, MultiplanarOption.IncludeOnlyPlanarCurves, i)[0] for i in [0, rebar.Quantity-1]]
		lines += [Line.CreateBound(lines[0].GetEndPoint(i), lines[-1].GetEndPoint(i)) for i in range(2)]
		for line in lines:
			dLine = doc.Create.NewDetailCurve(view, line)	
			dLine.LineStyle = rebarBoundStyle
		rebar.SetPresentationMode(view, RebarPresentationMode.Middle)
	elif condition3 and condition4:
		rebar.SetPresentationMode(view, RebarPresentationMode.Select)
		for i in range(rebar.Quantity):
			if i == 0 or i == rebar.Quantity - 1 or i == int(round(float(rebar.Quantity - 1)/2)):
				rebar.SetBarHiddenStatus(view, i, False)
			else:
				rebar.SetBarHiddenStatus(view, i, True)
	return lines

def SetRebarSecondaryGraphics(rebar, view):
	rebOverrides = view.GetElementOverrides(rebar.Id)
	rebOverrides.SetHalftone(True)
	rebOverrides.SetSurfaceForegroundPatternVisible(False)
	rebOverrides.SetSurfaceBackgroundPatternVisible(False)
	rebOverrides.SetCutForegroundPatternVisible(False)
	rebOverrides.SetCutBackgroundPatternVisible(False)
	rebOverrides.SetProjectionLineWeight(2)
	rebOverrides.SetProjectionLinePatternId(dashedLinePattern.Id)
	view.SetElementOverrides(rebar.Id, rebOverrides)
				
doc = DocumentManager.Instance.CurrentDBDocument

VPs = IN[0]
mainElements = UnwrapElement(IN[3])

defOverrides = OverrideGraphicSettings()
dashedLinePattern = LinePatternElement.GetLinePatternElementByName(doc, IN[1])
rebarBoundStyle = [gs for gs in FilteredElementCollector(doc).OfClass(GraphicsStyle).ToElements() if gs.Name == IN[2]][0]

TransactionManager.Instance.EnsureInTransaction(doc)

for i, vp in enumerate(VPs):
	mainWall = mainElements[i]
	if mainWall:
		rebars = vp.Collectors.Rebars.ToElements()
		rebarIdSets = DivideVisibleInvisibleRebarIds(rebars, mainWall, vp)
		vp.View.HideElements(List[ElementId](rebarIdSets[1]))
		
		filter = LogicalAndFilter(ElementClassFilter(Rebar), ElementIdSetFilter(List[ElementId](rebarIdSets[0])))
		mainWallRebars = [doc.GetElement(id) for id in mainWall.GetDependentElements(filter)]
		[CreateRebarBounds(rebar, vp) for rebar in mainWallRebars if rebar.Quantity > 2]		
				
		otherRebars = list(vp.Collectors.Rebars.Excluding(List[ElementId]([rebar.Id for rebar in mainWallRebars])).ToElements())
		containers = list(vp.Collectors.Containers.ToElements())
		[SetRebarSecondaryGraphics(rebar, vp.View) for rebar in (otherRebars + containers)]
	
TransactionManager.Instance.TransactionTaskDone()

OUT = ''
# ----------------------------------------
