# Dynamo custom node ОтображениеАрматуры3D.dyf (Dynamo 2.12.0.5650)
# category: 1П.Армирование
# Настройка арматуры в трёхмерном отображении на активном виде (актуально до 2022 версии Revit)

rebarsOrRebarContainers = Input(rebarsOrRebarContainers: var[]..[])  # Список арматурных стержней или арматурных контейнеров
редактирование_арматуры = Python(IN[0]=rebarsOrRebarContainers)  # IronPython2; graph output
# ---------- редактирование_арматуры.python (27 lines) ----------
import sys
import clr
clr.AddReference('RevitAPI')
from Autodesk.Revit.DB import *
from Autodesk.Revit.DB.Structure import *
clr.AddReference('RevitServices')
from RevitServices.Persistence import DocumentManager
from RevitServices.Transactions import TransactionManager

doc = DocumentManager.Instance.CurrentDBDocument

elems = UnwrapElement(IN[0])

rebarFilter = LogicalOrFilter([ElementClassFilter(Rebar), ElementClassFilter(RebarInSystem), ElementClassFilter(RebarContainer)])
view = doc.ActiveView

TransactionManager.Instance.EnsureInTransaction(doc)

if view.GetType() == View3D:
	for elem in elems:
		if rebarFilter.PassesFilter(elem):	
			elem.SetSolidInView(view, True)
			elem.SetUnobscuredInView(view, True)
		
TransactionManager.Instance.TransactionTaskDone()

OUT = ''
# ----------------------------------------
