# Dynamo custom node ПараметрыАрматуры.dyf (Dynamo 2.12.0.5650)
# category: 1П.Кэширование
# Сведения и методы, связанные с арматурными стержнями и арматурными контейнерами

rebarsOrRebarContainers = Input(rebarsOrRebarContainers: var[]..[])  # Список арматурных стержней или арматурных контейнеров
группирование_арматуры_и = Python(IN[0]=rebarsOrRebarContainers)  # "Группирование арматуры и контейнеров"; IronPython2
# ---------- группирование_арматуры_и.python (13 lines) ----------
import clr
clr.AddReference('RevitAPI')
from Autodesk.Revit.DB import *
from Autodesk.Revit.DB.Structure import *
clr.AddReference('RevitServices')
from RevitServices.Persistence import DocumentManager

doc = DocumentManager.Instance.CurrentDBDocument

rebars = [elem for elem in UnwrapElement(IN[0]) if elem.GetType() == Rebar]
rebarContainers = [elem for elem in UnwrapElement(IN[0]) if elem.GetType() == RebarContainer]

OUT = rebars, rebarContainers
# ----------------------------------------
firstItem = List.FirstItem(list=группирование_арматуры_и)

# group: Параметры
имя_параметра = StringInput("1П_Размер_В погонных метрах")
параметры = List.Create(item0=имя_параметра)

сбор_данных_арматуры = Python(IN[0]=firstItem, IN[1]=параметры)  # IronPython2
# ---------- сбор_данных_арматуры.python (113 lines) ----------
import clr
clr.AddReference('RevitAPI')
from Autodesk.Revit.DB import *
from Autodesk.Revit.DB.Structure import *
clr.AddReference('RevitServices')
from RevitServices.Persistence import DocumentManager

opt = Options()

#def GetPointArrayLength(points):
#	dsts = []
#	for point1 in points:
#		for point2 in points:
#			dsts.append(point1.DistanceTo(point2))
#	return max(dsts)

class RebarParameters:
	def __init__(self, rebar):
		self.Rebar = rebar
		self.Elem = rebar
		self.BarType = doc.GetElement(rebar.GetTypeId())
		self.Dir = rebar.GetShapeDrivenAccessor().GetDistributionPath().Direction
		self.Normal = rebar.GetShapeDrivenAccessor().Normal#*IN[2]
		self.Rule = rebar.LayoutRule
		self.Hooks = [[doc.GetElement(rebar.GetHookTypeId(i)) for i in range(2)], [rebar.GetHookOrientation(i) for i in range(2)], [rebar.GetHookRotationAngle(i) for i in range(2)]]
		self.Shape = doc.GetElement(rebar.GetShapeId())
		self.Style = self.Shape.RebarStyle
		self.InMeters = True if self.BarType.GetParameters(IN[1][0])[0].AsInteger() == 1 else False
		self.Host = doc.GetElement(rebar.GetHostId())
		if (self.Host.GetType() == FamilyInstance and self.Host.HasModifiedGeometry()) or self.Host.GetType() != FamilyInstance:
			self.HostSolid = SolidUtils.Clone([geom for geom in list(self.Host.Geometry[opt]) if geom.GetType() == Solid and geom.Volume > 0][0])
		elif self.Host.GetType() == FamilyInstance and self.Host.Symbol.Family.IsInPlace:
			geomInst = [geom for geom in list(self.Host.Geometry[opt]) if geom.GetType() == GeometryInstance][0]
			self.HostSolid = SolidUtils.Clone([geom for geom in geomInst.GetInstanceGeometry() if geom.GetType() == Solid and geom.Volume > 0][0])			
		else:
			self.HostSolid = None
		self.PhaseId = self.Host.Parameter[BuiltInParameter.PHASE_CREATED].AsElementId()
		self.AIName = doc.GetElement(rebar.AssemblyInstanceId).Name if rebar.AssemblyInstanceId != ElementId.InvalidElementId else None
		self.ParentId = rebar.AssemblyInstanceId if rebar.AssemblyInstanceId != ElementId.InvalidElementId else self.Host.Id
		self.ATMark = doc.GetElement(doc.GetElement(rebar.AssemblyInstanceId).GetTypeId()).Parameter[BuiltInParameter.WINDOW_TYPE_ID].AsString() if rebar.AssemblyInstanceId != ElementId.InvalidElementId else None

	def SetLayoutRuleForRCI(self, targetRCI, n):
		if self.Rule == RebarLayoutRule.Single or n == 1:
			targetRCI.SetLayoutAsSingle()
		else:
			step = self.Rebar.MaxSpacing
			L = (n-1) * step
			side = self.Rebar.GetShapeDrivenAccessor().BarsOnNormalSide
			includings = [self.Rebar.IncludeFirstBar, self.Rebar.IncludeLastBar]			
			if self.Rule == RebarLayoutRule.FixedNumber:
				targetRCI.SetLayoutAsFixedNumber(n, L, side, includings[0],includings[1])
			elif self.Rule == RebarLayoutRule.MaximumSpacing:
				targetRCI.SetLayoutAsMaximumSpacing(step, L, side, includings[0], includings[1])
			elif self.Rule == RebarLayoutRule.NumberWithSpacing:			
				targetRCI.SetLayoutAsNumberWithSpacing(n, step, side, includings[0], includings[1])
				
#	def GetLineSet(self):
#		rebar = self.Rebar
#		data = []
#		zs = []
#		for i in range(rebar.Quantity):
#			transform = rebar.GetMovedBarTransform(i)
#			z = round(transform.Origin.Z*304.8)
#			if z not in zs:
#				zs.append(z)
#		zs = sorted(zs)
#		startLines = rebar.GetTransformedCenterlineCurves(False, True, True, MultiplanarOption.IncludeOnlyPlanarCurves, 0)
#		xDir = rebar.GetShapeDrivenAccessor().Normal*IN[2]
#		for z in zs:
#			points = [rebar.GetTransformedCenterlineCurves(False, True, True, MultiplanarOption.IncludeOnlyPlanarCurves, i)[0].GetEndPoint(0) for i in range(rebar.Quantity) if round(rebar.GetMovedBarTransform(i).Origin.Z*304.8) == z]	
#			transform = Transform.CreateTranslation(XYZ.BasisZ*z/304.8 + xDir*GetPointArrayLength(points))
#			lines = [line.CreateTransformed(transform) for line in startLines]
#			n = len(points)
#			data.append([lines, n])
#		return data
		
	def GetLineSet(self):
		rebar = self.Rebar		
		startOrigin = rebar.GetMovedBarTransform(0).Origin
		startLines = rebar.GetTransformedCenterlineCurves(False, True, True, MultiplanarOption.IncludeOnlyPlanarCurves, 0)
		data = [[startLines, 1, startOrigin]]
		negativeStepTransform = Transform.CreateTranslation(-self.Dir*rebar.MaxSpacing)
		if rebar.Quantity > 1:
			for i in range(rebar.Quantity)[1:]:
				if rebar.DoesBarExistAtPosition(i):
					currentOrigin = rebar.GetMovedBarTransform(i).Origin
					condition1 = currentOrigin.IsAlmostEqualTo(data[-1][2])
					condition2 = currentOrigin.IsAlmostEqualTo(data[-1][2] + self.Dir*rebar.MaxSpacing*data[-1][1])
					condition3 = currentOrigin.IsAlmostEqualTo(data[-1][2] - self.Dir*rebar.MaxSpacing*2*data[-1][1])
					if condition1 or condition2 or condition3:
						data[-1][1] += 1
						if condition3:						
							data[-1][0] = [line.CreateTransformed(negativeStepTransform) for line in data[-1][0]]
					else:
						startOrigin = currentOrigin
						startLines = rebar.GetTransformedCenterlineCurves(False, True, True, MultiplanarOption.IncludeOnlyPlanarCurves, i)
						data.append([startLines, 1, startOrigin])
		return data
		
	def HasMovedBar(self):
		rebar = self.Rebar
		for i in range(rebar.Quantity):
			transform = rebar.GetMovedBarTransform(i)
			check = rebar.DoesBarExistAtPosition(i)
			if not transform.Origin.IsAlmostEqualTo(XYZ()) or not check:
				return True
		return False

doc = DocumentManager.Instance.CurrentDBDocument

RPs = [RebarParameters(rebar) for rebar in UnwrapElement(IN[0])]

OUT = RPs
# ----------------------------------------
rebarParameters = Output(сбор_данных_арматуры)  # Список параметров арматуры
lastItem = List.LastItem(list=группирование_арматуры_и)
сбор_данных_контейнеров = Python(IN[0]=lastItem)  # IronPython2
# ---------- сбор_данных_контейнеров.python (115 lines) ----------
import clr
import math
clr.AddReference('System')
from System.Collections.Generic import List
clr.AddReference('RevitAPI')
from Autodesk.Revit.DB import *
from Autodesk.Revit.DB.Structure import *
clr.AddReference('RevitServices')
from RevitServices.Persistence import DocumentManager

def CreateSolidFromBBox(box, origin):
	minPoint = box.Transform.OfPoint(box.Min)
	maxPoint = box.Transform.OfPoint(box.Max)	
	diagonal = maxPoint - minPoint
	diagonalL = minPoint.DistanceTo(maxPoint)	
	transform = box.Transform
	dirs = [transform.BasisX, transform.BasisY, transform.BasisZ]	
	dims = [diagonalL*math.cos(diagonal.AngleTo(dirs[i])) for i in range(3)]	
	p0 = origin
	p1 = p0 + dirs[0]*dims[0]
	p2 = p1 + dirs[1]*dims[1]
	p3 = p2 - dirs[0]*dims[0]
	points = [p0, p1, p2, p3]	
	lines = [Line.CreateBound(points[i-1], points[i]) for i in range(4)]
	cl = CurveLoop.Create(lines)
	solid = GeometryCreationUtilities.CreateExtrusionGeometry([cl], dirs[2], dims[2]) 	
	return solid
	
def CopyRebarLayoutRule(sourceRebar, targetRebar):
	rule = sourceRebar.LayoutRule
	if rule == RebarLayoutRule.Single:
		targetRebar.GetShapeDrivenAccessor().SetLayoutAsSingle()
	elif rule == RebarLayoutRule.FixedNumber:
		n = sourceRebar.Quantity
		step = sourceRebar.MaxSpacing
		targetRebar.GetShapeDrivenAccessor().SetLayoutAsFixedNumber(n, step, False, True, True)
	elif rule == RebarLayoutRule.MaximumSpacing or rule == RebarLayoutRule.NumberWithSpacing:
		step = sourceRebar.MaxSpacing
		n = sourceRebar.Quantity
		L = step*(n-1)
		targetRebar.GetShapeDrivenAccessor().SetLayoutAsNumberWithSpacing(n, step, False, True, True)	
	
class RebarContainerItemParameters():
	def __init__(self, rci):
		self.RCI = rci
		self.BarType = doc.GetElement(rci.BarTypeId)
		self.Lines = rci.GetCenterlineCurves(False, True, True)
		self.Dir = rci.GetDistributionPath().Direction
		self.Normal = rci.Normal
		self.Rule = rci.LayoutRule
		self.Hooks = [[doc.GetElement(rci.GetHookTypeId(j)) for j in range(2)], [rci.GetHookOrientation(j) for j in range(2)]]
		self.Shape = doc.GetElement(rci.RebarShapeId)
		self.Style = self.Shape.RebarStyle
		self.D = self.BarType.BarModelDiameter
		
	def SetLayoutRuleForRebar(self, targetRebar):
		if self.Rule == RebarLayoutRule.Single:
			targetRebar.GetShapeDrivenAccessor().SetLayoutAsSingle()
		else:
			n = self.RCI.Quantity
			L = self.RCI.ArrayLength
			step = self.RCI.MaxSpacing
			side = self.RCI.BarsOnNormalSide
			includings = [self.RCI.IncludeFirstBar, self.RCI.IncludeLastBar]			
			if self.Rule == RebarLayoutRule.FixedNumber:
				targetRebar.GetShapeDrivenAccessor().SetLayoutAsFixedNumber(n, L, side, includings[0],includings[1])
			elif self.Rule == RebarLayoutRule.MaximumSpacing:
				targetRebar.GetShapeDrivenAccessor().SetLayoutAsMaximumSpacing(step, L, side, includings[0], includings[1])
			elif self.Rule == RebarLayoutRule.NumberWithSpacing:			
				targetRebar.GetShapeDrivenAccessor().SetLayoutAsNumberWithSpacing(n, step, side, includings[0], includings[1])
				
	def SetLayoutRuleForRCI(self, targetRCI):
		if self.Rule == RebarLayoutRule.Single:
			targetRCI.SetLayoutAsSingle()
		else:
			n = self.RCI.Quantity
			L = self.RCI.ArrayLength
			step = self.RCI.MaxSpacing
			side = self.RCI.BarsOnNormalSide
			includings = [self.RCI.IncludeFirstBar, self.RCI.IncludeLastBar]			
			if self.Rule == RebarLayoutRule.FixedNumber:
				targetRCI.SetLayoutAsFixedNumber(n, L, side, includings[0],includings[1])
			elif self.Rule == RebarLayoutRule.MaximumSpacing:
				targetRCI.SetLayoutAsMaximumSpacing(step, L, side, includings[0], includings[1])
			elif self.Rule == RebarLayoutRule.NumberWithSpacing:			
				targetRCI.SetLayoutAsNumberWithSpacing(n, step, side, includings[0], includings[1])

class RebarContainerParameters:
	def __init__(self, container):
		self.Elem = container
		self.ElemType = doc.GetElement(container.GetTypeId())
		self.ElemTypeName = self.ElemType.Parameter[BuiltInParameter.ALL_MODEL_TYPE_NAME].AsString()
		self.BBox = container.BoundingBox[view]
		self.Transform = self.BBox.Transform
		self.Origin = self.Transform.OfPoint(self.BBox.Min)
		self.Center = Line.CreateBound(self.Transform.OfPoint(self.BBox.Min), self.Transform.OfPoint(self.BBox.Max)).Evaluate(0.5, True)
		self.PhaseId = container.Parameter[BuiltInParameter.PHASE_CREATED].AsElementId()
		self.Host = doc.GetElement(container.GetHostId())
		self.RPs = [RebarContainerItemParameters(container.GetItem(i)) for i in range(container.ItemsCount)]
		self.Mark = container.Parameter[BuiltInParameter.ALL_MODEL_MARK].AsString() if container.Parameter[BuiltInParameter.ALL_MODEL_MARK].HasValue else None
		self.AIName = doc.GetElement(container.AssemblyInstanceId).Name if container.AssemblyInstanceId != ElementId.InvalidElementId else None

	def CreateHost(self, doc, cat, name, origin):
		hostSolid = CreateSolidFromBBox(self.BBox, origin)
		host = DirectShape.CreateElement(doc, cat.Id)
		host.SetShape([hostSolid])
		host.SetName(name)
		return host		

doc = DocumentManager.Instance.CurrentDBDocument

view = doc.ActiveView
RCPs = [RebarContainerParameters(container) for container in UnwrapElement(IN[0])]

OUT = RCPs
# ----------------------------------------
rebarContainerParameters = Output(сбор_данных_контейнеров)  # Список параметров контейнеров
