# Dynamo custom node ПараметрыВида.dyf (Dynamo 2.13.1.3887)
# category: 1П.Кэширование
# Сбор исходных данных, свзяанных с видами

views = Input(views: var[]..[])  # Список видов
знак_направления_разрезов = IntegerSlider(1, range=-1..1 step 2)
сбор_исходных_данных_видов = Python(IN[0]=views, IN[1]=знак_направления_разрезов)  # IronPython2
# ---------- сбор_исходных_данных_видов.python (109 lines) ----------
import sys
import clr
import math
clr.AddReference('RevitAPI')
from Autodesk.Revit.DB import *
from Autodesk.Revit.DB.Structure import *
clr.AddReference('RevitServices')
from RevitServices.Persistence import DocumentManager

def ByMark(vp):
	return vp.ElemMark

class CropBoxParameters:
	def __init__(self, box, dirs):
		self.Dirs = dirs
		self.Origin = box.Transform.OfPoint(box.Min)
		self.Token = IN[1]
		self.Diagonal = box.Transform.OfPoint(box.Max) - box.Transform.OfPoint(box.Min)
		self.DiagonalL = box.Min.DistanceTo(box.Max)
		self.DiagonalLine = Line.CreateBound(box.Transform.OfPoint(box.Min), box.Transform.OfPoint(box.Max))
		self.L = self.DiagonalL*math.cos(self.Diagonal.AngleTo(dirs[0]*self.Token))
		self.B = self.DiagonalL*math.cos(self.Diagonal.AngleTo(dirs[1]))
		self.H = self.DiagonalL*math.cos(self.Diagonal.AngleTo(dirs[2]))
		self.BotLine = Line.CreateBound(self.Origin, self.Origin + dirs[0]*self.L*self.Token)
		self.LeftLine = Line.CreateBound(self.Origin, self.Origin + dirs[1]*self.B)
		self.TopLine = self.BotLine.CreateTransformed(Transform.CreateTranslation(dirs[1]*self.B))
		self.RightLine = self.LeftLine.CreateTransformed(Transform.CreateTranslation(dirs[0]*self.L*self.Token))
		self.FrontPlane = Plane.CreateByOriginAndBasis(self.Origin, dirs[0], dirs[1])
		self.Centroid = self.DiagonalLine.Evaluate(0.5, True)
		self.CenterPlane = Plane.CreateByOriginAndBasis(self.Centroid, dirs[0], dirs[1])
		self.CentroidDepthLine = Line.CreateBound(self.Centroid - dirs[2]*self.H/2, self.Centroid + dirs[2]*self.H/2)
		self.CentroidOutline = Outline(self.Centroid - dirs[2]*self.H/2, self.Centroid + dirs[2]*self.H/2 + dirs[1]*10/304.8)
		if self.CentroidOutline.IsEmpty:
			self.CentroidOutline = Outline(self.Centroid - dirs[2]*self.H/2, self.Centroid + dirs[2]*self.H/2 - dirs[1]*10/304.8)
		self.CentroidDepthLineUnbound = Line.CreateUnbound(self.Centroid, dirs[2])
		
	def CreateViewSolid(self, dst):		
		points = []
		points.append(self.Origin + self.Dirs[2]*self.H)
		points.append(points[-1] + self.Dirs[1]*self.B)
		points.append(points[-1] + self.Dirs[0]*self.L)
		points.append(points[-1] - self.Dirs[1]*self.B)
		lines = [Line.CreateBound(points[i-1], points[i]) for i in range(4)]
		cl = CurveLoop.Create(lines)		
		solid = GeometryCreationUtilities.CreateExtrusionGeometry([cl], -self.Dirs[2], dst)
		return solid
		
class ViewCollectors:
	def __init__(self, view):
		self.Floors = FilteredElementCollector(doc, view.Id).OfClass(Floor)
		self.Walls = FilteredElementCollector(doc, view.Id).OfClass(Wall)
		self.Columns = FilteredElementCollector(doc, view.Id).OfClass(FamilyInstance).OfCategory(BuiltInCategory.OST_StructuralColumns)
		self.Framing = FilteredElementCollector(doc, view.Id).OfClass(FamilyInstance).OfCategory(BuiltInCategory.OST_StructuralFraming)
		self.GenericModel = FilteredElementCollector(doc, view.Id).OfClass(FamilyInstance).OfCategory(BuiltInCategory.OST_GenericModel)		
		self.Union = self.Floors
		[self.Union.UnionWith(collector) for collector in [self.Walls, self.Columns, self.Framing, self.GenericModel]]
		self.Rebars = FilteredElementCollector(doc, view.Id).WherePasses(LogicalOrFilter(ElementClassFilter(Rebar), ElementClassFilter(RebarInSystem)))
		self.Containers = FilteredElementCollector(doc, view.Id).OfClass(RebarContainer)
		
class ViewParameters:
	def __init__(self, view):
		self.View = view
		self.Name = view.Name
		self.ElemMark = view.Name.split('_')[-1]
		self.Dirs = [view.RightDirection, view.UpDirection, view.ViewDirection]
		self.CropBox = CropBoxParameters(view.CropBox, self.Dirs)
		self.Scale = view.Scale/100
		self.Collectors = ViewCollectors(view)
		self.ViewportSheetName = view.Parameter[BuiltInParameter.VIEWPORT_SHEET_NAME].AsString() if view.Parameter[BuiltInParameter.VIEWPORT_SHEET_NAME].HasValue else ''
		self.MainElement = None
		
	def ShouldHideGridBubbles(self):
		condition1 = not self.Dirs[2].IsAlmostEqualTo(XYZ.BasisZ) and not self.Dirs[2].IsAlmostEqualTo(-XYZ.BasisZ)
		condition2 = not self.Name.find('рмирован')
		if condition1 and condition2:
			return True
		else:
			return False
			
	def GetMainElementFromView(self, elems):
		optForElems = Options()
		for elem in elems:
			if elem.GetType() == FamilyInstance and elem.Symbol.Family.IsInPlace:
				geomInst = [geom for geom in list(elem.Geometry[optForElems]) if geom.GetType() == GeometryInstance][0]
				solid = [geom for geom in geomInst.GetInstanceGeometry() if geom.GetType() == Solid and geom.Volume > 0][0]
			else:
				solid = [geom for geom in list(elem.Geometry[optForElems]) if geom.GetType() == Solid and geom.Volume > 0][0]
			voids = [doc.GetElement(id) for id in elem.GetDependentElements(voidFilter)]
			for i in [[0, 0], [-0.25, 0], [0.25, 0], [0, -0.25], [0, 0.25]]:
				transform = Transform.CreateTranslation(self.Dirs[0]*self.CropBox.L*i[0] + self.Dirs[1]*self.CropBox.H*i[-1])
				line = self.CropBox.CentroidDepthLine.CreateTransformed(transform)
				filter = LogicalOrFilter([BoundingBoxContainsPointFilter(line.Evaluate(j*0.1, True)) for j in range(10)])
				if list(solid.IntersectWithCurve(line, None)) or [void for void in voids if filter.PassesFilter(void)]:
					self.MainElement = elem
					return elem
		else:
			return None	
			
doc = DocumentManager.Instance.CurrentDBDocument

filter1 = LogicalAndFilter(ElementClassFilter(FamilyInstance), ElementCategoryFilter(BuiltInCategory.OST_Windows))
filter2 = LogicalAndFilter(ElementClassFilter(FamilyInstance), ElementCategoryFilter(BuiltInCategory.OST_Doors))
voidFilter = LogicalOrFilter(filter1, filter2)

views = UnwrapElement(IN[0])

VPs = [ViewParameters(view) for view in views]

OUT = VPs
# ----------------------------------------
VPs = Output(сбор_исходных_данных_видов)  # Список параметров видов
