# Dynamo custom node ПараметрыКолонны.dyf (Dynamo 2.13.1.3887)
# category: 1П.Кэширование
# Сведения и методы, связанные с колоннами

активныйВид = Custom[АктивныйВид]()  # Активный вид активного документа
columns = Input(columns: var[]..[])  # Список колонн
фильтрацияЖБК = Custom[ФильтрацияЖБК]()  # Фильтрация железобетонных конструкций, изделий в пределах активного документа Revit
join = List.Join(list0=фильтрацияЖБК.floorIds, list1=фильтрацияЖБК.foundationIds)

# group: Параметры
имя_параметра = StringInput("Рзм.Длина")
имя_параметра_2 = StringInput("Рзм.Ширина")
имя_параметра_3 = StringInput("1П_Размер_Высота")
имя_параметра_4 = StringInput("1П_Размер_Ширина")
имя_параметра_5 = StringInput("1П_Размер_В погонных метрах")
имя_параметра_6 = StringInput("1П_Арм_Класс")
имя_параметра_7 = StringInput("1П_Обозначение")
имя_параметра_8 = StringInput("1П_Наименование")
имя_параметра_9 = StringInput("1П_Арм_Семейство")
имя_параметра_10 = StringInput("1П_Блок")
имена_параметров = List.Create(item0=имя_параметра, item1=имя_параметра_2, item2=имя_параметра_3, item3=имя_параметра_4, item4=имя_параметра_5, item5=имя_параметра_6, item6=имя_параметра_7, item7=имя_параметра_8, item8=имя_параметра_9, item9=имя_параметра_10)

# group: Расстояния
предварительное_расстояние_до = DoubleSlider(100, range=0..100 step 5)  # "Предварительное расстояние до центра хомута"
защитный_слой_торцов_арматуры = DoubleSlider(50, range=10..50 step 5)
расстояние_до_центра = DoubleSlider(50, range=30..75 step 5)  # "Расстояние до центра вертикальной арматуры в колоннах"
деление_на_приопорную_пролетную = DoubleSlider(0.25, range=0..1 step 0.25)  # "Деление на приопорную/пролетную зоны"
расстояния = List.Create(item0=предварительное_расстояние_до, item1=защитный_слой_торцов_арматуры, item2=расстояние_до_центра, item3=деление_на_приопорную_пролетную)

сбор_данных = Python(IN[0]=активныйВид, IN[1]=columns, IN[2]=фильтрацияЖБК.structuralColumnIds, IN[3]=фильтрацияЖБК.wallIds, IN[4]=join, IN[5]=имена_параметров, IN[6]=фильтрацияЖБК.structuralFramingIds, IN[7]=расстояния)  # IronPython2
# ---------- сбор_данных.python (399 lines) ----------
import sys
import clr
import math
import System
clr.AddReference('System')
from System.Collections.Generic import List
clr.AddReference('RevitAPI')
from Autodesk.Revit.DB import *
from Autodesk.Revit.DB.Structure import *
clr.AddReference('RevitServices')
from RevitServices.Persistence import DocumentManager
from RevitServices.Transactions import TransactionManager

doc = DocumentManager.Instance.CurrentDBDocument
basePoint = FilteredElementCollector(doc).OfCategory(BuiltInCategory.OST_ProjectBasePoint).FirstElement()

RbtValues = {'B15':0.75, 'B20':0.9, 'B25':1.05, 'B30':1.15, 'B35':1.3, 'B40':1.4, 'B45':1.5}

def ComputeBaseAnchorLength(d, bclass):
	Rbt = RbtValues[bclass]
	Rs = 435
	n2 = 1
	if round(d*304.8) > 32:
		n2 = 0.9
	Rbond = Rbt*2.5*n2
	As = (math.pi*d**2)/4
	us = math.pi*d
	l0an = (Rs*As)/(Rbond*us)
	return l0an
	
def ComputeOverlapLength(d, bclass):
	l0an = ComputeBaseAnchorLength(d, bclass)
	lan = 0.9*l0an
	return math.ceil(max([0.3*l0an, 15*d, 200/304.8, lan])*304.8/10)*10/304.8

def VecABS(vec):
	x = abs(vec.X)
	y = abs(vec.Y)
	z = abs(vec.Z)
	return XYZ(x,y,z)

def SortGeomByZ(geom):
	return geom.Origin.Z
	
def ComputeBendDiameter(d, rClass):
	if rClass == 'А240':
		if round(d*304.8) < 20:
			db = 2.5*d
		else:
			db = 4*d
	else:
		if round(d*304.8) < 20:
			db = 5*d
		else:
			db = 8*d
	return db
	
def SetRebarBarTypeParameters(rt, d1, d2, rClass, im):
	rt.GetParameters(IN[5][4])[0].Set(im)
	rt.GetParameters(IN[5][5])[0].Set(int(rClass.split('А')[-1].split('С')[0]))
	rt.GetParameters(IN[5][6])[0].Set('ГОСТ 34028-2016')
	rt.GetParameters(IN[5][7])[0].Set(rClass)
	rt.GetParameters(IN[5][8])[0].Set(0)
	if rClass == 'А240':
		rt.Parameter[BuiltInParameter.REBAR_BAR_DEFORMATION_TYPE].Set(1)
	else:
		rt.Parameter[BuiltInParameter.REBAR_BAR_DEFORMATION_TYPE].Set(0)
	rt.Parameter[BuiltInParameter.REBAR_MODEL_BAR_DIAMETER].Set(d1)
	rt.Parameter[BuiltInParameter.REBAR_BAR_DIAMETER].Set(d1)
	if d2 > 0:
		db = d2
	else:
		db = ComputeBendDiameter(d, rClass)
	rt.Parameter[BuiltInParameter.REBAR_STANDARD_BEND_DIAMETER].Set(db)
	rt.Parameter[BuiltInParameter.REBAR_BAR_STIRRUP_BEND_DIAMETER].Set(db)
	rt.Parameter[BuiltInParameter.REBAR_STANDARD_HOOK_BEND_DIAMETER].Set(db)
	materials = [mat for mat in FilteredElementCollector(doc).OfClass(Material).ToElements() if mat.Name.find('Арматура D') == 0 and int(mat.Name.split('D')[-1]) == int(round(d1*304.8))]
	if materials:
		rt.Parameter[BuiltInParameter.MATERIAL_ID_PARAM].Set(materials[0].Id)
	subCats = [sc for sc in Category.GetCategory(doc, BuiltInCategory.OST_Rebar).SubCategories if sc.Name == 'D'+str(int(round(d1*304.8)))]
	if subCats:
		rt.Parameter[BuiltInParameter.REBAR_BAR_STYLE].Set(subCats[0].Id)

view = UnwrapElement(IN[0])
columns = UnwrapElement(IN[1])
columnIds = UnwrapElement(IN[2])
wallIds = UnwrapElement(IN[3])
slabIds = UnwrapElement(IN[4])
beamIds = UnwrapElement(IN[6])

opt = Options()
opt.ComputeReferences = True
		
class SlabParameters:
	def __init__(self, slab):
		self.Elem = slab
		self.Id = slab.Id.IntegerValue
		if slab.GetType() == Floor:
			self.T = slab.Parameter[BuiltInParameter.FLOOR_ATTR_THICKNESS_PARAM].AsDouble()
			self.SpanAngle = slab.SpanDirectionAngle
		else:
			self.T = slab.Symbol.Parameter[BuiltInParameter.STRUCTURAL_FOUNDATION_THICKNESS].AsDouble()
			self.SpanAngle = slab.GetTransform().BasisX.Normalize().AngleOnPlaneTo(XYZ.BasisX, XYZ.BasisZ)
			
		self.LvlId = slab.LevelId
		maxVol = max([geom.Volume for geom in list(slab.Geometry[opt]) if geom.GetType() == Solid])
		self.Solid = [geom for geom in list(slab.Geometry[opt]) if geom.GetType() == Solid and geom.Volume == maxVol][0]
		self.Supports = None
		self.BClass = slab.GetParameters('1Пп_Класс бетона')[0].AsValueString()
		if self.BClass.find('B') == -1:
			self.BClass = 'B' + self.BClass
		self.TopCovDst = 0
		self.BotCovDst = 0
		self.OthCovDst = 0
		if slab.GetType() == FamilyInstance or slab.Parameter[BuiltInParameter.FLOOR_PARAM_IS_STRUCTURAL].AsInteger() == 1:
			if doc.GetElement(slab.Parameter[BuiltInParameter.CLEAR_COVER_TOP].AsElementId()):
				self.TopCovDst = doc.GetElement(slab.Parameter[BuiltInParameter.CLEAR_COVER_TOP].AsElementId()).CoverDistance
			if doc.GetElement(slab.Parameter[BuiltInParameter.CLEAR_COVER_BOTTOM].AsElementId()):
				self.BotCovDst = doc.GetElement(slab.Parameter[BuiltInParameter.CLEAR_COVER_BOTTOM].AsElementId()).CoverDistance
			if doc.GetElement(slab.Parameter[BuiltInParameter.CLEAR_COVER_OTHER].AsElementId()):
				self.OthCovDst = doc.GetElement(slab.Parameter[BuiltInParameter.CLEAR_COVER_OTHER].AsElementId()).CoverDistance
				
		if round(self.SpanAngle*100)/100 == 0 or round(self.SpanAngle*100)/100 == round(3.14*100)/100:
			self.DMainTOP = slab.GetParameters('1Пп_Арм_X_Верх_Диаметр')[0].AsDouble()
			self.DMainBOT = slab.GetParameters('1Пп_Арм_X_Низ_Диаметр')[0].AsDouble()
			self.DSecTOP = slab.GetParameters('1Пп_Арм_Y_Верх_Диаметр')[0].AsDouble()
			self.DSecBOT = slab.GetParameters('1Пп_Арм_Y_Низ_Диаметр')[0].AsDouble()
		else:
			self.DMainTOP = slab.GetParameters('1Пп_Арм_Y_Верх_Диаметр')[0].AsDouble()
			self.DMainBOT = slab.GetParameters('1Пп_Арм_Y_Низ_Диаметр')[0].AsDouble()
			self.DSecTOP = slab.GetParameters('1Пп_Арм_X_Верх_Диаметр')[0].AsDouble()
			self.DSecBOT = slab.GetParameters('1Пп_Арм_X_Низ_Диаметр')[0].AsDouble()
		self.Phase = slab.Parameter[BuiltInParameter.PHASE_CREATED].AsElementId()
		self.Workset = slab.Parameter[BuiltInParameter.ELEM_PARTITION_PARAM].AsInteger()
		if slab.GetParameters(IN[5][9]):
			self.Section = slab.GetParameters(IN[5][9])[0].AsString()
		else:
			self.Section = None
		
		
	def GetSlabBottomSupports(self, wp):
		cutLine = Line.CreateBound(wp.Geom.BotCenterLine.GetEndPoint(0) - XYZ.BasisZ*10/304.8, wp.Geom.BotCenterLine.GetEndPoint(1) - XYZ.BasisZ*10/304.8)
		solid = self.Solid
		spotLines = list(solid.IntersectWithCurve(cutLine, None))
		slabSupports = []
		for spotLine in spotLines:
			p0 = spotLine.GetEndPoint(0) + XYZ.BasisZ*10/304.8
			p1 = spotLine.GetEndPoint(1) + XYZ.BasisZ*10/304.8
			slabSupports.append(Line.CreateBound(p0, p1))
		return slabSupports
		
	def GetSlabSupports(self, wp, delta):
		cutLine = Line.CreateBound(wp.Geom.TopCenterLine.GetEndPoint(0) + XYZ.BasisZ*(10/304.8+delta), wp.Geom.TopCenterLine.GetEndPoint(1) + XYZ.BasisZ*(10/304.8+delta))
		solid = self.Solid
		spotLines = list(solid.IntersectWithCurve(cutLine, None))
		slabSupports = []
		for spotLine in spotLines:
			p0 = spotLine.GetEndPoint(0) - XYZ.BasisZ*10/304.8
			p1 = spotLine.GetEndPoint(1) - XYZ.BasisZ*10/304.8
			slabSupports.append(Line.CreateBound(p0, p1))
		return slabSupports
		
class ElemFaces:
	def __init__(self, geom):
		faces = geom.Solid.Faces
		xDir = VecABS(geom.XDir)
		yDir = VecABS(geom.YDir)
		self.Top = [face for face in faces if face.FaceNormal.Normalize().IsAlmostEqualTo(XYZ.BasisZ)]
		self.Bottom = [face for face in faces if face.FaceNormal.Normalize().IsAlmostEqualTo(-XYZ.BasisZ)]
		self.Short = [face for face in faces if VecABS(face.FaceNormal.Normalize()).IsAlmostEqualTo(xDir)]
		self.Long = [face for face in faces if VecABS(face.FaceNormal.Normalize()).IsAlmostEqualTo(yDir)]
		
class BeamParameters:
	def __init__(self, beam):
		self.Elem = beam
		self.Id = beam.Id.IntegerValue
		self.LvlId = beam.Parameter[BuiltInParameter.INSTANCE_REFERENCE_LEVEL_PARAM].AsElementId()
		self.Solid = [geom for geom in list(beam.Geometry[opt]) if geom.GetType() == Solid and geom.Volume > 0][0]
		self.Supports = None
		if beam.Symbol.GetParameters('Высота'):
			self.H = beam.Symbol.GetParameters('Высота')[0].AsDouble()
		else:
			self.H = None
		
	def GetBeamSupports(self, wp):
		cutLine = Line.CreateBound(wp.Geom.TopCenterLine.GetEndPoint(0) + XYZ.BasisZ*10/304.8, wp.Geom.TopCenterLine.GetEndPoint(1) + XYZ.BasisZ*10/304.8)
		solid = self.Solid
		spotLines = list(solid.IntersectWithCurve(cutLine, None))
		beamSupports = []
		for spotLine in spotLines:
			p0 = spotLine.GetEndPoint(0) - XYZ.BasisZ*10/304.8
			p1 = spotLine.GetEndPoint(1) - XYZ.BasisZ*10/304.8
			line = Line.CreateBound(p0, p1)
			if round(line.Length*304.8) == round(spotLine.Length*304.8):
				beamSupports.append(line)
		return beamSupports		
	
class ColumnGeometryParameters:
	def __init__(self, column):
		self.Elem = column
		self.CutCornerBL = 0
		if column.GetParameters('Подрезка углов BL'):
			self.CutCornerBL = column.GetParameters('Подрезка углов BL')[0].AsDouble()
		self.CutCornerBR = 0
		if column.GetParameters('Подрезка углов BR'):
			self.CutCornerBR = column.GetParameters('Подрезка углов BR')[0].AsDouble()
		
		self.L = column.Symbol.GetParameters(IN[5][0])[0].AsDouble() - self.CutCornerBL - self.CutCornerBR
		self.T = column.Symbol.GetParameters(IN[5][1])[0].AsDouble()
		self.H = column.GetParameters(IN[5][2])[0].AsDouble()
		self.BotOffset = column.Parameter[BuiltInParameter.FAMILY_BASE_LEVEL_OFFSET_PARAM].AsDouble()
		self.BotLvlId = column.Parameter[BuiltInParameter.FAMILY_BASE_LEVEL_PARAM].AsElementId()
		self.BotZ = doc.GetElement(self.BotLvlId).Elevation + self.BotOffset
		self.TopOffset = column.Parameter[BuiltInParameter.FAMILY_TOP_LEVEL_OFFSET_PARAM].AsDouble()
		self.TopLvlId = column.Parameter[BuiltInParameter.FAMILY_TOP_LEVEL_PARAM].AsElementId()
		self.TopZ = self.BotZ + self.H			
		self.XDir = column.GetTransform().BasisX
		self.YDir = column.GetTransform().BasisY
		self.BotOrigin = column.Location.Point + XYZ.BasisZ*(self.BotZ + basePoint.Position.Z) - self.XDir*self.CutCornerBR/2 + self.XDir*self.CutCornerBL/2
		self.MiddleOrigin = self.BotOrigin + XYZ.BasisZ*self.H/2
		self.EndPoints = [self.BotOrigin - self.XDir*self.L/2, self.BotOrigin + self.XDir*self.L/2]	
		self.BotCenterLine = Line.CreateBound(self.EndPoints[0], self.EndPoints[1])
		self.TopCenterLine = Line.CreateBound(self.EndPoints[0] + XYZ.BasisZ*self.H, self.EndPoints[1] + XYZ.BasisZ*self.H)
		self.Solid = [geom for geom in list(column.Geometry[opt]) if geom.GetType() == Solid and geom.Volume > 0][0]
		self.Faces = ElemFaces(self)
		self.Chamfer = None
					
	def TurnOnOffChamfers(self, switch):
		if self.Elem.GetParameters('Фаски'):
			if switch:
				value = [id for id in self.Elem.Symbol.Family.GetFamilyTypeParameterValues(self.Elem.GetParameters('Фаски')[0].Id) if doc.GetElement(id).FamilyName == 'Угол'][0]
			else:
				value = [id for id in self.Elem.Symbol.Family.GetFamilyTypeParameterValues(self.Elem.GetParameters('Фаски')[0].Id) if doc.GetElement(id).FamilyName == 'Без подрезки'][0]
			self.Elem.GetParameters('Фаски')[0].Set(value)
			return self.Elem.Symbol.GetParameters('Размер фаски')[0].AsDouble()
		else:
			return None
		
class ColumnReinforcement:
	def __init__(self, column):
		self.Type = 'Column'
		self.Elem = column
		self.DX = column.GetParameters('1Пп_Арм_Хомуты_Диаметр')[0].AsDouble()
		self.DY1 = column.GetParameters('1Пп_Арм_Вертикальная_Диаметр 1')[0].AsDouble()
		self.NY1 = column.GetParameters('1Пп_Арм_Вертикальная_Количество')[0].AsInteger()
		self.StepX = column.GetParameters('1Пп_Арм_Хомуты_Шаг приопорный')[0].AsDouble()
		self.StepX2 = column.GetParameters('1Пп_Арм_Хомуты_Шаг пролетный')[0].AsDouble()
		self.CovOth = None
		self.HasAnchorPlates = column.GetParameters('1Пп_Арм_Вертикальная_Анкерные пластины')[0].AsInteger()
		self.HasVStirrups = column.GetParameters('1Пп_Арм_Вертикальная_Пшки')[0].AsInteger()
		self.NX = None
		self.VRebarParameters = []
		self.VStirrupParameters = []
		self.HStirrupParameters = []
		self.AnchorParameters = []
		self.RCTypeId = None
		
	def GetRCType(self):
		self.RCTypeId = RebarContainerType.GetOrCreateRebarContainerType(doc, 'Арматурный каркас')
				
	def GetRebarTypes(self):	
		self.RebarTypeDX = self.GetRebarType(self.DX, 'А240', self.DY1)
		self.RebarTypeDY1 = self.GetRebarType(self.DY1, 'А500С', 0)
		
	def GetRebarType(self, d, rClass, dV):
		for rt in FilteredElementCollector(doc).OfClass(RebarBarType).ToElements():
			name = rt.Parameter[BuiltInParameter.SYMBOL_NAME_PARAM].AsString()
			diameter = round(rt.Parameter[BuiltInParameter.REBAR_BAR_DIAMETER].AsDouble()*304.8)
			inMeteres = rt.get_Parameter(System.Guid('844a01e2-19fc-4dc5-baa0-a4bda30ef1f6')).AsInteger()
			if name.find(rClass) != -1 and diameter == round(d*304.8) and inMeteres == 0 and (dV == 0 or name.find(str(int(round(dV*304.8)))) != -1):
				break
		else:
			rt = RebarBarType.Create(doc)
			if dV > 0:
				suffix = '_' + str(int(round(dV*304.8)))
			else:
				suffix = ''
			rt.Name = str(int(round(d*304.8))) + '-' + rClass + suffix
			SetRebarBarTypeParameters(rt, d, dV, rClass, 0)
		return rt
		
	def UpdateRebarCoverType(self):
		dst = 0
		for rct in FilteredElementCollector(doc).OfClass(RebarCoverType).ToElements():
			if round(rct.CoverDistance*304.8) == round(dst*304.8):
				break
		else:
			rct = RebarCoverType.Create(doc, str(round(dst*304.8)), dst)
		for parName in [BuiltInParameter.CLEAR_COVER_TOP, BuiltInParameter.CLEAR_COVER_BOTTOM, BuiltInParameter.CLEAR_COVER_OTHER]:
			if not self.Elem.Parameter[parName].IsReadOnly:
				self.Elem.Parameter[parName].Set(rct.Id)	
		self.CovOth = doc.GetElement(self.Elem.Parameter[BuiltInParameter.CLEAR_COVER_OTHER].AsElementId()).CoverDistance		
	
class ColumnParameters:
	def __init__(self, column):
		self.Elem = column
		self.Id = column.Id
		self.Geom = ColumnGeometryParameters(column)
		self.Reinf = ColumnReinforcement(column)
		self.BClass = column.GetParameters('1Пп_Класс бетона')[0].AsValueString()
		if self.BClass.find('B') == -1:
			self.BClass = 'B' + self.BClass	
		self.Phase = column.Parameter[BuiltInParameter.PHASE_CREATED].AsElementId()
		self.Reinf.NX = self.GetReinfNX()
		if column.GetParameters(IN[5][9]):
			self.Section = column.GetParameters(IN[5][9])[0].AsString()
		else:
			self.Section = None
		self.Mark = column.Parameter[BuiltInParameter.ALL_MODEL_MARK].AsString()
		
	def HasBottomSlab(self):
		filter = ElementLevelFilter(self.Geom.BotLvlId)
		slabs = FilteredElementCollector(doc, List[ElementId](slabIds)).WherePasses(filter).ToElements()
#		cutLine = Line.CreateBound(self.Geom.BotCenterLine.GetEndPoint(0) - XYZ.BasisZ*10/304.8, self.Geom.BotCenterLine.GetEndPoint(1) - XYZ.BasisZ*10/304.8)
		for slab in slabs:
			sp = SlabParameters(slab)
			sups = sp.GetSlabBottomSupports(self)
			if sups:
				sp.Supports = sups
				return sp
		return None
		
	def HasUpperSlab(self, delta):
		filter = ElementLevelFilter(self.Geom.TopLvlId)
		slabs = FilteredElementCollector(doc, List[ElementId](slabIds)).OfClass(Floor).WherePasses(filter).ToElements()
#		cutLine = Line.CreateBound(self.Geom.TopCenterLine.GetEndPoint(0) + XYZ.BasisZ*10/304.8, self.Geom.TopCenterLine.GetEndPoint(1) + XYZ.BasisZ*10/304.8)
		for slab in slabs:
			sp = SlabParameters(slab)
			sups = sp.GetSlabSupports(self, delta)
			if sups:
				sp.Supports = sups
				return sp
		return None

	def HasUpperColumn(self, delta):
		filter = ElementLevelFilter(self.Geom.TopLvlId)
		columns = FilteredElementCollector(doc, List[ElementId](columnIds)).WherePasses(filter).ToElements()
		cutLine = Line.CreateBound(self.Geom.TopCenterLine.GetEndPoint(0) + XYZ.BasisZ*(300/304.8+delta), self.Geom.TopCenterLine.GetEndPoint(1) + XYZ.BasisZ*(300/304.8+delta))
		for column in columns:
			cp = ColumnParameters(column)
			spotLines = list(cp.Geom.Solid.IntersectWithCurve(cutLine, None))
			if spotLines and VecABS(cp.Geom.XDir).IsAlmostEqualTo(VecABS(self.Geom.XDir)):
				return cp
		return None
		
#	def HasUpperWall(self, delta):
#		filter = ElementLevelFilter(self.Geom.TopLvlId)
#		columns = FilteredElementCollector(doc, List[ElementId](wallIds)).WherePasses(filter).ToElements()
#		cutLine = Line.CreateBound(self.Geom.TopCenterLine.GetEndPoint(0) + XYZ.BasisZ*(300/304.8+delta), self.Geom.TopCenterLine.GetEndPoint(1) + XYZ.BasisZ*(300/304.8+delta))
#		for wall in walls:
#			wp = ColumnParameters(column)
#			spotLines = list(cp.Geom.Solid.IntersectWithCurve(cutLine, None))
#			if spotLines and VecABS(cp.Geom.XDir).IsAlmostEqualTo(VecABS(self.Geom.XDir)):
#				return cp
#		return None	
		
	def HasUpperBeam(self):
		beams = [beam for beam in FilteredElementCollector(doc, List[ElementId](beamIds)).WhereElementIsNotElementType().ToElements() if beam.Parameter[BuiltInParameter.INSTANCE_REFERENCE_LEVEL_PARAM].AsElementId().IntegerValue == self.Geom.TopLvlId.IntegerValue]
#		cutLine = Line.CreateBound(self.Geom.TopCenterLine.GetEndPoint(0) + XYZ.BasisZ*10/304.8, self.Geom.TopCenterLine.GetEndPoint(1) + XYZ.BasisZ*10/304.8)
		for beam in beams:
			bp = BeamParameters(beam)
			sups = bp.GetBeamSupports(self)
			if sups:
				bp.Supports = sups
				return bp
		return None

	def GetReinfNX(self):
		botOv = math.ceil(ComputeOverlapLength(self.Reinf.DY1, self.BClass)*304.8/10)*10/304.8
		if round(self.Reinf.StepX*304.8) != round(self.Reinf.StepX2*304.8):
			H1 = math.ceil(self.Geom.H*IN[7][3]/self.Reinf.StepX)*self.Reinf.StepX
			n3 = math.floor((self.Geom.H-2*H1) / self.Reinf.StepX2)
			if round((self.Geom.H-2*H1 - n3*self.Reinf.StepX2)*304.8) > (self.Reinf.StepX + self.Reinf.StepX2)/2:
				n3 += 1
			if round(H1*304.8) < round(botOv*304.8):
				n1 = round((H1 - IN[7][0]/304.8)/self.Reinf.StepX) + 1
				n2 = math.floor((botOv - H1)/self.Reinf.StepX2)
				n3 -= n2	
				n4 = math.floor((self.Geom.H - (IN[7][0]/304.8 + (n1-1)*self.Reinf.StepX + (n2+n3)*self.Reinf.StepX2))/self.Reinf.StepX)
			else:
				n1 = math.floor((botOv - IN[7][0]/304.8)/self.Reinf.StepX)
				n2 = round((H1-(IN[1][0]/304.8+(n1-1)*self.Reinf.StepX))/self.Reinf.StepX)
				n4 = math.floor((self.Geom.H - (IN[1][0]/304.8 + (n1+n2)*self.Reinf.StepX + n3*self.Reinf.StepX2))/self.Reinf.StepX)
		else:
			n1 = math.floor((botOv - IN[7][0]/304.8)/self.Reinf.StepX2) + 1
			n2 = math.floor((self.Geom.H - IN[7][0]/304.8 - (n1-1)*self.Reinf.StepX2)/self.Reinf.StepX2)
			n3 = 0
			n4 = 0	
		return [n1, n2, n3, n4]

CPars = [ColumnParameters(column) for column in columns if column.GetParameters('Тип армирования') and column.GetParameters('Тип армирования')[0].AsElementId()]
sortedCPars = []
sortedCPars.append([cp for cp in CPars if cp.Reinf.NY1 == 4])
sortedCPars.append([cp for cp in CPars if cp.Reinf.NY1 == 8 and round(cp.Geom.L*304.8) == round(cp.Geom.T*304.8)])
sortedCPars.append([cp for cp in CPars if cp.Reinf.NY1 == 8 and round(cp.Geom.L*304.8) != round(cp.Geom.T*304.8)])
sortedCPars.append([cp for cp in CPars if cp.Reinf.NY1 == 12 and round(cp.Geom.L*304.8) != round(cp.Geom.T*304.8)])
sortedCPars.append([cp for cp in CPars if cp.Reinf.NY1 == 12 and round(cp.Geom.L*304.8) == round(cp.Geom.T*304.8)])

OUT = sortedCPars + [CPars]
# ----------------------------------------
number = DoubleInput(0)
getItemAtIndex = List.GetItemAtIndex(list=сбор_данных, index=number)
square4CPs = Output(getItemAtIndex)  # Квадратные колонны, 4 стержня
number_2 = DoubleInput(1)
getItemAtIndex_2 = List.GetItemAtIndex(list=сбор_данных, index=number_2)
square8CPs = Output(getItemAtIndex_2)  # Квадратные колонны, 8 стержней
number_3 = DoubleInput(2)
getItemAtIndex_3 = List.GetItemAtIndex(list=сбор_данных, index=number_3)
rectangle8CPs = Output(getItemAtIndex_3)  # Прямоугольные колонны, 8 стержней
number_4 = DoubleInput(3)
getItemAtIndex_4 = List.GetItemAtIndex(list=сбор_данных, index=number_4)
rectangle12CPs = Output(getItemAtIndex_4)  # Прямоугольные колонны, 12 стержней
number_5 = DoubleInput(4)
getItemAtIndex_5 = List.GetItemAtIndex(list=сбор_данных, index=number_5)
square12CPs = Output(getItemAtIndex_5)  # Квадратные колонны, 12 стержней
number_6 = DoubleInput(5)
getItemAtIndex_6 = List.GetItemAtIndex(list=сбор_данных, index=number_6)
allCPs = Output(getItemAtIndex_6)  # Все колонны
