# Dynamo custom node ПараметрыЛиста.dyf (Dynamo 2.13.1.3887)
# category: 1П.Кэширование
# Сведения и методы, связанные с листами в активном документе

sheets = Input(sheets: var[]..[])  # Список листов
извлечение_видов_с_листов = Python(IN[0]=sheets)  # IronPython2
# ---------- извлечение_видов_с_листов.python (16 lines) ----------
import clr
clr.AddReference('RevitAPI')
from Autodesk.Revit.DB import *
clr.AddReference('RevitServices')
from RevitServices.Persistence import DocumentManager
		
doc = DocumentManager.Instance.CurrentDBDocument

sheets = UnwrapElement(IN[0])

views = []
for sheet in sheets:
	viewports = [doc.GetElement(id) for id in sheet.GetAllViewports()]
	views += [doc.GetElement(vp.ViewId) for vp in viewports]

OUT = views
# ----------------------------------------
параметрыВида = Custom[ПараметрыВида](views=извлечение_видов_с_листов)  # Сбор исходных данных, свзяанных с видами
сбор_исходных_данных_листов = Python(IN[0]=sheets, IN[1]=параметрыВида)  # IronPython2
# ---------- сбор_исходных_данных_листов.python (42 lines) ----------
import sys
import clr
import math
clr.AddReference('RevitAPI')
from Autodesk.Revit.DB import *
from Autodesk.Revit.DB.Structure import *
clr.AddReference('RevitServices')
from RevitServices.Persistence import DocumentManager

def ByMark(vp):
#	mainElement = None
#	if vp.Name.find('К-') != -1:
#		mainElement = vp.GetMainElementFromView(vp.Collectors.Columns.ToElements())			
#	elif vp.Name.find('Стм-') != -1 or vp.Name.find('Дм-') != -1:
#		mainElement = vp.GetMainElementFromView(vp.Collectors.Walls.ToElements())
	mainElement = vp.GetMainElementFromView(vp.Collectors.Union.ToElements())
	if mainElement and mainElement.Parameter[BuiltInParameter.ALL_MODEL_MARK].HasValue:	
		vp.ElemMark = mainElement.Parameter[BuiltInParameter.ALL_MODEL_MARK].AsString()	
	return vp.ElemMark
		
class SheetParameters:
	def __init__(self, sheet):
		self.Sheet = sheet
		self.Name = sheet.Name
		self.Width = sheet.Outline.Max.U - sheet.Outline.Min.U
		self.Viewports = [doc.GetElement(id) for id in sheet.GetAllViewports()]
		self.ViewPars = sorted([vp for vp in allVPars if vp.ViewportSheetName == self.Name], key=ByMark)
		self.ViewConcretePars = [vp for vp in self.ViewPars if (vp.Name.find('Опалубочные чертежи') != -1 or vp.Name.find('Опалубочный чертеж') != -1) and vp.Name.find('ечение') == -1 and vp.Name.find('горизонтальное') == -1 and vp.Name.find('Вид') == -1 and vp.Name.find('расположения') == -1 and vp.Name.find('Обрамление') == -1 and vp.Name.find('рагмент') == -1 and vp.Name.find('азрез') == -1]
		self.AI = None
		self.ElemMarksString = ', '.join([vp.ElemMark for vp in self.ViewConcretePars])
		self.SimpleRebarPars = []
		self.SheetSetName = sheet.Parameter[BuiltInParameter.SHEET_NUMBER].AsString().split('-')[0]
		self.Schedules = []
		
doc = DocumentManager.Instance.CurrentDBDocument

sheets = UnwrapElement(IN[0])
allVPars = IN[1]

SPars = [SheetParameters(sheet) for sheet in sheets]

OUT = SPars
# ----------------------------------------
SPars = Output(сбор_исходных_данных_листов)  # Список параметров листов
