# Dynamo custom node ПараметрыОсей.dyf (Dynamo 2.13.1.3887)
# category: 1П.Кэширование
# Сведения и методы, связанные со строительными осями

gridSets = Input(gridSets: var[]..[])  # Список наборов строительных осей (по списку видов)
python_script = Python(IN[0]=gridSets)  # IronPython2
# ---------- python_script.python (52 lines) ----------
import clr
clr.AddReference('System')
from System.Collections.Generic import List
clr.AddReference('RevitAPI')
from Autodesk.Revit.DB import *
clr.AddReference('RevitServices')
from RevitServices.Persistence import DocumentManager

class GridParameters:
	def __init__(self, grid):
		self.Grid = grid
		self.View = None
		self.Names = [grid.Name]
		self.Lines = [grid.Curve, None]
		self.Centers = [self.Lines[0].Evaluate(0.5, True), None]
		self.Origin = self.Lines[0].Origin
		self.Directions = [self.Lines[0].Direction, self.Lines[0].Direction.CrossProduct(XYZ.BasisZ), XYZ.BasisZ]
		self.Plane = Plane.CreateByOriginAndBasis(self.Origin, self.Directions[0], self.Directions[2])
		self.HasBubbles = [None, None]
		self.RayWhereGridHasBeenCatchedDir = None
			
	def GetNearGridPars(self):
		nearGPs = [None, None]
		collector = FilteredElementCollector(doc).OfClass(Grid)
		otherGPs = [GridParameters(grid) for grid in collector.Excluding(List[ElementId]([self.Grid.Id])).ToElements() if grid.Curve.Direction.IsAlmostEqualTo(self.Grid.Curve.Direction) or grid.Curve.Direction.IsAlmostEqualTo(-self.Grid.Curve.Direction)]
		
		planes = [gp.Plane for gp in otherGPs]
		points = [(plane.Origin + plane.XVec*plane.Project(self.Centers[0])[0].U + plane.YVec*plane.Project(self.Centers[0])[0].V) for plane in planes]
		dirs = [self.Directions[1]*token for token in [-1, 1]]
		rays = [Line.CreateBound(self.Centers[0], self.Centers[0] + 100000*dir) for dir in dirs]
		for i in range(2):
			projectPars = [round(rays[i].Project(point).Parameter, 5) for point in points]
			dsts = [dst for dst in projectPars if dst > 0]
			if dsts:
				nearGPs[i] = otherGPs[projectPars.index(min(dsts))]
				nearGPs[i].RayWhereGridHasBeenCatchedDir = rays[i].Direction.Normalize()
		return nearGPs
	
	def UpdateViewGeometrics(self, view):
		opt.View = view
		self.View = view
		self.Lines[-1] = list(self.Grid.Geometry[opt])[0]
		self.Centers[-1] = self.Lines[-1].Evaluate(0.5, True)
		self.HasBubbles = [self.Grid.IsBubbleVisibleInView(de, view) for de in [DatumEnds.End0, DatumEnds.End1]]

doc = DocumentManager.Instance.CurrentDBDocument
opt = Options()
gridSets = UnwrapElement(IN[0])

GPSets = [[GridParameters(grid) for grid in gridSet] for gridSet in gridSets]

OUT = GPSets
# ----------------------------------------
gridParameterSets = Output(python_script)
