# Dynamo custom node ПараметрыОтверстия.dyf (Dynamo 2.13.1.3887)
# category: 1П.Кэширование
# Сведения и методы, связанные с отверстиями

openings = Input(openings: var[]..[])  # Список отверстий

# group: Параметры
имя_параметра = StringInput("1П_Размер_Ширина")
имя_параметра_2 = StringInput("1П_Размер_Высота")
имя_параметра_3 = StringInput("1П_Категория проема")
имя_параметра_4 = StringInput("1П_Зона")
имя_параметра_5 = StringInput("1П_Блок")
имя_параметра_6 = StringInput("1П_Размер_Отметка расположения")
имена_параметров = List.Create(item0=имя_параметра, item1=имя_параметра_2, item2=имя_параметра_3, item3=имя_параметра_4, item4=имя_параметра_5, item5=имя_параметра_6)

фильтрацияЖБК = Custom[ФильтрацияЖБК]()  # Фильтрация железобетонных конструкций, изделий в пределах активного документа Revit
сбор_данных = Python(IN[0]=openings, IN[1]=имена_параметров, IN[2]=фильтрацияЖБК.allConcreteIds)  # IronPython2
# ---------- сбор_данных.python (84 lines) ----------
import sys
import clr
import math
import System
clr.AddReference('System')
from System.Collections.Generic import List
clr.AddReference('RevitAPI')
from Autodesk.Revit.DB import *
from Autodesk.Revit.DB.Structure import *
clr.AddReference('RevitServices')
from RevitServices.Persistence import DocumentManager
from RevitServices.Transactions import TransactionManager

doc = DocumentManager.Instance.CurrentDBDocument
	
def VecABS(vec):
	x = abs(vec.X)
	y = abs(vec.Y)
	z = abs(vec.Z)
	return XYZ(x,y,z)

openings = UnwrapElement(IN[0])

opt = Options()
opt.ComputeReferences = True

class OpeningParameters:
	def __init__(self, open):
		self.Id = open.Id
		self.Elem = open
		if open.GetParameters(IN[1][0]):
			self.B = open.GetParameters(IN[1][0])[0].AsDouble()
		else:
			self.B = None
		if open.GetParameters(IN[1][1]):
			self.H = open.GetParameters(IN[1][1])[0].AsDouble()
		else:
			self.H = None	
		self.Origin = open.Location.Point
		self.Z = self.Origin.Z
		self.XDir = open.GetTransform().BasisX
		self.ZDir = open.GetTransform().BasisZ
		self.EndPoints = [self.Origin - self.XDir*self.B/2, self.Origin + self.XDir*self.B/2]
		filter = BoundingBoxContainsPointFilter(self.Origin)
		self.Host = FilteredElementCollector(doc, List[ElementId](IN[2])).WherePasses(filter).FirstElement()
		self.Level = doc.GetElement(self.Host.LevelId)
		self.Offsets = [open.Parameter[BuiltInParameter.INSTANCE_SILL_HEIGHT_PARAM].AsDouble(), open.GetParameters(IN[1][5])[0].AsDouble()]
		self.Phase = self.Host.Parameter[BuiltInParameter.PHASE_CREATED].AsElementId()
		if open.GetParameters(IN[1][2]):
			self.Assignment = open.GetParameters(IN[1][2])[0].AsString()
		else:
			self.Assignment = None
		self.Zone = self.Host.GetParameters(IN[1][3])[0].AsString()
		self.Section = self.Host.GetParameters(IN[1][4])[0].AsString()
#		self.HostPars = wp
#		self.Solid = GeometryCreationUtilities.CreateExtrusionGeometry([CurveLoop.Create(self.GetSketch())], wp.Geom.YDir, wp.Geom.T)
		
#	def GetSketch(self):
#		p0 = self.EndPoints[0] - self.HostPars.Geom.YDir*self.HostPars.Geom.T/2
#		p1 = p0 + XYZ.BasisZ*self.H
#		p2 = self.EndPoints[1] - self.HostPars.Geom.YDir*self.HostPars.Geom.T/2 + XYZ.BasisZ*self.H
#		p3 = p2 - XYZ.BasisZ*self.H
#		lines = []
#		lines.append(Line.CreateBound(p0, p1))
#		lines.append(Line.CreateBound(p1, p2))
#		lines.append(Line.CreateBound(p2, p3))
#		lines.append(Line.CreateBound(p3, p0))
#		return lines
		
#	def GetAttachedFaces(self):
#		openFaces = [face for face in self.Solid.Faces if not VecABS(face.FaceNormal.Normalize()).IsAlmostEqualTo(VecABS(self.HostPars.Geom.YDir))]
#		attFaces = []
#		for openFace in openFaces:
#			point = openFace.Evaluate(UV(10/304.8, 10/304.8))
#			cutLine = Line.CreateBound(point, point + openFace.FaceNormal.Normalize()*10/304.8)
#			spotLines = list(self.HostPars.Geom.Solid.IntersectWithCurve(cutLine, None))
#			if not spotLines:
#				attFaces.append(openFace)
#		return attFaces
					

OPars = [OpeningParameters(open) for open in openings]

OUT = OPars
# ----------------------------------------
OPars = Output(сбор_данных)  # Список параметров отверстий
