# Dynamo custom node ПараметрыСтены.dyf (Dynamo 3.3.0.6316)
# category: 1П.Кэширование
# Сведения и методы, связанные с несущими стенами

активныйВид = Custom[АктивныйВид]()  # Активный вид активного документа
walls = Input(walls: var[]..[])  # Список стен
фильтрацияЖБК = Custom[ФильтрацияЖБК]()

# group: Вводные для сбора данных
имя_параметра = StringInput("Рзм.Длина")
имя_параметра_2 = StringInput("Рзм.Ширина")
имя_параметра_3 = StringInput("1П_Размер_Высота")
имя_параметра_4 = StringInput("1П_Размер_Ширина")
имя_параметра_5 = StringInput("1П_Размер_В погонных метрах")
имя_параметра_6 = StringInput("1П_Арм_Класс")
имя_параметра_7 = StringInput("1П_Обозначение")
имя_параметра_8 = StringInput("1П_Наименование")
имя_параметра_9 = StringInput("1П_Арм_Семейство")
имя_параметра_10 = StringInput("1П_Зона")
имя_параметра_11 = StringInput("1П_Блок")
имена_параметров = List.Create(item0=имя_параметра, item1=имя_параметра_2, item2=имя_параметра_3, item3=имя_параметра_4, item4=имя_параметра_5, item5=имя_параметра_6, item6=имя_параметра_7, item7=имя_параметра_8, item8=имя_параметра_9, item9=имя_параметра_10, item10=имя_параметра_11)

join = List.Join(list0=фильтрацияЖБК.structuralColumnIds, list1=фильтрацияЖБК.wallIds)
имя_трехмерного_вида = StringInput("3D_Общий_Опалубка")
пересекатель = Custom[Пересекатель](elemIds=join, view3DName=имя_трехмерного_вида)
точность_ловли_бетона = DoubleSlider(30, range=5..70 step 5)

# group: Уровни
сортировка_уровней = Python()  # IronPython2
# ---------- сортировка_уровней.python (21 lines) ----------
import sys
import clr
import System
clr.AddReference('System')
from System.Collections.Generic import List
clr.AddReference('RevitAPI')
from Autodesk.Revit.DB import *
from Autodesk.Revit.DB.Structure import *
clr.AddReference('RevitServices')
from RevitServices.Persistence import DocumentManager
from RevitServices.Transactions import TransactionManager

doc = DocumentManager.Instance.CurrentDBDocument

def ByElevation(lvl):
	return round(lvl.Elevation*304.8)
	
lvls = sorted(FilteredElementCollector(doc).OfClass(Level).ToElements(), key=ByElevation)
lvlIds = [lvl.Id.IntegerValue for lvl in lvls]

OUT = lvlIds
# ----------------------------------------
firstItem = List.FirstItem(list=сортировка_уровней)
количество_срезаемых_элементов = IntegerSlider(0, range=-30..30 step 1)
срез_списка = List.DropItems(list=firstItem, amount=количество_срезаемых_элементов)

сбор_данных = Python(IN[0]=активныйВид, IN[1]=walls, IN[2]=фильтрацияЖБК.structuralColumnIds, IN[3]=фильтрацияЖБК.wallIds, IN[4]=фильтрацияЖБК.floorIds, IN[5]=имена_параметров, IN[6]=пересекатель, IN[7]=точность_ловли_бетона, IN[8]=срез_списка)  # IronPython2
# ---------- сбор_данных.python (1023 lines) ----------
import sys
import clr
import math
import System
clr.AddReference('System')
from System.Collections.Generic import List
clr.AddReference('RevitAPI')
from Autodesk.Revit.DB import *
from Autodesk.Revit.DB.Structure import *
clr.AddReference('RevitServices')
from RevitServices.Persistence import DocumentManager
from RevitServices.Transactions import TransactionManager

doc = DocumentManager.Instance.CurrentDBDocument
basePoint = FilteredElementCollector(doc).OfCategory(BuiltInCategory.OST_ProjectBasePoint).FirstElement()
	
def VecABS(vec):
	x = abs(vec.X)
	y = abs(vec.Y)
	z = abs(vec.Z)
	return XYZ(x,y,z)

def SortGeomByZ(geom):
	return geom.Origin.Z
	
def SortPointsByCoords(p0, p1):
	conditions = []
	conditions.append(round(p0.X*304.8) <= round(p1.X*304.8))
	conditions.append(round(p0.Y*304.8) <= round(p1.Y*304.8))
	conditions.append(round(p0.Z*304.8) <= round(p1.Z*304.8))
#	return conditions
	if conditions[0] and conditions[1] and conditions[2]:
		return [p0, p1]
	else:
		return [p1, p0]
		
def SortByElevation(id):
	return round(doc.GetElement(ElementId(id)).Elevation)*304.8
	
def ComputeBendDiameter(d, rClass):
	if rClass == 'А240':
		if round(d*304.8) < 20:
			db = 2.5*d
		else:
			db = 4*d
	else:
		if round(d*304.8) < 20:
			db = 5*d
		else:
			db = 8*d
	return db
	
def SetRebarBarTypeParameters(rt, d1, d2, rClass, im):
	rt.GetParameters(IN[5][4])[0].Set(im)
	rt.GetParameters(IN[5][5])[0].Set(int(rClass.split('А')[-1].split('С')[0]))
	rt.GetParameters(IN[5][6])[0].Set('ГОСТ 34028-2016')
	rt.GetParameters(IN[5][7])[0].Set(rClass)
	rt.GetParameters(IN[5][8])[0].Set(0)
	if rClass == 'А240':
		rt.Parameter[BuiltInParameter.REBAR_BAR_DEFORMATION_TYPE].Set(1)
	else:
		rt.Parameter[BuiltInParameter.REBAR_BAR_DEFORMATION_TYPE].Set(0)
	rt.Parameter[BuiltInParameter.REBAR_MODEL_BAR_DIAMETER].Set(d1)
	rt.Parameter[BuiltInParameter.REBAR_BAR_DIAMETER].Set(d1)
	if d2 > 0:
		db = d2
	else:
		db = ComputeBendDiameter(d1, rClass)
	rt.Parameter[BuiltInParameter.REBAR_STANDARD_BEND_DIAMETER].Set(db)
	rt.Parameter[BuiltInParameter.REBAR_BAR_STIRRUP_BEND_DIAMETER].Set(db)
	rt.Parameter[BuiltInParameter.REBAR_STANDARD_HOOK_BEND_DIAMETER].Set(db)
	materials = [mat for mat in FilteredElementCollector(doc).OfClass(Material).ToElements() if mat.Name.find('Арматура D') == 0 and int(mat.Name.split('D')[-1]) == int(round(d1*304.8))]
	if materials:
		rt.Parameter[BuiltInParameter.MATERIAL_ID_PARAM].Set(materials[0].Id)
	subCats = [sc for sc in Category.GetCategory(doc, BuiltInCategory.OST_Rebar).SubCategories if sc.Name == 'D'+str(int(round(d1*304.8)))]
	if subCats:
		rt.Parameter[BuiltInParameter.REBAR_BAR_STYLE].Set(subCats[0].Id)
		
def GetUnboundFaces(faces):
	return [Plane.CreateByNormalAndOrigin(face.FaceNormal, face.Origin) for face in faces]

view = UnwrapElement(IN[0])
walls = UnwrapElement(IN[1])
columnIds = UnwrapElement(IN[2])
wallIds = UnwrapElement(IN[3])
slabIds = UnwrapElement(IN[4])
intersector = UnwrapElement(IN[6])

opt = Options()
opt.ComputeReferences = True

class ElemFaces:
	def __init__(self, geom):
		faces = geom.Solid.Faces
		xDir = VecABS(geom.XDir)
		yDir = VecABS(geom.YDir)
		self.Top = [face for face in faces if face.FaceNormal.Normalize().IsAlmostEqualTo(XYZ.BasisZ)]
		self.Bottom = [face for face in faces if face.FaceNormal.Normalize().IsAlmostEqualTo(-XYZ.BasisZ)]
		self.Short = [face for face in faces if VecABS(face.FaceNormal.Normalize()).IsAlmostEqualTo(xDir)]
		self.Long = [face for face in faces if VecABS(face.FaceNormal.Normalize()).IsAlmostEqualTo(yDir)]

class OpeningParameters:
	def __init__(self, wp, open):
		self.Id = open.Id
		self.Elem = open
		if open.GetParameters(IN[5][3]):
			self.B = open.GetParameters(IN[5][3])[0].AsDouble()
		else:
			self.B = None
		if open.GetParameters(IN[5][2]):
			self.H = open.GetParameters(IN[5][2])[0].AsDouble()
		else:
			self.H = None	
		self.Origin = open.Location.Point
		self.Z = self.Origin.Z
		self.XDir = open.GetTransform().BasisX
		self.ZDir = open.GetTransform().BasisZ
		self.EndPoints = [self.Origin - self.XDir*self.B/2, self.Origin + self.XDir*self.B/2]
		self.Host = wp.Elem
		self.HostPars = wp
		self.Solid = GeometryCreationUtilities.CreateExtrusionGeometry([CurveLoop.Create(self.GetSketch())], wp.Geom.YDir, wp.Geom.T)
		
	def GetSketch(self):
		p0 = self.EndPoints[0] - self.HostPars.Geom.YDir*self.HostPars.Geom.T/2
		p1 = p0 + XYZ.BasisZ*self.H
		p2 = self.EndPoints[1] - self.HostPars.Geom.YDir*self.HostPars.Geom.T/2 + XYZ.BasisZ*self.H
		p3 = p2 - XYZ.BasisZ*self.H
		lines = []
		lines.append(Line.CreateBound(p0, p1))
		lines.append(Line.CreateBound(p1, p2))
		lines.append(Line.CreateBound(p2, p3))
		lines.append(Line.CreateBound(p3, p0))
		return lines
		
	def GetAttachedFaces(self):
		openFaces = [face for face in self.Solid.Faces if not VecABS(face.FaceNormal.Normalize()).IsAlmostEqualTo(VecABS(self.HostPars.Geom.YDir))]
		attFaces = []
		for openFace in openFaces:
			point = openFace.Evaluate(UV(10/304.8, 10/304.8))
			cutLine = Line.CreateBound(point, point + openFace.FaceNormal.Normalize()*10/304.8)
			spotLines = list(self.HostPars.Geom.Solid.IntersectWithCurve(cutLine, None))
			if not spotLines:
				attFaces.append(openFace)
		return attFaces
					
class VoidParameters:
	def __init__(self, wp, void):
		self.Id = void.Id
		self.Elem = void
		self.H = void.Symbol.Parameter[BuiltInParameter.DOOR_HEIGHT].AsDouble()
		self.B = void.Symbol.Parameter[BuiltInParameter.FURNITURE_WIDTH].AsDouble()	
		self.Origin = void.Location.Point
		self.Z = self.Origin.Z
		self.XDir = void.GetTransform().BasisX
		self.ZDir = void.GetTransform().BasisZ
		self.EndPoints = [self.Origin - self.XDir*self.B/2, self.Origin + self.XDir*self.B/2]
		self.ZPoints = [self.Origin, self.Origin + XYZ.BasisZ*self.H]
		self.Host = wp.Elem
		self.HostPars = wp
		self.Solid = GeometryCreationUtilities.CreateExtrusionGeometry([CurveLoop.Create(self.GetSketch())], -wp.Geom.YDir, wp.Geom.T)
		self.BotCenterLine = Line.CreateBound(self.EndPoints[0], self.EndPoints[1])		
		
	def GetSketch(self):
		p0 = self.EndPoints[0] + self.HostPars.Geom.YDir*self.HostPars.Geom.T/2
		p1 = p0 + XYZ.BasisZ*self.H
		p2 = self.EndPoints[1] + self.HostPars.Geom.YDir*self.HostPars.Geom.T/2 + XYZ.BasisZ*self.H
		p3 = p2 - XYZ.BasisZ*self.H
		lines = []
		lines.append(Line.CreateBound(p0, p1))
		lines.append(Line.CreateBound(p1, p2))
		lines.append(Line.CreateBound(p2, p3))
		lines.append(Line.CreateBound(p3, p0))
		return lines

	def GetAttachedFaces(self):
		openFaces = [face for face in self.Solid.Faces if not VecABS(face.FaceNormal.Normalize()).IsAlmostEqualTo(VecABS(self.HostPars.Geom.YDir))]
		attFaces = []
		for openFace in openFaces:
			center = openFace.Evaluate(UV(10/304.8, 10/304.8))
			cutLine = Line.CreateBound(center, center + openFace.FaceNormal.Normalize()*10/304.8)
			spotLines = list(self.HostPars.Geom.Solid.IntersectWithCurve(cutLine, None))
			if not spotLines:
				attFaces.append(openFace)
		return attFaces
		
	def GetBoundFaces(self):
		openFaces = [face for face in self.Solid.Faces if not VecABS(face.FaceNormal.Normalize()).IsAlmostEqualTo(VecABS(self.HostPars.Geom.YDir))]
		hostFaces = [face for face in self.HostPars.Geom.Solid.Faces if not VecABS(face.FaceNormal.Normalize()).IsAlmostEqualTo(VecABS(self.HostPars.Geom.YDir))]
		boundFaces = []
		for openFace in openFaces:
			center = openFace.Evaluate(UV(10/304.8, 10/304.8))
			cutLine = Line.CreateBound(center, center + openFace.FaceNormal.Normalize()*10/304.8)
			for hostFace in hostFaces:
				project = hostFace.Project(center)
				if project and MathComparisonUtils.IsAlmostZero(project.Distance):
					boundFaces.append(hostFace)
					break
			else:
				boundFaces.append(None)
		return boundFaces		
		
	def HasUpperEqualVoid(self):
		ends = [None, None]
		upperWPs = self.HostPars.HasUpperWalls()
		for upWP in upperWPs:
			vps = upWP.Voids
			for vp in vps:
				for i in range(2):
					line = Line.CreateBound(self.EndPoints[i], vp.EndPoints[i])
					if line.Direction.Normalize().IsAlmostEqualTo(XYZ.BasisZ):
						ends[i] = vp
		return ends
		
	def GetRegionSolid(self):
		cutLine = Line.CreateBound(self.Origin + XYZ.BasisZ*10/304.8 - self.XDir*(self.B/2+10/304.8), self.Origin + XYZ.BasisZ*10/304.8 + self.XDir*(self.B/2*10/304.8))
		for region in self.HostPars.Regions:
			solid = region.GetRegionSolid() 
			spotLines = list(solid.IntersectWithCurve(cutLine, None))
			if spotLines:
				return solid
		else:
#			return [r.GetRegionSolid() for r in self.HostPars.Regions]
			return None

class SlabGeometry:
	def __init__(self, sp):
		slab = sp.Elem
		self.SpanAngle = slab.SpanDirectionAngle
		transform = Transform.CreateRotation(XYZ.BasisZ, self.SpanAngle)
		self.XDir = transform.BasisX
		self.YDir = transform.BasisY
		self.Solid = [geom for geom in list(slab.Geometry[opt]) if geom.GetType() == Solid and geom.Volume > 0][0]
		self.Faces = ElemFaces(self)
		
class SlabParameters:
	def __init__(self, slab):
		self.Elem = slab
		self.Id = slab.Id
		self.T = slab.Parameter[BuiltInParameter.FLOOR_ATTR_THICKNESS_PARAM].AsDouble()
		self.SpanAngle = slab.SpanDirectionAngle
		self.LvlId = slab.LevelId
		self.Solid = [geom for geom in list(slab.Geometry[opt]) if geom.GetType() == Solid and geom.Volume > 0][0]
		
		self.Geom = SlabGeometry(self)
		
		self.Supports = None
		bClassPar = slab.GetParameters('1Пп_Класс бетона')[0]
		if bClassPar.StorageType == StorageType.Double:
			self.BClass = 'B' + str(int(round(bClassPar.AsDouble())))
		else:
			self.BClass = slab.GetParameters('1Пп_Класс бетона')[0].AsString()
		self.TopCovDst = 0
		self.BotCovDst = 0
		self.OthCovDst = 0
		if slab.Parameter[BuiltInParameter.FLOOR_PARAM_IS_STRUCTURAL].AsInteger() == 1:
			if doc.GetElement(slab.Parameter[BuiltInParameter.CLEAR_COVER_TOP].AsElementId()):
				self.TopCovDst = doc.GetElement(slab.Parameter[BuiltInParameter.CLEAR_COVER_TOP].AsElementId()).CoverDistance
			if doc.GetElement(slab.Parameter[BuiltInParameter.CLEAR_COVER_BOTTOM].AsElementId()):
				self.BotCovDst = doc.GetElement(slab.Parameter[BuiltInParameter.CLEAR_COVER_BOTTOM].AsElementId()).CoverDistance
			if doc.GetElement(slab.Parameter[BuiltInParameter.CLEAR_COVER_OTHER].AsElementId()):
				self.OthCovDst = doc.GetElement(slab.Parameter[BuiltInParameter.CLEAR_COVER_OTHER].AsElementId()).CoverDistance
				
		if round(self.SpanAngle*100)/100 == 0 or round(self.SpanAngle*100)/100 == round(3.14*100)/100:
			self.DMainTOP = slab.GetParameters('1Пп_Арм_X_Верх_Диаметр')[0].AsDouble()
			self.DMainBOT = slab.GetParameters('1Пп_Арм_X_Низ_Диаметр')[0].AsDouble()
			self.DSecTOP = slab.GetParameters('1Пп_Арм_Y_Верх_Диаметр')[0].AsDouble()
			self.DSecBOT = slab.GetParameters('1Пп_Арм_Y_Низ_Диаметр')[0].AsDouble()
		else:
			self.DMainTOP = slab.GetParameters('1Пп_Арм_Y_Верх_Диаметр')[0].AsDouble()
			self.DMainBOT = slab.GetParameters('1Пп_Арм_Y_Низ_Диаметр')[0].AsDouble()
			self.DSecTOP = slab.GetParameters('1Пп_Арм_X_Верх_Диаметр')[0].AsDouble()
			self.DSecBOT = slab.GetParameters('1Пп_Арм_X_Низ_Диаметр')[0].AsDouble()
		self.Phase = slab.Parameter[BuiltInParameter.PHASE_CREATED].AsElementId()
		self.Workset = slab.Parameter[BuiltInParameter.ELEM_PARTITION_PARAM].AsInteger()
		if slab.GetParameters(IN[5][9]):
			self.Zone = slab.GetParameters(IN[5][9])[0].AsString()
		else:
			self.Zone = None
		if slab.GetParameters(IN[5][10]):
			self.Section = slab.GetParameters(IN[5][10])[0].AsString()
		else:
			self.Section = None	
		
		
	def GetSlabBottomSupports(self, wp):
		cutLine = Line.CreateBound(wp.Geom.BotCenterLine.GetEndPoint(0) - XYZ.BasisZ*10/304.8, wp.Geom.BotCenterLine.GetEndPoint(1) - XYZ.BasisZ*10/304.8)
		solid = self.Solid
		spotLines = list(solid.IntersectWithCurve(cutLine, None))
		slabSupports = []
		for spotLine in spotLines:
			p0 = spotLine.GetEndPoint(0) + XYZ.BasisZ*10/304.8
			p1 = spotLine.GetEndPoint(1) + XYZ.BasisZ*10/304.8
			slabSupports.append(Line.CreateBound(p0, p1))
		return slabSupports
		
	def GetSlabSupports(self, wp):
		cutLine = Line.CreateBound(wp.Geom.TopCenterLine.GetEndPoint(0) + XYZ.BasisZ*10/304.8, wp.Geom.TopCenterLine.GetEndPoint(1) + XYZ.BasisZ*10/304.8)
		solid = self.Solid
		spotLines = list(solid.IntersectWithCurve(cutLine, None))
		slabSupports = []
		for spotLine in spotLines:
			p0 = spotLine.GetEndPoint(0) - XYZ.BasisZ*10/304.8
			p1 = spotLine.GetEndPoint(1) - XYZ.BasisZ*10/304.8
			slabSupports.append(Line.CreateBound(p0, p1))
		return slabSupports

class ColumnGeometryParameters:
	def __init__(self, column):
		self.L = column.Symbol.GetParameters(IN[5][0])[0].AsDouble()
		self.T = column.Symbol.GetParameters(IN[5][1])[0].AsDouble()
		self.H = column.GetParameters(IN[5][2])[0].AsDouble()
		self.LvlId = column.LevelId
		self.BotOffset = column.Parameter[BuiltInParameter.FAMILY_BASE_LEVEL_OFFSET_PARAM].AsDouble()
		self.BotZ = doc.GetElement(self.LvlId).Elevation + self.BotOffset
		self.BotOrigin = column.Location.Point + XYZ.BasisZ*(self.BotZ + basePoint.Position.Z)
		self.XDir = column.GetTransform().BasisX
		self.YDir = column.GetTransform().BasisY
		self.EndPoints = [self.BotOrigin - self.XDir*self.L/2, self.BotOrigin + self.XDir*self.L/2]
		self.EndPoints2 = [self.BotOrigin - self.YDir*self.T/2, self.BotOrigin + self.YDir*self.T/2]
		self.BotCenterLine = Line.CreateBound(self.EndPoints[0], self.EndPoints[1])
		self.Solid = [geom for geom in list(column.Geometry[opt]) if geom.GetType() == Solid and geom.Volume > 0][0]
		self.Faces = ElemFaces(self)
		
class ColumnReinforcement:
	def __init__(self, column):
		self.Type = 'Column'
		self.Elem = column
		self.DX = column.GetParameters('1Пп_Арм_Хомуты_Диаметр')[0].AsDouble()
		self.DY1 = column.GetParameters('1Пп_Арм_Вертикальная_Диаметр 1')[0].AsDouble()
		self.DY3 = column.GetParameters('1Пп_Арм_Вертикальная_Диаметр 1')[0].AsDouble()
		self.StepX = column.GetParameters('1Пп_Арм_Хомуты_Шаг пролетный')[0].AsDouble()
		covOth = doc.GetElement(column.Parameter[BuiltInParameter.CLEAR_COVER_OTHER].AsElementId())
		if covOth:
			self.CovOth = covOth.CoverDistance
		else:
			self.CovOth = None
				
	def GetRebarTypes(self):	
		self.RebarTypeDX = self.GetRebarType(self.DX, 'А240', self.DY1)
		self.RebarTypeDY1 = self.GetRebarType(self.DY1, 'А500С', 0)
		self.RebarTypeDY3 = self.GetRebarType(self.DY3, 'А500С', 0)
		self.RebarTypeDBinder = self.RebarTypeDX
		
	def GetRebarType(self, d, rClass, dV):
		for rt in FilteredElementCollector(doc).OfClass(RebarBarType).ToElements():
			name = rt.Parameter[BuiltInParameter.SYMBOL_NAME_PARAM].AsString()
			diameter = round(rt.Parameter[BuiltInParameter.REBAR_BAR_DIAMETER].AsDouble()*304.8)
			inMeteres = rt.get_Parameter(System.Guid('844a01e2-19fc-4dc5-baa0-a4bda30ef1f6')).AsInteger()
			if name.find(rClass) != -1 and diameter == round(d*304.8) and inMeteres == 0 and (dV == 0 or name.find(str(int(round(dV*304.8)))) != -1):
				break
		else:
			rt = RebarBarType.Create(doc)
			if dV > 0:
				suffix = '_' + str(int(round(dV*304.8)))
			else:
				suffix = ''
			rt.Name = str(int(round(d*304.8))) + '-' + rClass + suffix
			SetRebarBarTypeParameters(rt, d, dV, rClass, 0)
		return rt
		
	def UpdateRebarCoverType(self, align):
		dst = align - self.DY1/2 - self.DX
		for rct in FilteredElementCollector(doc).OfClass(RebarCoverType).ToElements():
			if round(rct.CoverDistance*304.8) == round(dst*304.8):
				break
		else:
			rct = RebarCoverType.Create(doc, str(round(dst*304.8)), dst)
		if not self.Elem.Parameter[BuiltInParameter.CLEAR_COVER_OTHER].IsReadOnly:	
			self.Elem.Parameter[BuiltInParameter.CLEAR_COVER_OTHER].Set(rct.Id)
			self.CovOth = doc.GetElement(self.Elem.Parameter[BuiltInParameter.CLEAR_COVER_OTHER].AsElementId()).CoverDistance	
	
class ColumnParameters:
	def __init__(self, column):
		self.Elem = column
		self.Id = column.Id
		self.Geom = ColumnGeometryParameters(column)
		self.Reinf = ColumnReinforcement(column)
		bClassPar = wall.GetParameters('1Пп_Класс бетона')[0]
		if bClassPar.StorageType == StorageType.Double:
			self.BClass = 'B' + str(int(round(bClassPar.AsDouble())))
		else:
			self.BClass = wall.GetParameters('1Пп_Класс бетона')[0].AsString()
		if column.GetParameters(IN[5][9]):
			self.Zone = column.GetParameters(IN[5][9])[0].AsString()
		else:
			self.Zone = None
		if column.GetParameters(IN[5][10]):
			self.Section = column.GetParameters(IN[5][10])[0].AsString()
		else:
			self.Section = None	
			
class WallEnd:
	def __init__(self, elp):
		self.Type = 'End'
		self.HostPars = elp
		self.T = elp.Geom.T
		self.Origin = None
		self.XDir = None
		self.Region = None
		
	def HasUpperElement(self):
		filters = []
		filters.append(LogicalOrFilter(ElementLevelFilter(self.HostPars.Geom.TopLvlId), ElementLevelFilter(self.HostPars.Geom.BotLvlId)))
		catchPoint = self.Origin + self.XDir*10/304.8 + XYZ.BasisZ*(self.HostPars.Geom.H + 300/304.8)
		filters.append(BoundingBoxContainsPointFilter(catchPoint))
		comFilter = LogicalAndFilter(filters)
		elemIds = list(wallIds) + list(columnIds)
		elem = FilteredElementCollector(doc, List[ElementId](elemIds)).WherePasses(comFilter).FirstElement()
		if elem:		
			if elem.GetType() == FamilyInstance:
				elp = ColumnParameters(elem)
			else:
				elp = WallParameters(elem)
			return elp
		return None
		
	def HasUpperSlab(self):
		filters = []
		filters.append(ElementLevelFilter(self.HostPars.Geom.TopLvlId))
		catchPoint = self.Origin + self.XDir*10/304.8 + XYZ.BasisZ*(self.HostPars.Geom.H + 10/304.8)
		filters.append(BoundingBoxContainsPointFilter(catchPoint))
		comFilter = LogicalAndFilter(filters)
		slab = FilteredElementCollector(doc, List[ElementId](slabIds)).OfClass(Floor).WherePasses(comFilter).FirstElement()
		if slab:
			sp = SlabParameters(slab)
			return sp
		return None

	def GetSolid(self):
		tokens = [[0, -1], [1, -1], [1, 1], [0, 1]]
		points = []
		dir1 = self.XDir
		dir2 = self.HostPars.Geom.YDir 
		for i in range(4):
			point = self.Origin + dir1*self.T*tokens[i][0] + dir2*(self.T/2)*tokens[i][1]
			points.append(point)
		lines = []
		lines.append(Line.CreateBound(points[0], points[1]))
		lines.append(Line.CreateBound(points[1], points[2]))
		lines.append(Line.CreateBound(points[2], points[3]))
		lines.append(Line.CreateBound(points[3], points[0]))
		solid = GeometryCreationUtilities.CreateExtrusionGeometry([CurveLoop.Create(lines)], XYZ.BasisZ, self.HostPars.Geom.H)
		return solid
		
	def GetOutline(self):
		p0 = self.Origin - VecABS(self.XDir)*self.T - VecABS(self.HostPars.Geom.YDir)*self.T/2
		p1 = self.Origin + VecABS(self.XDir)*self.T + VecABS(self.HostPars.Geom.YDir)*self.T/2 + XYZ.BasisZ*self.HostPars.Geom.H
		outline = Outline(p0, p1)
		return outline

class WallIntersection:
	def __init__(self, aelps, elp):
		self.Type = 'Intersection'
		self.HostPars = elp
		self.AttachedElemsPars = aelps
		self.T = []
		for aelp in aelps:
			if VecABS(aelp.Geom.YDir).IsAlmostEqualTo(VecABS(elp.Geom.XDir)) or aelp.Elem.GetType() == Wall:
				self.T.append(aelp.Geom.T)
			else:
				self.T.append(aelp.Geom.L)
		self.L = [aelp.Geom.L for aelp in aelps if aelp.Elem.GetType() == FamilyInstance]
		self.Origin = None
		self.PlaceRebars = False
		
	def HasUpperElement(self):
		filters = []
		filters.append(LogicalOrFilter(ElementLevelFilter(self.HostPars.Geom.TopLvlId), ElementLevelFilter(self.HostPars.Geom.BotLvlId)))
		catchPoint = self.Origin + XYZ.BasisZ*(self.HostPars.Geom.H + 300/304.8)
		filters.append(BoundingBoxContainsPointFilter(catchPoint))
		comFilter = LogicalAndFilter(filters)
		elemIds = list(wallIds) + list(columnIds)
		elem = FilteredElementCollector(doc, List[ElementId](elemIds)).WherePasses(comFilter).FirstElement()
		if elem:		
			if elem.GetType() == FamilyInstance:
				self.PlaceRebars = False
				elp = ColumnParameters(elem)
			else:
				elp = WallParameters(elem)
			return elp
		return None
		
	def HasUpperSlab(self):
		filters = []
		filters.append(ElementLevelFilter(self.HostPars.Geom.TopLvlId))
		catchPoint = self.Origin + XYZ.BasisZ*(self.HostPars.Geom.H + 10/304.8)
		filters.append(BoundingBoxContainsPointFilter(catchPoint))
		comFilter = LogicalAndFilter(filters)
		slab = FilteredElementCollector(doc, List[ElementId](slabIds)).OfClass(Floor).WherePasses(comFilter).FirstElement()
		if slab:
			sp = SlabParameters(slab)
			return sp
		return None
		
	def GetSolid(self):
		tokens = [[-1,-1], [-1, 1], [1, 1], [1, -1]]
		points = []
		dir1 = self.HostPars.Geom.XDir
		dir21 = self.AttachedElemsPars[0].Geom.XDir
		dir22 = self.AttachedElemsPars[0].Geom.YDir
		if VecABS(dir1).IsAlmostEqualTo(VecABS(dir21)):
			dir2 = dir22
			side = self.L[0]
		else:
			dir2 = dir21
			side = self.T[0]
		for i in range(4):
			point = self.Origin + dir1*side/2*tokens[i][0] + dir2*(self.HostPars.Geom.T/2)*tokens[i][1]
			points.append(point)
		lines = []
		lines.append(Line.CreateBound(points[0], points[1]))
		lines.append(Line.CreateBound(points[1], points[2]))
		lines.append(Line.CreateBound(points[2], points[3]))
		lines.append(Line.CreateBound(points[3], points[0]))
		solid = GeometryCreationUtilities.CreateExtrusionGeometry([CurveLoop.Create(lines)], XYZ.BasisZ, self.HostPars.Geom.H)
		return solid
		
	def GetOutline(self):
		dir1 = self.HostPars.Geom.XDir
		dir21 = self.AttachedElemsPars[0].Geom.XDir
		dir22 = self.AttachedElemsPars[0].Geom.YDir
		if VecABS(dir1).IsAlmostEqualTo(VecABS(dir21)):
			dir2 = dir22
			side = self.L[0]
		else:
			dir2 = dir21
			side = self.T[0]
		p0 = self.Origin - VecABS(dir1)*side/2 - VecABS(dir2)*self.HostPars.Geom.T/2
		p1 = self.Origin + VecABS(dir1)*side/2 + VecABS(dir2)*self.HostPars.Geom.T/2 + XYZ.BasisZ*self.HostPars.Geom.H
		outline = Outline(p0, p1)
		return outline
				
class WallGeometryParameters:
	def __init__(self, wall):
		self.T = wall.Width
		self.H = wall.Parameter[BuiltInParameter.WALL_USER_HEIGHT_PARAM].AsDouble()		
		self.BotOffset = wall.Parameter[BuiltInParameter.WALL_BASE_OFFSET].AsDouble()
		self.BotLvlId = wall.Parameter[BuiltInParameter.WALL_BASE_CONSTRAINT].AsElementId()
		self.BotZ = doc.GetElement(self.BotLvlId).Elevation + (self.BotOffset)
		self.TopOffset = wall.Parameter[BuiltInParameter.WALL_TOP_OFFSET].AsDouble()
		self.TopLvlId = wall.Parameter[BuiltInParameter.WALL_HEIGHT_TYPE].AsElementId()
		self.TopZ = self.BotZ + self.H
		self.EndPoints = [wall.Location.Curve.GetEndPoint(0) + XYZ.BasisZ*(self.BotOffset), wall.Location.Curve.GetEndPoint(1) + XYZ.BasisZ*(self.BotOffset)]
		self.BotCenterLine = Line.CreateBound(self.EndPoints[0], self.EndPoints[1])
		self.TopCenterLine = Line.CreateBound(self.EndPoints[0] + XYZ.BasisZ*self.H, self.EndPoints[1] + XYZ.BasisZ*self.H)
		self.MiddleOrigin = self.BotCenterLine.Evaluate(0.5, True) + XYZ.BasisZ*self.H/2
		self.L = self.BotCenterLine.Length	
		self.XDir = wall.Location.Curve.Direction.Normalize()
		self.YDir = wall.Orientation.Normalize()		
		self.Solid = [geom for geom in list(wall.Geometry[opt]) if geom.GetType() == Solid and geom.Volume > 0][0]
		self.Faces = ElemFaces(self)
		self.CenterPlane = Plane.CreateByNormalAndOrigin(self.YDir, self.EndPoints[0])
		self.BottomPlane = Plane.CreateByNormalAndOrigin(XYZ.BasisZ, self.EndPoints[0])
		self.CuttingSolids = None
		
	def GetStartSolid(self):
		p0 = self.EndPoints[0] - self.YDir*self.T/2
		p1 = p0 + XYZ.BasisZ*self.H
		p3 = self.EndPoints[1] - self.YDir*self.T/2
		p2 = p3 + XYZ.BasisZ*self.H
		lines = []
		lines.append(Line.CreateBound(p0, p1))
		lines.append(Line.CreateBound(p1, p2))
		lines.append(Line.CreateBound(p2, p3))
		lines.append(Line.CreateBound(p3, p0))
		solid = GeometryCreationUtilities.CreateExtrusionGeometry([CurveLoop.Create(lines)], self.YDir, self.T)
		return solid
		
	def GetCuttingSolids(self):
		startSolid = self.GetBBoxSolid()
		bruttoSolid = self.GetBruttoSolid()
		solid = BooleanOperationsUtils.ExecuteBooleanOperation(startSolid, bruttoSolid, BooleanOperationsType.Difference)
		solids = SolidUtils.SplitVolumes(solid)
		return [bruttoSolid]
		
	def GetParity(self):
		rayOrigins = []
		rayOrigins.append(self.EndPoints[0] + self.XDir*10/304.8)
		rayOrigins.append(self.BotCenterLine.ComputeDerivatives(0.5, True).Origin)
		rayOrigins.append(self.EndPoints[1] + self.XDir*10/304.8)
		rayOrigins.append(self.TopCenterLine.GetEndPoint(0) + self.XDir*10/304.8)
		rayOrigins.append(self.TopCenterLine.ComputeDerivatives(0.5, True).Origin)
		rayOrigins.append(self.TopCenterLine.GetEndPoint(1) + self.XDir*10/304.8)
#		rayOrigins.append(self.EndPoints[0] + self.XDir*10/304.8 - XYZ.BasisZ*(self.BotZ + 50000/304.8))
#		rayOrigins.append(self.BotCenterLine.ComputeDerivatives(0.5, True).Origin - XYZ.BasisZ*(self.BotZ + 50000/304.8))
#		rayOrigins.append(self.EndPoints[1] + self.XDir*10/304.8 - XYZ.BasisZ*(self.BotZ + 50000/304.8))

		maxN = 0
		maxI = 0
		wallBranches = []
		for i, origin in enumerate(rayOrigins):
			wallBranches.append([])
			wallBranches[-1] += intersector.Find(origin, -XYZ.BasisZ)  
			wallBranches[-1] += intersector.Find(origin, XYZ.BasisZ)
			if maxN < len(wallBranches[-1]):
				maxN = len(wallBranches[-1])
				maxI = i
		wallBranch = wallBranches[maxI]
		levels = [doc.GetElement(doc.GetElement(rwc.GetReference()).LevelId) for rwc in wallBranch]
		lvlIds = sorted(list(set([lvl.Id.IntegerValue for lvl in levels])), key=SortByElevation)
		i = -1 + (lvlIds.index(self.BotLvlId.IntegerValue) % 2)*2
		return i
		
class WallAnchor:
	def __init__(self, rebar, wp):
		self.Reb = rebar
		line = rebar.GetCenterlineCurves(False, True, True, MultiplanarOption.IncludeOnlyPlanarCurves, 0)[0]
		self.RebLine = line
		self.XDir = rebar.GetShapeDrivenAccessor().Normal.Normalize()
		self.ZDir = line.Direction.Normalize()
		self.ZToken = self.ZDir.DotProduct(XYZ(1,1,1))
		if self.ZToken < 0:
			self.Origin = line.GetEndPoint(0)
		else:
			self.Origin = line.GetEndPoint(1)	
		self.D = rebar.Parameter[BuiltInParameter.REBAR_BAR_DIAMETER].AsDouble()
		self.N = rebar.Quantity
		self.Type = 'OnRegion'
		self.AttachedElemsPars = None
		self.Partition = rebar.Parameter[BuiltInParameter.NUMBER_PARTITION_PARAM].AsString()			
								
class WallReinforcement:
	def __init__(self, wp):
		self.WP = wp
		self.Type = 'Wall'
		wall = wp.Elem
		self.Elem = wall
		self.DX = wall.GetParameters('1Пп_Арм_Горизонтальная_Диаметр')[0].AsDouble()
		self.DY1 = wall.GetParameters('1Пп_Арм_Вертикальная_Диаметр 1')[0].AsDouble()
		self.DY2 = wall.GetParameters('1Пп_Арм_Вертикальная_Диаметр 2')[0].AsDouble()
		self.DY3 = wall.GetParameters('1Пп_Арм_Вертикальная_Диаметр 3')[0].AsDouble()
		self.DStud = wall.GetParameters('1Пп_Арм_Шпильки_Диаметр')[0].AsDouble()
		self.DStudS = self.DStud * 2.5
		self.DBinder = wall.GetParameters('1Пп_Арм_Хомуты_Диаметр')[0].AsDouble()
		self.StepX = wall.GetParameters('1Пп_Арм_Горизонтальная_Шаг')[0].AsDouble()
		self.StepY = wall.GetParameters('1Пп_Арм_Вертикальная_Шаг')[0].AsDouble()
		self.CovExt = doc.GetElement(wall.Parameter[BuiltInParameter.CLEAR_COVER_EXTERIOR].AsElementId()).CoverDistance
		self.CovInt = doc.GetElement(wall.Parameter[BuiltInParameter.CLEAR_COVER_INTERIOR].AsElementId()).CoverDistance
		if doc.GetElement(wall.Parameter[BuiltInParameter.CLEAR_COVER_OTHER].AsElementId()):
			self.CovOth = doc.GetElement(wall.Parameter[BuiltInParameter.CLEAR_COVER_OTHER].AsElementId()).CoverDistance
		else:
			self.CovOth = 0
		self.Wancs = None
		self.MidRebs = None
		
	def GetRebarTypes(self):	
		self.RebarTypeDX = self.GetRebarType(self.DX, 'А500С', 0)
		self.RebarTypeDXim = self.GetRebarType(self.DY1, 'А500С', 1)
		self.RebarTypeDY1 = self.GetRebarType(self.DY1, 'А500С', 0)
		self.RebarTypeDY2 = self.GetRebarType(self.DY2, 'А500С', 0)
		self.RebarTypeDY3 = self.GetRebarType(self.DY3, 'А500С', 0)
		self.RebarTypeDStud = self.GetRebarType(self.DStud, 'А240', 0)
		self.RebarTypeDBinder = self.GetRebarType(self.DBinder, 'А240', 0)

	def GetRebarType(self, d, rClass, im):
		for rt in FilteredElementCollector(doc).OfClass(RebarBarType).ToElements():
			name = rt.Parameter[BuiltInParameter.SYMBOL_NAME_PARAM].AsString()
			diameter = round(rt.Parameter[BuiltInParameter.REBAR_BAR_DIAMETER].AsDouble()*304.8)
			inMeteres = rt.get_Parameter(System.Guid('844a01e2-19fc-4dc5-baa0-a4bda30ef1f6')).AsInteger()
			if name.find(rClass) != -1 and diameter == round(d*304.8) and inMeteres == im and not name.split('_')[-1].isdigit():
				break
		else:
			rt = RebarBarType.Create(doc)
			if im == 1:
				suffix = '_ПМ'
			else:
				suffix = ''
			rt.Name = str(int(round(d*304.8))) + '-' + rClass + suffix
			SetRebarBarTypeParameters(rt, d, 0, rClass, im)
		return rt
		
	def UpdateRebarCoverType(self, align, covEnds):
		dst = align - self.DX
		for rct1 in FilteredElementCollector(doc).OfClass(RebarCoverType).ToElements():
			if round(rct1.CoverDistance*304.8) == round(dst*304.8):
				break
		else:
			rct1 = RebarCoverType.Create(doc, str(round(dst*304.8)), dst)
		for rct2 in FilteredElementCollector(doc).OfClass(RebarCoverType).ToElements():
			if round(rct2.CoverDistance*304.8) == round(covEnds*304.8):
				break
		else:
			rct2 = RebarCoverType.Create(doc, str(round(covEnds*304.8)), covEnds)
		if not self.Elem.Parameter[BuiltInParameter.CLEAR_COVER_EXTERIOR].IsReadOnly:
			self.Elem.Parameter[BuiltInParameter.CLEAR_COVER_EXTERIOR].Set(rct1.Id)
			self.CovExt = doc.GetElement(self.Elem.Parameter[BuiltInParameter.CLEAR_COVER_EXTERIOR].AsElementId()).CoverDistance
		if not self.Elem.Parameter[BuiltInParameter.CLEAR_COVER_INTERIOR].IsReadOnly:
			self.Elem.Parameter[BuiltInParameter.CLEAR_COVER_INTERIOR].Set(rct1.Id)
			self.CovInt = doc.GetElement(self.Elem.Parameter[BuiltInParameter.CLEAR_COVER_INTERIOR].AsElementId()).CoverDistance
		if not self.Elem.Parameter[BuiltInParameter.CLEAR_COVER_OTHER].IsReadOnly:
			self.Elem.Parameter[BuiltInParameter.CLEAR_COVER_OTHER].Set(rct2.Id)
			self.CovOth = doc.GetElement(self.Elem.Parameter[BuiltInParameter.CLEAR_COVER_OTHER].AsElementId()).CoverDistance
			
	def GetWallAnchors(self):
		wancs = []	
		currentWP = self.WP
		while not wancs:
			botWPs = currentWP.HasBottomWalls()		
			if not botWPs:
				break
			rebarIds = botWPs[0].Elem.GetDependentElements(ElementClassFilter(Rebar))
			if not rebarIds:
				break
			filter = BoundingBoxIntersectsFilter(currentWP.Contour)
			vRebars = list(FilteredElementCollector(doc, List[ElementId](rebarIds)).WherePasses(filter).ToElements())		
			filteredVRebars = []
			for rebar in vRebars:
				line = rebar.GetCenterlineCurves(False, True, True, MultiplanarOption.IncludeOnlyPlanarCurves, 0)[0]
				filters = []
				filters.append(BoundingBoxContainsPointFilter(line.GetEndPoint(0)))
				filters.append(BoundingBoxContainsPointFilter(line.GetEndPoint(1)))
				filter = LogicalOrFilter(filters)
				if filter.PassesFilter(self.WP.Elem):
					filteredVRebars.append(rebar)				
			if filteredVRebars:
				wancs = [WallAnchor(rebar, currentWP) for rebar in filteredVRebars]
				inters = currentWP.HasEndIntersections()
				ends = currentWP.HasEnds()
				for wanc in wancs:
					for inter in inters:
						if inter:
							solid = inter.GetSolid()
							spotlines = list(solid.IntersectWithCurve(wanc.RebLine, None))
							if spotlines:
								wanc.Type = 'OnIntersection'
								wanc.AttachedElemsPars = inter.AttachedElemsPars
					for end in ends:
						if end:
							solid = end.GetSolid()
							spotlines = list(solid.IntersectWithCurve(wanc.RebLine, None))
							if spotlines:
								wanc.Type = 'OnEnd'
			else:
				currentWP = botWPs[0]						
		return wancs		
	
	def GetMiddleVRebars(self):
		middleVRebars = []
		currentWP = self.WP
		while not middleVRebars:
			botWPs = currentWP.HasBottomWalls()		
			if not botWPs:
				break
			rebarIds = botWPs[0].Elem.GetDependentElements(ElementClassFilter(Rebar))
			if not rebarIds:
				break
			filter = BoundingBoxIntersectsFilter(currentWP.Contour)
			vRebars = list(FilteredElementCollector(doc, List[ElementId](rebarIds)).WherePasses(filter).ToElements())			
			for rebar in vRebars:
				line = rebar.GetCenterlineCurves(False, True, True, MultiplanarOption.IncludeOnlyPlanarCurves, 0)[0]
				filters = []
				filters.append(BoundingBoxContainsPointFilter(line.GetEndPoint(0)))
				filters.append(BoundingBoxContainsPointFilter(line.GetEndPoint(1)))
				filter = LogicalOrFilter(filters)
				if not filter.PassesFilter(self.WP.Elem):
					middleVRebars.append(rebar)
			if not middleVRebars:
				currentWP = botWPs[0]
		return middleVRebars
		
class WallParameters:
	def __init__(self, wall):
		self.Elem = wall
		self.Id = wall.Id.IntegerValue
		self.Geom = WallGeometryParameters(wall)
		self.Reinf = WallReinforcement(self)
		bClassPar = wall.GetParameters('1Пп_Класс бетона')[0]
		if bClassPar.StorageType == StorageType.Double:
			self.BClass = 'B' + str(int(round(bClassPar.AsDouble())))
		else:
			self.BClass = wall.GetParameters('1Пп_Класс бетона')[0].AsString()
		self.Regions = []
		self.Intersections = []
		self.Ends = []
		self.Openings = self.GetOpeningAndVoidParameters()[0]
		self.Voids = self.GetOpeningAndVoidParameters()[1]
		self.Phase = wall.Parameter[BuiltInParameter.PHASE_CREATED].AsElementId()
		self.Contour = Outline(wall.BoundingBox[doc.GetElement(intersector.ViewId)].Min, wall.BoundingBox[doc.GetElement(intersector.ViewId)].Max)
		if wall.GetParameters(IN[5][9]):
			self.Zone = wall.GetParameters(IN[5][9])[0].AsString()
		else:
			self.Zone = None
		if wall.GetParameters(IN[5][10]):
			self.Section = wall.GetParameters(IN[5][10])[0].AsString()
		else:
			self.Section = None
		self.Mark = wall.Parameter[BuiltInParameter.ALL_MODEL_MARK].AsString()
		
	def HasBottomSlabs(self):
		filter = ElementLevelFilter(self.Geom.BotLvlId)
		slabs = FilteredElementCollector(doc, List[ElementId](slabIds)).OfClass(Floor).WherePasses(filter).ToElements()
		cutLine = Line.CreateBound(self.Geom.BotCenterLine.GetEndPoint(0) - XYZ.BasisZ*10/304.8, self.Geom.BotCenterLine.GetEndPoint(1) - XYZ.BasisZ*10/304.8)
		sps = []
		for slab in slabs:
			sp = SlabParameters(slab)
			sups = sp.GetSlabBottomSupports(self)
			if sups:
				sp.Supports = sups
				sps.append(sp)
		return sps
		
	def HasBottomWalls(self):
		points = [self.Geom.BotCenterLine.GetEndPoint(0) - XYZ.BasisZ*500/304.8, self.Geom.BotCenterLine.GetEndPoint(1) - XYZ.BasisZ*500/304.8]
		sortedPoints = SortPointsByCoords(points[0], points[1])
		cutLine = Line.CreateBound(sortedPoints[0], sortedPoints[1])
		outline = Outline(sortedPoints[0]-VecABS(self.Geom.YDir)*10/304.8, sortedPoints[1]+VecABS(self.Geom.YDir)*10/304.8)
		filter = BoundingBoxIntersectsFilter(outline)		
#		i = IN[8].index(self.Geom.BotLvlId.IntegerValue)-1
#		lvlId = ElementId(IN[8][i])
#		filter = LogicalOrFilter(ElementLevelFilter(lvlId), ElementLevelFilter(self.Geom.BotLvlId))
		walls = FilteredElementCollector(doc, List[ElementId](wallIds)).WherePasses(filter).ToElements()
#		cutLine = Line.CreateBound(self.Geom.BotCenterLine.GetEndPoint(0) - XYZ.BasisZ*500/304.8, self.Geom.BotCenterLine.GetEndPoint(1) - XYZ.BasisZ*500/304.8)
		wps = []
		for wall in walls:
			wp = WallParameters(wall)
			spotLines = list(wp.Geom.Solid.IntersectWithCurve(cutLine, None))
			if spotLines and VecABS(wp.Geom.XDir).IsAlmostEqualTo(VecABS(self.Geom.XDir)):
				wps.append(wp)
		return wps		
		
	def HasUpperSlabs(self):
		filter = ElementLevelFilter(self.Geom.TopLvlId)
		slabs = FilteredElementCollector(doc, List[ElementId](slabIds)).OfClass(Floor).WherePasses(filter).ToElements()
		cutLine = Line.CreateBound(self.Geom.TopCenterLine.GetEndPoint(0) + XYZ.BasisZ*10/304.8, self.Geom.TopCenterLine.GetEndPoint(1) + XYZ.BasisZ*10/304.8)
		sps = []
		for slab in slabs:
			sp = SlabParameters(slab)
			sups = sp.GetSlabSupports(self)
			if sups:
				sp.Supports = sups
				sps.append(sp)
		return sps
		
	def HasUpperColumns(self):
		filter = ElementLevelFilter(self.Geom.TopLvlId)
		columns = FilteredElementCollector(doc, List[ElementId](columnIds)).WherePasses(filter).ToElements()
		cutLine = Line.CreateBound(self.Geom.TopCenterLine.GetEndPoint(0) + XYZ.BasisZ*300/304.8, self.Geom.TopCenterLine.GetEndPoint(1) + XYZ.BasisZ*300/304.8)
		cps = []
		for column in columns:
			cp = ColumnParameters(column)
			spotLines = list(cp.Geom.Solid.IntersectWithCurve(cutLine, None))
			if spotLines and VecABS(cp.Geom.XDir).IsAlmostEqualTo(VecABS(self.Geom.XDir)):
				cps.append(cp)
		return cps
		
	def HasUpperWalls(self):
		points = [self.Geom.TopCenterLine.GetEndPoint(0) + XYZ.BasisZ*300/304.8, self.Geom.TopCenterLine.GetEndPoint(1) + XYZ.BasisZ*300/304.8]
		sortedPoints = SortPointsByCoords(points[0], points[1])
		cutLine = Line.CreateBound(sortedPoints[0], sortedPoints[1])
		outline = Outline(sortedPoints[0]-VecABS(self.Geom.YDir)*10/304.8, sortedPoints[1]+VecABS(self.Geom.YDir)*10/304.8)
		filter = BoundingBoxIntersectsFilter(outline)
#		filter = LogicalOrFilter(ElementLevelFilter(self.Geom.TopLvlId), ElementLevelFilter(self.Geom.BotLvlId))
		walls = FilteredElementCollector(doc, List[ElementId](wallIds)).WherePasses(filter).ToElements()
		wps = []
		for wall in walls:
			wp = WallParameters(wall)
			spotLines = list(wp.Geom.Solid.IntersectWithCurve(cutLine, None))
			if spotLines and VecABS(wp.Geom.XDir).IsAlmostEqualTo(VecABS(self.Geom.XDir)):
				wps.append(wp)
		return wps

	def HasMiddleIntersections(self):
		intersections = []
		tokens = [1, -1]
		elemIds = list(wallIds) + list(columnIds)
		elemIds.remove(ElementId(self.Id))
		lvlfilter = ElementLevelFilter(self.Geom.BotLvlId)
#		filter = BoundingBoxIntersectsFilter(self.Contour)		
		elems = FilteredElementCollector(doc, List[ElementId](elemIds)).WherePasses(lvlfilter).ToElements()		
		for elem in elems:
			wi = None
			elp = None
			for i in range(2):
				if elem.GetType() == Wall:
					joinedElements = list(elem.Location.ElementsAtJoin[i])		
					if joinedElements and self.Id in [wall.Id.IntegerValue for wall in joinedElements]:
						otherWall = [wall for wall in joinedElements if wall.Id.IntegerValue != self.Id][0]
						wp = WallParameters(otherWall)
						if not wp.Geom.EndPoints[i].IsAlmostEqualTo(self.Geom.EndPoints[0]) and not wp.Geom.EndPoints[i].IsAlmostEqualTo(self.Geom.EndPoints[1]) and lvlfilter.PassesFilter(otherWall) and round(wp.Geom.BotZ*304.8) == round(self.Geom.BotZ*304.8):
							wi = WallIntersection([wp], self)
							wi.Origin = wp.Geom.EndPoints[i]							
					elif not elp:
						elp = WallParameters(elem)	
				elif not elp:
					elp = ColumnParameters(elem)
				if elp:
					filters = []
					if VecABS(elp.Geom.YDir).IsAlmostEqualTo(VecABS(self.Geom.XDir)) or elp.Elem.GetType() == Wall:
						dir1 = elp.Geom.XDir
						dir2 = elp.Geom.YDir
						points = elp.Geom.EndPoints
					elif elp.Elem.GetType() == FamilyInstance:
						dir1 = elp.Geom.YDir
						dir2 = elp.Geom.XDir
						points = elp.Geom.EndPoints2					
					filters.append(BoundingBoxContainsPointFilter(points[i] + dir1*IN[7]/304.8*tokens[i] - dir2*(elp.Geom.T/2+IN[7]/304.8) + XYZ.BasisZ*IN[7]/304.8))
					filters.append(BoundingBoxContainsPointFilter(points[i] + dir1*IN[7]/304.8*tokens[i] + dir2*(elp.Geom.T/2+IN[7]/304.8) + XYZ.BasisZ*IN[7]/304.8))
					filters.append(BoundingBoxContainsPointFilter(points[i] - dir1*IN[7]/304.8*tokens[i] - dir2*(elp.Geom.T/2+IN[7]/304.8) + XYZ.BasisZ*IN[7]/304.8))
					filters.append(BoundingBoxContainsPointFilter(points[i] - dir1*IN[7]/304.8*tokens[i] + dir2*(elp.Geom.T/2+IN[7]/304.8) + XYZ.BasisZ*IN[7]/304.8))
					dsts = [plane.Project(points[i])[1] for plane in GetUnboundFaces(self.Geom.Faces.Long) if plane.Project(points[i])]					
					if dsts:
						dst = min(dsts)
					else:
						dst = 0
					if filters[0].PassesFilter(self.Elem) and filters[1].PassesFilter(self.Elem) and round(elp.Geom.BotZ*304.8) == round(self.Geom.BotZ*304.8) and not wi:
						wi = WallIntersection([elp], self)
						wi.Origin = points[i] + dir1*(self.Geom.T/2+dst)*tokens[i]
					elif filters[2].PassesFilter(self.Elem) and filters[3].PassesFilter(self.Elem) and round(elp.Geom.BotZ*304.8) == round(self.Geom.BotZ*304.8) and not wi:
						wi = WallIntersection([elp], self)
						wi.Origin = points[i] - dir1*(self.Geom.T/2+dst)*tokens[i]
				if wi:
					for k in [0, 0.5, 1]:				
						cutLine = Line.CreateBound(wi.Origin, wi.Origin + XYZ.BasisZ*(10/304.8 + self.Geom.H*k))
						spotLines = list(self.Geom.Solid.IntersectWithCurve(cutLine, None))
						if spotLines:
							wi.PlaceRebars = True
							break
					intersections.append(wi)
					break					
		return intersections

	def HasEndIntersections(self):
		intersections = []
		tokens = [1, -1]
		lvlfilter = ElementLevelFilter(self.Geom.BotLvlId)
		elemIds = FilteredElementCollector(doc, List[ElementId]( list(wallIds) + list(columnIds))).WherePasses(lvlfilter).ToElementIds()
		for i in range(2):
			wi = None
			joinedElements = list(self.Elem.Location.ElementsAtJoin[i])	
			if joinedElements:		
				otherWalls = [wall for wall in joinedElements if wall.Id.IntegerValue != self.Id and lvlfilter.PassesFilter(wall)]
				wps = [WallParameters(wall) for wall in otherWalls]
				filteredWPs = [wp for wp in wps if round(wp.Geom.BotZ*304.8) == round(self.Geom.BotZ*304.8)]
				if filteredWPs:
					wi = WallIntersection(filteredWPs, self)
					wi.Origin = self.Geom.EndPoints[i]				
			else:
				filters = []
				filters.append(BoundingBoxContainsPointFilter(self.Geom.EndPoints[i] + self.Geom.XDir*10/304.8*tokens[i] - self.Geom.YDir*(self.Geom.T/2+10/304.8) + XYZ.BasisZ*10/304.8))
				filters.append(BoundingBoxContainsPointFilter(self.Geom.EndPoints[i] + self.Geom.XDir*10/304.8*tokens[i] + self.Geom.YDir*(self.Geom.T/2+10/304.8) + XYZ.BasisZ*10/304.8))
				filters.append(BoundingBoxContainsPointFilter(self.Geom.EndPoints[i] - self.Geom.XDir*10/304.8*tokens[i] - self.Geom.YDir*(self.Geom.T/2+10/304.8) + XYZ.BasisZ*10/304.8))
				filters.append(BoundingBoxContainsPointFilter(self.Geom.EndPoints[i] - self.Geom.XDir*10/304.8*tokens[i] + self.Geom.YDir*(self.Geom.T/2+10/304.8) + XYZ.BasisZ*10/304.8))
				filter1 = LogicalOrFilter([filters[0], filters[1]])
				filter2 = LogicalOrFilter([filters[2], filters[3]])
				otherElems = FilteredElementCollector(doc, List[ElementId](elemIds)).WherePasses(filter1).ToElements()
				if otherElems:
					elps = [WallParameters(elem) for elem in otherElems if elem.GetType() == Wall] + [ColumnParameters(elem) for elem in otherElems if elem.GetType() == FamilyInstance]
#					filteredELPs = [elp for elp in elps if round(elp.Geom.BotZ*304.8) == round(self.Geom.BotZ*304.8)]
					wi = WallIntersection(elps, self)
					wi.Origin = self.Geom.EndPoints[i] + self.Geom.XDir*elps[0].Geom.T/2*tokens[i]
				else:
					otherElems = FilteredElementCollector(doc, List[ElementId](elemIds)).WherePasses(filter2).ToElements()
					if otherElems: 
						elps = [WallParameters(elem) for elem in otherElems if elem.GetType() == Wall] + [ColumnParameters(elem) for elem in otherElems if elem.GetType() == FamilyInstance]
#						filteredELPs = [elp for elp in elps if round(elp.Geom.BotZ*304.8) == round(self.Geom.BotZ*304.8)]
						wi = WallIntersection(elps, self)
						wi.Origin = self.Geom.EndPoints[i] - self.Geom.XDir*elps[0].Geom.T/2*tokens[i]
			if wi:				
				cutLine = Line.CreateBound(wi.Origin, wi.Origin + XYZ.BasisZ*10/304.8)
				spotLines = list(self.Geom.Solid.IntersectWithCurve(cutLine, None))
				if spotLines:				
					wi.PlaceRebars = True
			intersections.append(wi)
		return intersections
		
	def HasEnds(self):
		ends = []
		tokens = [1, -1]
		filter = ElementLevelFilter(self.Geom.BotLvlId)
		elemIds = FilteredElementCollector(doc, List[ElementId]( list(wallIds) + list(columnIds))).WherePasses(filter).ToElementIds()
		for i in range(2):
			end = None
			joinedElements = list(self.Elem.Location.ElementsAtJoin[i])
			if not joinedElements:
				filters = []
				filters.append(BoundingBoxContainsPointFilter(self.Geom.EndPoints[i] + self.Geom.XDir*10/304.8*tokens[i] - self.Geom.YDir*(self.Geom.T/2+10/304.8) + XYZ.BasisZ*10/304.8))
				filters.append(BoundingBoxContainsPointFilter(self.Geom.EndPoints[i] + self.Geom.XDir*10/304.8*tokens[i] + self.Geom.YDir*(self.Geom.T/2+10/304.8) + XYZ.BasisZ*10/304.8))
				filters.append(BoundingBoxContainsPointFilter(self.Geom.EndPoints[i] - self.Geom.XDir*10/304.8*tokens[i] - self.Geom.YDir*(self.Geom.T/2+10/304.8) + XYZ.BasisZ*10/304.8))
				filters.append(BoundingBoxContainsPointFilter(self.Geom.EndPoints[i] - self.Geom.XDir*10/304.8*tokens[i] + self.Geom.YDir*(self.Geom.T/2+10/304.8) + XYZ.BasisZ*10/304.8))
				filter1 = LogicalOrFilter([filters[0], filters[1]])
				filter2 = LogicalOrFilter([filters[2], filters[3]])
				otherElems1 = FilteredElementCollector(doc, List[ElementId](elemIds)).WherePasses(filter1).ToElements()
				otherElems2 = FilteredElementCollector(doc, List[ElementId](elemIds)).WherePasses(filter2).ToElements()
				if not otherElems1 and not otherElems2:
					end = WallEnd(self)
					end.Origin = self.Geom.EndPoints[i]
					end.XDir = self.Geom.XDir*tokens[i]
			ends.append(end)
		return ends
		
	def HasOutsideFace(self):
		for face in self.Geom.Faces.Long:
			uvs = []
			uvs.append(UV(10/304.8, 10/304.8))
			uvs.append(UV(self.Geom.BotCenterLine.Length/2, 10/304.8))
			uvs.append(UV(self.Geom.BotCenterLine.Length-10/304.8, 10/304.8))
			normal = face.FaceNormal.Normalize()
			for uv in uvs:
		 		origin = face.Evaluate(uv)
				targets = intersector.FindNearest(origin, normal)
				if not targets:
					return face
		else:
			return None
						
	def GetOpeningAndVoidParameters(self):
		filters = []
		filters.append(ElementClassFilter(FamilyInstance))
		filters.append(ElementCategoryFilter(BuiltInCategory.OST_Windows))
		filters.append(ElementCategoryFilter(BuiltInCategory.OST_Doors))
		filter = LogicalAndFilter(filters[0], LogicalOrFilter(filters[1], filters[2]))
		allOpenings = [doc.GetElement(id) for id in self.Elem.GetDependentElements(filter) if doc.GetElement(id).Symbol.FamilyName.find('231') == 0]
		openings = [open for open in allOpenings if open.Symbol.FamilyName.find('тверсти') != -1]
		voids = [open for open in allOpenings if open.Symbol.FamilyName.find('проем') != -1]
		return [OpeningParameters(self, open) for open in openings], [VoidParameters(self, void) for void in voids]

TransactionManager.Instance.EnsureInTransaction(doc)

WPars = [WallParameters(wall) for wall in walls if wall.GetParameters('Тип армирования') and  wall.GetParameters('Тип армирования')[0].AsElementId()]

TransactionManager.Instance.TransactionTaskDone()

OUT = WPars
# ----------------------------------------
WPars = Output(сбор_данных)  # Список параметров стен
