# Dynamo custom node ПеренумерацияЛистов.dyf (Dynamo 2.13.1.3887)
# category: 1П.Чертежи.Листы
# Определение нового номера для заданных листов

sheets = Input(sheets: var[]..[])  # Список листов
sheetNumber = Sheet.SheetNumber(sheet=sheets)
отсечение_префикса = Python(IN[0]=sheetNumber)  # IronPython2
# ---------- отсечение_префикса.python (17 lines) ----------
import sys
import clr
clr.AddReference('RevitAPI')
from Autodesk.Revit.DB import *

sheetNumbers = UnwrapElement(IN[0])

TrimmedNumbers = []
for i in sheetNumbers:
	if len(i.split('-')) > 1:
		tn = float(i.split('-')[1].split('_')[0])
	else:
		tn = float(i.split('_')[0])
		
	TrimmedNumbers.append(tn)
	
OUT = TrimmedNumbers
# ----------------------------------------
sortByKey = List.SortByKey(list=sheets, keys=отсечение_префикса)
startSheetNumber = Input(startSheetNumber: int)  # Начать нумерацию листов с номера
название_параметра_листа = StringInput("1П_Штамп_Номер листа")
перенумерация_листов = Python(IN[0]=sortByKey.sortedList, IN[1]=startSheetNumber, IN[2]=название_параметра_листа)  # IronPython2
# ---------- перенумерация_листов.python (37 lines) ----------
import sys
import clr
clr.AddReference('RevitAPI')
from Autodesk.Revit.DB import *
clr.AddReference('RevitServices')
from RevitServices.Persistence import DocumentManager
from RevitServices.Transactions import TransactionManager

sheets = UnwrapElement(IN[0])
startNumber = int(IN[1])

doc = DocumentManager.Instance.CurrentDBDocument

newNumbers = []

for i, sheet in enumerate(sheets):
	if len(sheet.SheetNumber.split('-')) > 1:
		Prefix = sheet.SheetNumber.split('-')[0]
		newNumbers.append(Prefix + '-' + str(i + startNumber)) 
	else:
		newNumbers.append(str(i + startNumber))

TransactionManager.Instance.EnsureInTransaction(doc)

for i, sheet in enumerate(sheets):
	sheet.SheetNumber = newNumbers[i] + '_temp'

for i, sheet in enumerate(sheets):
	sheet.SheetNumber = newNumbers[i]
	if sheet.GetParameters(IN[2]):
		sheet.GetParameters(IN[2])[0].Set(newNumbers[i].split('-')[-1])
				
doc.Regenerate()

TransactionManager.Instance.TransactionTaskDone()

OUT = newNumbers
# ----------------------------------------
newSheetNumbers = Output(перенумерация_листов)  # Новая нумерация листов
