# Dynamo custom node Пересекатель.dyf (Dynamo 2.13.1.3887)
# category: 1П.Фильтрация
# Создание пересекателя на основе трёхмерного вида для поиска элементов

view3DName = Input(view3DName: string)  # Имя трёхмерного вида
elemIds = Input(elemIds: var[]..[])  # Список ID элементов
пересекатель = Python(IN[0]=view3DName, IN[1]=elemIds)  # IronPython2
# ---------- пересекатель.python (18 lines) ----------
import clr
clr.AddReference('System')
from System.Collections.Generic import List
clr.AddReference('RevitAPI')
from Autodesk.Revit.DB import *
clr.AddReference('RevitServices')
from RevitServices.Persistence import DocumentManager

doc = DocumentManager.Instance.CurrentDBDocument

elemIds = IN[1]
view3Ds = [view for view in FilteredElementCollector(doc).OfClass(View3D).ToElements() if view.Name == IN[0]]
if view3Ds:
	view3D = view3Ds[0]

intersector = ReferenceIntersector(List[ElementId](elemIds), FindReferenceTarget.Element, view3D) 

OUT = intersector
# ----------------------------------------
refIntersector = Output(пересекатель)
