# Dynamo custom node ПолучитьРеальныйСолид.dyf (Dynamo 2.13.1.3887)
# category: 1П.Подготовка
# Обрабатывает элементы для получения "реальной" объемной геометрии - данный скрипт используется для перевода свойства HasModifiedGeometry в положение "True" и получения геометрии типа "Solid" напрямую, без посредства "GeometryInstance" (см. примечания для класса "GeometryInstance" в Revit SDK)

elemsId = Input(elemsId: var[]..[])  # Список ID элементов
имя_семейства_с_возможностью = StringInput("Семейство1")  # "Имя семейства с возможностью вырезать полости"
обработать_элементы_для = Python(IN[0]=elemsId, IN[1]=имя_семейства_с_возможностью)  # "Обработать элементы для получения "реальной" объемной геометрии"; IronPython2
# ---------- обработать_элементы_для.python (54 lines) ----------
import sys
import clr
import math
import System
clr.AddReference('System')
from System.Collections.Generic import List
clr.AddReference('RevitAPI')
from Autodesk.Revit.DB import *
from Autodesk.Revit.DB.Structure import *
clr.AddReference('RevitServices')
from RevitServices.Persistence import DocumentManager
from RevitServices.Transactions import TransactionManager

doc = DocumentManager.Instance.CurrentDBDocument

def GetBBoxVertices(elem):
	box = elem.BoundingBox[doc.ActiveView]
	diagonal = box.Max - box.Min
	diagonalL= box.Min.DistanceTo(box.Max)
	L = diagonalL*math.cos(diagonal.AngleTo(XYZ.BasisX))
	B = diagonalL*math.cos(diagonal.AngleTo(XYZ.BasisY))
	H = diagonalL*math.cos(diagonal.AngleTo(XYZ.BasisZ))
	return [box.Min, box.Min + XYZ.BasisX*L, box.Min + XYZ.BasisY*B, box.Min + XYZ.BasisZ*H, box.Max, box.Max - XYZ.BasisX*L, box.Max - XYZ.BasisY*B, box.Max - XYZ.BasisZ*H]

elemIds = UnwrapElement(IN[0])
createdElemIds = []
opt = Options()

tempSymbols = [sym for sym in FilteredElementCollector(doc).OfClass(FamilySymbol) if sym.FamilyName == IN[1]]
if tempSymbols:
	tempSymbol = tempSymbols[0]
else:
	tempSymbol = None

TransactionManager.Instance.EnsureInTransaction(doc)

if tempSymbol:
	for id in elemIds:
		elem = doc.GetElement(id)
		if elem.GetType() == FamilyInstance and not elem.Symbol.Family.IsInPlace and not elem.HasModifiedGeometry():
			insertPoints = GetBBoxVertices(elem)	
			for insertPoint in insertPoints:
				tempElem = doc.Create.NewFamilyInstance(insertPoint, tempSymbol, StructuralType.NonStructural)
				createdElemIds.append(tempElem.Id)
				try:
					InstanceVoidCutUtils.AddInstanceVoidCut(doc, elem, tempElem)
				except Exception:
					continue
			
TransactionManager.Instance.TransactionTaskDone()

elems = [doc.GetElement(id) for id in elemIds]

OUT = createdElemIds, elemIds, elems
# ----------------------------------------
end = Revit.Transaction.Transaction.End(input=обработать_элементы_для)
number = DoubleInput(2)
getItemAtIndex = List.GetItemAtIndex(list=end, index=number)
elems = Output(getItemAtIndex)  # Список обработанных элементов
обработать_элементы_для_2 = Python()  # "Обработать элементы для получения "реальной" объемной геометрии"; IronPython2; frozen; unwired: IN[0], IN[1]
# ---------- обработать_элементы_для_2.python (76 lines) ----------
import sys
import clr
import System
clr.AddReference('System')
from System.Collections.Generic import List
clr.AddReference('RevitAPI')
from Autodesk.Revit.DB import *
from Autodesk.Revit.DB.Structure import *
clr.AddReference('RevitServices')
from RevitServices.Persistence import DocumentManager
from RevitServices.Transactions import TransactionManager

doc = DocumentManager.Instance.CurrentDBDocument

beamFilter = LogicalAndFilter(ElementClassFilter(FamilyInstance), ElementCategoryFilter(BuiltInCategory.OST_StructuralFraming))

def GetLevelId(elem):
	
	if beamFilter.PassesFilter(elem):
		lvlId = elem.Parameter[BuiltInParameter.INSTANCE_REFERENCE_LEVEL_PARAM].AsElementId()
	else:
		lvlId = elem.LevelId
	return lvlId
	
#def GetOrientation(elem):
#	if elem.GetType() == Wall:
#		return elem.Orientation
#	elif elem.GetType() == Floor:
#		return XYZ.BasisZ
#	else:
#	return elem.FacingOrientation.Normalize()
		
def GetInsertPoint(elem, z):
	if elem.GetType() == Wall or beamFilter.PassesFilter(elem):
		return elem.Location.Curve.Evaluate(0.5, True) + XYZ.BasisZ*(z+500/304.8)
	#elif elem.GetType() == Floor:
	#	solids = [geom for geom in list(elem.Geometry[opt]) if geom.GetType() == Solid and geom.Volume > 0]
	#	return solids[0].ComputeCentroid()
	else:
		return elem.Location.Point + XYZ.BasisZ*(z+500/304.8)	

elemIds = UnwrapElement(IN[0])
createdElemIds = []
opt = Options()

tempSymbols = [sym for sym in FilteredElementCollector(doc).OfClass(FamilySymbol) if sym.FamilyName == IN[1]]
if tempSymbols:
	tempSymbol = tempSymbols[0]
else:
	tempSymbol = None

orient = XYZ()

TransactionManager.Instance.EnsureInTransaction(doc)

if tempSymbol:
	for id in elemIds:
		elem = doc.GetElement(id)
		if elem.GetType() == FamilyInstance and not elem.HasModifiedGeometry():
			lvl = doc.GetElement(GetLevelId(elem))
			z = lvl.Elevation
			orient = elem.FacingOrientation.Normalize()
			insertPoint = GetInsertPoint(elem, z)
			
			tempElem = doc.Create.NewFamilyInstance(insertPoint, tempSymbol, StructuralType.NonStructural)
			try:		
				InstanceVoidCutUtils.AddInstanceVoidCut(doc, elem, tempElem)
				createdElemIds.append(tempElem.Id)	
			except Exception:
				continue
			
TransactionManager.Instance.TransactionTaskDone()

elems = [doc.GetElement(id) for id in elemIds]

OUT = createdElemIds, elemIds, elems
# ----------------------------------------
number_2 = DoubleInput(0)
getItemAtIndex_2 = List.GetItemAtIndex(list=end, index=number_2)
удаление_временных_элементов = Python(IN[0]=getItemAtIndex_2)  # IronPython2
# ---------- удаление_временных_элементов.python (24 lines) ----------
import sys
import clr
import System
clr.AddReference('System')
from System.Collections.Generic import List
clr.AddReference('RevitAPI')
from Autodesk.Revit.DB import *
from Autodesk.Revit.DB.Structure import *
clr.AddReference('RevitServices')
from RevitServices.Persistence import DocumentManager
from RevitServices.Transactions import TransactionManager

doc = DocumentManager.Instance.CurrentDBDocument

elemIds = UnwrapElement(IN[0])

TransactionManager.Instance.EnsureInTransaction(doc)

doc.Delete(List[ElementId](elemIds))




OUT = 'Выполнено'
# ----------------------------------------
number_3 = DoubleInput(1)
getItemAtIndex_3 = List.GetItemAtIndex(list=end, index=number_3)
elemIds = Output(getItemAtIndex_3)  # Список обработанных элементов
