# Dynamo custom node РазборкаКонтейнеров.dyf (Dynamo 2.13.1.3887)
# category: 1П.Армирование
# Заменяет арматурные контейнеры арматурными стержнями идентичными наполнению контейнера.

rebarContainers = Input(rebarContainers: var[]..[])  # Список арматурных контейнеров
корректировкаХостаДляАрматуры = Custom[КорректировкаХостаДляАрматуры](rebarsOrRebarContainers=rebarContainers)  # Проверяет и корректирует хост арматурных стержней или арматурных контейнеров.
monitoring = Output(корректировкаХостаДляАрматуры.monitoring)  # Мониторинг хостов
разборка_контейнеров = Python(IN[0]=корректировкаХостаДляАрматуры.RCPs)  # IronPython2
# ---------- разборка_контейнеров.python (48 lines) ----------
import sys
import clr
clr.AddReference('RevitAPI')
from Autodesk.Revit.DB import *
from Autodesk.Revit.DB.Structure import *
clr.AddReference('RevitServices')
from RevitServices.Persistence import DocumentManager
from RevitServices.Transactions import TransactionManager

def GetPartitionName(rcp):
	condition1 = rcp.Host.GetType() == FamilyInstance
	if condition1:
		condition2 = rcp.Host.Symbol.GetParameters('1П_Размер_Ширина')
		condition3 = rcp.Host.Symbol.GetParameters('1П_Размер_Высота')
	else:
		condition2 = False
		condition3 = False
	if condition1 and condition2 and condition3:
		hostB = rcp.Host.Symbol.GetParameters('1П_Размер_Ширина')[0].AsValueString()
		hostH = rcp.Host.Symbol.GetParameters('1П_Размер_Высота')[0].AsValueString()
		suffix = '_' + hostB + 'x' + hostH + '(h)'
	else:
		suffix = ''
	return '04_Выпуски' + suffix
	
doc = DocumentManager.Instance.CurrentDBDocument

RCPs = IN[0]	
extractedRebars = []

TransactionManager.Instance.EnsureInTransaction(doc)

for rcp in RCPs:
	partitionName = GetPartitionName(rcp)
	for rp in rcp.RPs:	
		rebar = Rebar.CreateFromCurvesAndShape(doc, rp.Shape, rp.BarType, rp.Hooks[0][0], rp.Hooks[0][1], rcp.Host, rp.Normal, rp.Lines, rp.Hooks[1][0], rp.Hooks[1][1])
		if not rebar:
			rebar = Rebar.CreateFromCurves(doc, rp.Style, rp.BarType, rp.Hooks[0][0], rp.Hooks[0][1], rcp.Host, rp.Normal, rp.Lines, rp.Hooks[1][0], rp.Hooks[1][1], True, True)
		if rebar:	
			rp.SetLayoutRuleForRebar(rebar)	
			rebar.Parameter[BuiltInParameter.PHASE_CREATED].Set(rcp.PhaseId)
			rebar.Parameter[BuiltInParameter.NUMBER_PARTITION_PARAM].Set(partitionName)
		extractedRebars.append(rebar)
	doc.Delete(rcp.Elem.Id)
	
TransactionManager.Instance.TransactionTaskDone()

OUT = extractedRebars
# ----------------------------------------
extractedRebars = Output(разборка_контейнеров)  # Извлеченные арматурные стержни
