# Dynamo custom node СборкаКонтейнеров.dyf (Dynamo 2.13.1.3887)
# category: 1П.Армирование
# Собирает идентичные арматурные контейнеры из арматурных стержней. Стержни можно выбирать: отдельно (из данного набора будет создан единый контейнер), по сборкам из стержней (для каждой сборки будет создан контейнер), по хостам (контейнеры будут созданы для каждого хоста из стержней внутри хоста)

sourceElems = Input(sourceElems: var[]..[])  # Список арматурных стержней, сборок или хостов
извлечение_арматуры = Python(IN[0]=sourceElems)  # IronPython2
# ---------- извлечение_арматуры.python (29 lines) ----------
import clr
clr.AddReference('RevitAPI')
from Autodesk.Revit.DB import *
from Autodesk.Revit.DB.Structure import *
clr.AddReference('RevitServices')
from RevitServices.Persistence import DocumentManager

doc = DocumentManager.Instance.CurrentDBDocument

rebarFilter = ElementClassFilter(Rebar)
aiFilter = ElementClassFilter(AssemblyInstance)

elems = list(UnwrapElement(IN[0]))

rebars = []
for elem in elems:
	if rebarFilter.PassesFilter(elem):
		rebars.append(elem)
	elif aiFilter.PassesFilter(elem):
		ai = elem
		subElems = [doc.GetElement(id) for id in ai.GetMemberIds()]
		subRebars = [subElem for subElem in subElems if rebarFilter.PassesFilter(subElem)]
		rebars += subRebars
	else:
		host = elem
		subRebars = [doc.GetElement(id) for id in host.GetDependentElements(rebarFilter)]
		rebars += subRebars

OUT = rebars
# ----------------------------------------
параметрыАрматуры = Custom[ПараметрыАрматуры](rebarsOrRebarContainers=извлечение_арматуры)  # Сведения и методы, связанные с арматурными стержнями и арматурными контейнерами

# group: Параметры
имя_параметра = StringInput("1Пп_Наименование контейнера")
containerName = Input(containerName: string = "")  # Имя контейнера Для присвоения имени контейнера по умолчанию задать ""
данные_параметра = List.Create(item0=имя_параметра, item1=containerName)
имя_параметра_2 = StringInput("1Пп_Обозначение контейнера")
имя_параметра_3 = StringInput("1П_Количество")
имя_параметра_4 = StringInput("1П_Масса")
имя_параметра_5 = StringInput("1П_Марка конструкции")
имя_параметра_6 = StringInput("1П_Размер_В погонных метрах")
имя_параметра_7 = StringInput("1П_Зона")
имя_параметра_8 = StringInput("1П_Наименование")
параметры = List.Create(item0=данные_параметра, item1=имя_параметра_2, item2=имя_параметра_3, item3=имя_параметра_4, item4=имя_параметра_5, item5=имя_параметра_6, item6=имя_параметра_7, item7=имя_параметра_8)

создание_контейнера = Python(IN[0]=параметрыАрматуры.rebarParameters, IN[1]=параметры)  # IronPython2
# ---------- создание_контейнера.python (83 lines) ----------
import sys
import clr
clr.AddReference('System')
from System.Collections.Generic import List
clr.AddReference('RevitAPI')
from Autodesk.Revit.DB import *
from Autodesk.Revit.DB.Structure import *
clr.AddReference('RevitServices')
from RevitServices.Persistence import DocumentManager
from RevitServices.Transactions import TransactionManager

def AppendDividedItems(rp, container):
	lineSet = rp.GetLineSet()
	for data in lineSet:
		lines = data[0]
		n = data[1]
		item = container.AppendItemFromCurvesAndShape(rp.Shape, rp.BarType, rp.Hooks[0][0], rp.Hooks[0][1], rp.Normal, lines, rp.Hooks[1][0], rp.Hooks[1][1])
		rp.SetLayoutRuleForRCI(item, n)
				
def IsRCShouldBeInMeters(RPs):
	for rp in RPs:
		if rp.InMeters:
			return True
	return False
	
def GetRCTypeName(RPs):
	if IN[1][0][1] != '':
		return IN[1][0][1]
	else:
		parent = doc.GetElement(RPs[0].ParentId)
		if parent.GetType() == AssemblyInstance:
			condition1 = doc.GetElement(parent.GetTypeId()).GetParameters(IN[1][7])
			condition2 = doc.GetElement(parent.GetTypeId()).GetParameters(IN[1][7])[0].HasValue
			condition3 = doc.GetElement(parent.GetTypeId()).GetParameters(IN[1][7])[0].AsString() != ''
			if condition1 and condition2 and condition3:
				return doc.GetElement(parent.GetTypeId()).GetParameters(IN[1][7])[0].AsString()
			else:
				return 'Каркас'
		else:
			return containerNames[parent.Category.Name] if parent.Category.Name in containerNames.keys() else 'Контейнер'
	
def GetRCType(RPs):
	isRCInMeters = IsRCShouldBeInMeters(rpSet)
	containerTypeName = GetRCTypeName(RPs) + ('_ПМ' if isRCInMeters else '')
	containerTypeId = RebarContainerType.GetOrCreateRebarContainerType(doc, containerTypeName)
	containerType = doc.GetElement(containerTypeId)
	containerType.GetParameters(IN[1][5])[0].Set(1 if isRCInMeters else 0)
	return containerType

doc = DocumentManager.Instance.CurrentDBDocument

containerNames = {'Несущие колонны': 'Армирование колонн', 'Стены': 'Армирование стен', 'Каркас несущий': 'Армирование балок', 'Перекрытия': 'Армирование плит'}

RPs = IN[0]
parentIdIntegerValues = set([rp.ParentId for rp in RPs])

rpSets = []
for idInt in parentIdIntegerValues:
	rpSets.append([rp for rp in RPs if rp.ParentId == idInt])

TransactionManager.Instance.EnsureInTransaction(doc)

rebarContainers = []
for rpSet in rpSets:
	containerType = GetRCType(rpSet)
	container = RebarContainer.Create(doc, rpSet[0].Host, containerType.Id)
	rebarContainers.append(container)
	
for i, container in enumerate(rebarContainers):
	filteredRPs = rpSets[i]
	for rp in filteredRPs:
		if rp.HasMovedBar():
			AppendDividedItems(rp, container)
		else:
			container.AppendItemFromRebar(rp.Rebar)

	container.Parameter[BuiltInParameter.PHASE_CREATED].Set(filteredRPs[0].PhaseId)
	if filteredRPs[0].ATMark:
		container.Parameter[BuiltInParameter.ALL_MODEL_MARK].Set(filteredRPs[0].ATMark)

TransactionManager.Instance.TransactionTaskDone()

OUT = rebarContainers
# ----------------------------------------
end = Revit.Transaction.Transaction.End(input=создание_контейнера)
отображениеАрматуры3D = Custom[ОтображениеАрматуры3D](rebarsOrRebarContainers=end)  # Настройка арматуры в трёхмерном отображении на активном виде (актуально до 2022 версии Revit)
shouldDeleteSourceRebars = Input(shouldDeleteSourceRebars: bool = true)  # Удалять исходную арматуру
разборка_сборок_удаление = Python(IN[0]=параметрыАрматуры.rebarParameters, IN[1]=shouldDeleteSourceRebars, IN[2]=end)  # "Разборка сборок, удаление исходной арматуры"; IronPython2
# ---------- разборка_сборок_удаление.python (31 lines) ----------
import clr
clr.AddReference('System')
from System.Collections.Generic import List
clr.AddReference('RevitAPI')
from Autodesk.Revit.DB import *
from Autodesk.Revit.DB.Structure import *
clr.AddReference('RevitServices')
from RevitServices.Persistence import DocumentManager
from RevitServices.Transactions import TransactionManager

if IN[1]:
	doc = DocumentManager.Instance.CurrentDBDocument
	
	aiFilter = ElementClassFilter(AssemblyInstance)
	RPs = UnwrapElement(IN[0])
	
	TransactionManager.Instance.EnsureInTransaction(doc)
	
	aiIntIds = []
	for rp in RPs:
		elem = doc.GetElement(rp.ParentId)
		if aiFilter.PassesFilter(elem) and rp.ParentId.IntegerValue not in aiIntIds:
			aiIntIds.append(rp.ParentId.IntegerValue)
			elem.Disassemble()
			
	rebarIds = [rp.Rebar.Id for rp in RPs]
	doc.Delete(List[ElementId](rebarIds))

	TransactionManager.Instance.TransactionTaskDone()

OUT = ''
# ----------------------------------------
shouldEditContainer = Input(shouldEditContainer: bool = true)  # Заполнять параметры контейнера
редактирование_контейнеров = Python(IN[0]=end, IN[1]=параметры, IN[2]=shouldEditContainer)  # IronPython2
# ---------- редактирование_контейнеров.python (84 lines) ----------
import sys
import clr
clr.AddReference('RevitAPI')
from Autodesk.Revit.DB import *
from Autodesk.Revit.DB.Structure import *
clr.AddReference('RevitServices')
from RevitServices.Persistence import DocumentManager
from RevitServices.Transactions import TransactionManager

doc = DocumentManager.Instance.CurrentDBDocument

def GetRebarLength(item):
	lines = item.GetCenterlineCurves(True, True, True)
	L = sum([line.Length for line in lines])
	return L

def CalculateMass(container):
	volume = 0
	items = [container.GetItem(i) for i in range(container.ItemsCount)]
	rst = doc.GetElement(container.GetTypeId())
	inMeters = rst.GetParameters(IN[1][5])[0].AsInteger()
	if inMeters == 1:	
		for item in items:
			barType = doc.GetElement(item.BarTypeId)
			inMeters = barType.GetParameters(IN[1][5])[0].AsInteger()
			L = GetRebarLength(item)
			if inMeters == 1:
				volume += item.Volume/L * (1000/304.8)
			elif item.LayoutRule != RebarLayoutRule.Single:
				n = item.Quantity
				step = item.MaxSpacing
				volume += item.Volume/n * round((1000/304.8)/step)
			else:
				volume += item.Volume
	else:
		for item in items:
			volume += item.Volume
	mass = 7850*(volume*304.8**3)/10**9
	return mass
	
def GetAmount(container):
	amount = 1/float(container.ItemsCount)
	rst = doc.GetElement(container.GetTypeId())
	inMeters = rst.GetParameters(IN[1][5])[0].AsInteger()
	if inMeters == 1:
		items = [container.GetItem(i) for i in range(container.ItemsCount)]
		for item in items:
			barType = doc.GetElement(item.BarTypeId)
			inMeters = barType.GetParameters(IN[1][5])[0].AsInteger()
			if inMeters == 1:		
				amount = round(GetRebarLength(item)*304.8)/1000/float(container.ItemsCount)
				break
	return amount

rebarContainers = UnwrapElement(IN[0])

if IN[2]:
	TransactionManager.Instance.EnsureInTransaction(doc)
	
	for container in rebarContainers:
		host = doc.GetElement(container.GetHostId())
		zone = host.GetParameters(IN[1][6])[0].AsString()
		container.PresentItemsAsSubelements = True
		
		overrideMan = container.GetParametersManager()
		overrideMan.ClearOverrides()	
		partParId = container.Parameter[BuiltInParameter.NUMBER_PARTITION_PARAM].Id
		overrideMan.AddOverride(partParId, '03_Каркасы')
		
		if IN[1][0][1] != '':
			container.GetParameters(IN[1][0][0])[0].Set(IN[1][0][1].split('_')[0])
		else:
			container.GetParameters(IN[1][0][0])[0].Set(doc.GetElement(container.GetTypeId()).Parameter[BuiltInParameter.ALL_MODEL_TYPE_NAME].AsString().split('_')[0])
		container.GetParameters(IN[1][2])[0].Set(GetAmount(container))
		container.GetParameters(IN[1][3])[0].Set(CalculateMass(container))
		container.GetParameters(IN[1][6])[0].Set(zone)
		 
		if doc.GetElement(container.GetHostId()).Parameter[BuiltInParameter.ALL_MODEL_MARK].HasValue:
			hostMark = doc.GetElement(container.GetHostId()).Parameter[BuiltInParameter.ALL_MODEL_MARK].AsString()
			container.GetParameters(IN[1][4])[0].Set(hostMark)
				
	TransactionManager.Instance.TransactionTaskDone()

OUT = rebarContainers
# ----------------------------------------
rebarContainers = Output(редактирование_контейнеров)  # Список арматурных контейнеров
