# Dynamo custom node СловарьМарок.dyf (Dynamo 3.3.0.6316)
# category: 1П.Подготовка
# Создает словарь марок для расшифровки. Например, марки элементов, начинающиеся на "Пм-", будут расшифровываться как "Плита монолитная". Используется для формирования названий видов, спецификаций, листов и т. п. Работает на внешнем файле EXCEL.

file_path = Filename("..\! Справка !\Конструкции\Расшифровка марок.xlsx")
file_from_path = FileObject(path=file_path)
string = StringInput("Расшифровка марок")
boolean = BoolSelector(false)
boolean_2 = BoolSelector(false)
importExcel = Data.ImportExcel(file=file_from_path, sheetName=string, readAsStrings=boolean, showExcel=boolean_2)
словарь = Python(IN[0]=importExcel)  # IronPython2
# ---------- словарь.python (5 lines) ----------
dict = {}
for item in IN[0]:
    dict[item[0]] = [item[i] for i in [1,2,3,4]]
   
OUT = dict
# ----------------------------------------
OUT = Output(словарь)
