# Dynamo custom node СозданиеВертикальногоРазреза.dyf (Dynamo 2.13.1.3887)
# category: 1П.Виды
# Создает вертикальный разрез под углом A к "глобальной оси X" (XYZ.BasisX), где 0<A<=180. Применяется для создания опалубочных чертежей и схем армирования стен и колонн.

ELPs = Input(ELPs: var[]..[])  # Список ПАРАМЕТРОВ стен и (или) колонн (использовать ноды из раздела 1П.Кэширование)
inputOffsets = Input(inputOffsets: var[]..[])  # Список расстояний включающий в себя: 0. Смещение по бокам 1. Смещение низа 2. Смещение верха 3. Смещение передней грани 4. Смещение задней грани
inputStringData = Input(inputStringData: var[]..[])  # Список, состоящий из трёх элементов-строк, включающий в себя: 0. Имя шаблона вида 1. Имя типа сечений 2. Марка комплекта чертежей

# group: Параметры
имя_параметра = StringInput("1П_Штамп_Раздел проекта")
имена_параметров = List.Create(item0=имя_параметра)

словарьМарок = Custom[СловарьМарок]()  # Создает словарь марок для расшифровки. Например, марки элементов, начинающиеся на "Пм-", будут расшифровываться как "Плита монолитная". Используется для формирования названий видов, спецификаций, листов и т. п. Работает на внешнем файле EXCEL.
создание_разреза = Python(IN[0]=ELPs, IN[1]=inputOffsets, IN[2]=inputStringData, IN[3]=имена_параметров, IN[4]=словарьМарок)  # IronPython2
# ---------- создание_разреза.python (94 lines) ----------
import clr
import math
clr.AddReference('System')
from System.Collections.Generic import List
clr.AddReference('RevitAPI')
from Autodesk.Revit.DB import *
clr.AddReference('RevitServices')
from RevitServices.Persistence import DocumentManager
from RevitServices.Transactions import TransactionManager

def GetViewDirectionByElemNormal(elp):
	angle = round(XYZ.BasisX.AngleOnPlaneTo(elp.Geom.YDir, XYZ.BasisZ), 3)
	test.append(angle)
	if 0 < angle <= round(math.pi, 3):
		return elp.Geom.YDir
	else:
		return -elp.Geom.YDir
	
def SetViewParameters(view):
	if elp.Mark:
		name = IN[2][2] + '_' + elp.Mark + '_' + IN[2][0].split('_')[-1]
		if name not in uniqueViewNames:
			view.Name = name
			view.Parameter[BuiltInParameter.VIEW_DESCRIPTION].Set(groupName[elp.Mark.split('-')[0]][2] + ' ' + elp.Mark)
			uniqueViewNames.append(name)
	if template and not view.Parameter[BuiltInParameter.VIEW_TEMPLATE].IsReadOnly:
		view.Parameter[BuiltInParameter.VIEW_TEMPLATE].Set(template.Id)		
	if not view.Parameter[BuiltInParameter.PHASE_CREATED].IsReadOnly:
		view.Parameter[BuiltInParameter.VIEW_PHASE].Set(elp.Phase)	
	view.Parameter[BuiltInParameter.VIEWER_CROP_REGION_VISIBLE].Set(0)
	if view.GetParameters(IN[3][0]) and not view.GetParameters(IN[3][0])[0].IsReadOnly:
		view.GetParameters(IN[3][0])[0].Set(IN[2][2])
	
def HideNonHostEmbs(view):
	embIdsToHide = []
	embs = [elem for elem in FilteredElementCollector(doc, view.Id).WherePasses(embFilter).ToElements() if elem.Symbol.FamilyName.find('220') == 0]
	for emb in embs:
		filter = BoundingBoxContainsPointFilter(emb.GetTransform().Origin - (10/304.8)*emb.GetTransform().BasisZ)
		if not filter.PassesFilter(elp.Elem):
			embIdsToHide.append(emb.Id)
			embIdsToHide += list(emb.GetSubComponentIds())
	if embIdsToHide:
		view.HideElements(List[ElementId](embIdsToHide))
	
doc = DocumentManager.Instance.CurrentDBDocument
ELPs = IN[0]

templates = [view for view in FilteredElementCollector(doc).OfClass(View).ToElements() if view.IsTemplate == True and view.Name == IN[2][0]]
template = templates[0] if templates else None
viewSectionType = [type for type in FilteredElementCollector(doc).OfClass(ViewFamilyType).ToElements() if type.Parameter[BuiltInParameter.SYMBOL_NAME_PARAM].AsString() == IN[2][1]][0]

embFilter = LogicalAndFilter(ElementClassFilter(FamilyInstance), LogicalOrFilter(ElementCategoryFilter(BuiltInCategory.OST_Rebar), ElementCategoryFilter(BuiltInCategory.OST_GenericModel)))

createdViews = []
uniqueViewNames = []
offsets = [dim/304.8 for dim in IN[1]]

groupName = IN[4]

test = []

TransactionManager.Instance.EnsureInTransaction(doc)

for i, elp in enumerate(ELPs):
	
	sectionBox = BoundingBoxXYZ()
	
	transform = sectionBox.Transform
	transform.BasisZ = GetViewDirectionByElemNormal(elp)
	transform.BasisY = XYZ.BasisZ
	transform.BasisX = transform.BasisY.CrossProduct(transform.BasisZ)
	transform.Origin = elp.Geom.MiddleOrigin - transform.BasisZ*offsets[3]
	
	sectionBox.Transform = transform
	
	for dim in range(3):
		sectionBox.MinEnabled[dim] = True	
		sectionBox.MaxEnabled[dim] = True
	
	sectionBox.Min = -XYZ.BasisX*(elp.Geom.L/2+offsets[0]) - XYZ.BasisY*(elp.Geom.H/2+offsets[1])
	sectionBox.Max = XYZ.BasisX*(elp.Geom.L/2+offsets[0]) + XYZ.BasisY*(elp.Geom.H/2+offsets[2]) + XYZ.BasisZ*(offsets[3]+offsets[4])

	view = ViewSection.CreateSection(doc, viewSectionType.Id, sectionBox)
	SetViewParameters(view)
	if IN[2][0].find('палубоч') != -1:
		HideNonHostEmbs(view)
	
	createdViews.append(view)
	doc.Regenerate()
	
TransactionManager.Instance.TransactionTaskDone()

OUT = createdViews
#OUT = [sectionBox.Min, sectionBox.Max, transform.Origin, transform.BasisX, transform.BasisY, transform.BasisZ]
# ----------------------------------------
views = Output(создание_разреза)  # Созданные виды
