# Dynamo custom node СозданиеГоризонтальногоРазреза.dyf (Dynamo 2.13.1.3887)
# category: 1П.Виды
# Создает горизонтальный разрез под углом A к "глобальной оси X" (XYZ.BasisX), где 0<A<=180. Применяется для создания опалубочных чертежей и схем армирования стен и колонн.

ELPs = Input(ELPs: var[]..[])  # Список ПАРАМЕТРОВ стен и (или) колонн (использовать ноды из раздела 1П.Кэширование)

# group: Размеры
смещение_по_бокам = DoubleSlider(500, range=0..3000 step 100)
смещение_низа = DoubleSlider(600, range=0..3000 step 100)
смещение_верха = DoubleSlider(600, range=0..3000 step 100)
смещение_передней_грани = DoubleSlider(250, range=0..2000 step 10)
смещение_задней_грани = DoubleSlider(250, range=0..2000 step 10)
настройки_границ_вида = List.Create(item0=смещение_по_бокам, item1=смещение_низа, item2=смещение_верха, item3=смещение_передней_грани, item4=смещение_задней_грани)

inputStringData = Input(inputStringData: var[]..[])  # Список, состоящий из трёх элементов-строк, включающий в себя: 1. Имя шаблона вида 1. Имя типа сечений 1. Марка комплекта чертежей

# group: Параметры
имя_параметра = StringInput("1П_Штамп_Раздел проекта")
имена_параметров = List.Create(item0=имя_параметра)

словарьМарок = Custom[СловарьМарок]()  # Создает словарь марок для расшифровки. Например, марки элементов, начинающиеся на "Пм-", будут расшифровываться как "Плита монолитная". Используется для формирования названий видов, спецификаций, листов и т. п. Работает на внешнем файле EXCEL.
создание_горизонтального_сечения = Python(IN[0]=ELPs, IN[1]=настройки_границ_вида, IN[2]=inputStringData, IN[3]=имена_параметров, IN[4]=словарьМарок)  # IronPython2
# ---------- создание_горизонтального_сечения.python (92 lines) ----------
import clr
import math
clr.AddReference('System')
from System.Collections.Generic import List
clr.AddReference('RevitAPI')
from Autodesk.Revit.DB import *
clr.AddReference('RevitServices')
from RevitServices.Persistence import DocumentManager
from RevitServices.Transactions import TransactionManager

def GetViewDirectionByElemNormal(elp):
	angle = XYZ.BasisX.AngleOnPlaneTo(elp.Geom.YDir, XYZ.BasisZ)
	test.append(angle)
	if 0 < angle <= math.pi:
		return elp.Geom.YDir
	else:
		return -elp.Geom.YDir
	
def SetViewParameters(view):
	if elp.Mark:
		name = IN[2][2] + '_' + elp.Mark + '_Опалубочный чертеж - Сечение 1'
		if name not in uniqueViewNames:
			view.Name = name
			view.Parameter[BuiltInParameter.VIEW_DESCRIPTION].Set(groupName[elp.Mark.split('-')[0]][2] + ' ' + elp.Mark)
			uniqueViewNames.append(name)
	if template and not view.Parameter[BuiltInParameter.VIEW_TEMPLATE].IsReadOnly:
		view.Parameter[BuiltInParameter.VIEW_TEMPLATE].Set(template.Id)		
	if not view.Parameter[BuiltInParameter.PHASE_CREATED].IsReadOnly:
		view.Parameter[BuiltInParameter.VIEW_PHASE].Set(elp.Phase)	
	view.Parameter[BuiltInParameter.VIEWER_CROP_REGION_VISIBLE].Set(0)
	if view.GetParameters(IN[3][0]) and not view.GetParameters(IN[3][0])[0].IsReadOnly:
		view.GetParameters(IN[3][0])[0].Set(IN[2][2])
	
def HideNonHostEmbs(view):
	embIdsToHide = []
	embs = [elem for elem in FilteredElementCollector(doc, view.Id).WherePasses(embFilter).ToElements() if elem.Symbol.FamilyName.find('220') == 0]
	for emb in embs:
		filter = BoundingBoxContainsPointFilter(emb.GetTransform().Origin - (10/304.8)*emb.GetTransform().BasisZ)
		if not filter.PassesFilter(elp.Elem):
			embIdsToHide.append(emb.Id)
			embIdsToHide += list(emb.GetSubComponentIds())
	if embIdsToHide:
		view.HideElements(List[ElementId](embIdsToHide))
	
doc = DocumentManager.Instance.CurrentDBDocument
ELPs = IN[0]

templates = [view for view in FilteredElementCollector(doc).OfClass(View).ToElements() if view.IsTemplate == True and view.Name == IN[2][0]]
template = templates[0] if templates else None
viewSectionType = [type for type in FilteredElementCollector(doc).OfClass(ViewFamilyType).ToElements() if type.Parameter[BuiltInParameter.SYMBOL_NAME_PARAM].AsString() == IN[2][1]][0]

embFilter = LogicalAndFilter(ElementClassFilter(FamilyInstance), LogicalOrFilter(ElementCategoryFilter(BuiltInCategory.OST_Rebar), ElementCategoryFilter(BuiltInCategory.OST_GenericModel)))

createdViews = []
uniqueViewNames = []
offsets = [dim/304.8 for dim in IN[1]]

groupName = IN[4]

test = []

TransactionManager.Instance.EnsureInTransaction(doc)

for i, elp in enumerate(ELPs):
	
	sectionBox = BoundingBoxXYZ()
	
	transform = sectionBox.Transform
	transform.BasisY = -GetViewDirectionByElemNormal(elp)
	transform.BasisZ = -XYZ.BasisZ
	transform.BasisX = transform.BasisY.CrossProduct(transform.BasisZ)
	transform.Origin = elp.Geom.MiddleOrigin - transform.BasisZ*offsets[3]
	
	sectionBox.Transform = transform
	
	for dim in range(3):
		sectionBox.MinEnabled[dim] = True	
		sectionBox.MaxEnabled[dim] = True
	
	sectionBox.Min = -XYZ.BasisX*(elp.Geom.L/2+offsets[0]) - XYZ.BasisY*(elp.Geom.T/2+offsets[1])
	sectionBox.Max = XYZ.BasisX*(elp.Geom.L/2+offsets[0]) + XYZ.BasisY*(elp.Geom.T/2+offsets[2]) + XYZ.BasisZ*(offsets[3]+offsets[4])

	view = ViewSection.CreateSection(doc, viewSectionType.Id, sectionBox)
	SetViewParameters(view)
	HideNonHostEmbs(view)
	
	createdViews.append(view)
	doc.Regenerate()
	
TransactionManager.Instance.TransactionTaskDone()

OUT = createdViews
# ----------------------------------------
views = Output(создание_горизонтального_сечения)  # Созданные виды
