# Dynamo custom node СозданиеСпецификацииДляАрматурныхСборок.dyf (Dynamo 2.13.1.3887)
# category: 1П.Ведомости и спецификации
# Создаёт спецификацию элементов сборки с арматурными стержнями по заданному имени шаблона спецификации. Указывает в имени сборки количество строк спецификации (опционально).

ATs = Input(ATs: var[]..[])  # Список типов сборок с арматурными стержнями
scheduleTemplateName = Input(scheduleTemplateName: string)  # Имя шаблона спецификации
modifyNameWithRowCount = Input(modifyNameWithRowCount: bool)  # Переименововать сборку в соответствии с количеством строк в спецификации
создание_спецификаций_по_сборкам = Python(IN[0]=ATs, IN[1]=scheduleTemplateName, IN[2]=modifyNameWithRowCount)  # "Создание спецификаций по сборкам, переименовование сборок"; IronPython2
# ---------- создание_спецификаций_по_сборкам.python (94 lines) ----------
import sys
import clr
import System
clr.AddReference('RevitAPI')
from Autodesk.Revit.DB import *
from Autodesk.Revit.DB.Structure import *
clr.AddReference('RevitServices')
from RevitServices.Persistence import DocumentManager
from RevitServices.Transactions import TransactionManager

doc = DocumentManager.Instance.CurrentDBDocument

def ByNRows(at):
	n = int(at.Parameter[BuiltInParameter.ALL_MODEL_TYPE_NAME].AsString().split('_')[1])
	return n

def ByPrefix(at):
	return at.Parameter[BuiltInParameter.ALL_MODEL_TYPE_NAME].AsString().split('_')[-1].split('-')[0]
		
def ByNMark(at):
	return round(float(at.Parameter[BuiltInParameter.ALL_MODEL_TYPE_NAME].AsString().split('_')[-1].split('-')[1]), 2)
	
def HasSuffix(at):
	mark = at.Parameter[BuiltInParameter.ALL_MODEL_TYPE_NAME].AsString().split('_')[-1]
	if len(mark.split('-')) > 2 or len(mark.split(' ')) > 1:
		return 1
	else:
		return 0

def GetSuffix(at):
	mark = at.Parameter[BuiltInParameter.ALL_MODEL_TYPE_NAME].AsString().split('_')[-1]
	if len(mark.split('-')) > 2:	
		suffix = '-' + mark.split('-')[-1]
	elif len(mark.split(' ')) > 1:
		suffix = ' ' + mark.split(' ')[-1]
	else:
		suffix = ''
	return suffix
	
def HasSchedules(at):
	scheduleIds = list(at.GetDependentElements(ElementClassFilter(ViewSchedule)))
	if scheduleIds:
		return True
	else:
		return False

ATs = UnwrapElement(IN[0])
firstAIs = [[doc.GetElement(id) for id in at.GetDependentElements(ElementClassFilter(AssemblyInstance))][0] for at in ATs]
viewTemps = [schedule for schedule in FilteredElementCollector(doc).OfClass(ViewSchedule).ToElements() if schedule.IsTemplate and schedule.Name.find(IN[1]) == 0]
viewTemp = viewTemps[0]

rebarCat = Category.GetCategory(doc, BuiltInCategory.OST_Rebar)
	
schedules = []

TransactionManager.Instance.EnsureInTransaction(doc)

for ai in firstAIs:
	at = doc.GetElement(ai.GetTypeId())
	atOldName = at.Parameter[BuiltInParameter.ALL_MODEL_TYPE_NAME].AsString()
	if not HasSchedules(at) and len(atOldName.split('_')) == 2 and not HasSuffix(at):
		schedule = AssemblyViewUtils.CreateSingleCategorySchedule(doc, ai.Id, rebarCat.Id, viewTemp.Id, True)
		doc.Regenerate()
		if IN[2]:
			nRows = schedule.GetTableData().GetSectionData(SectionType.Body).NumberOfRows
			atNewName = atOldName.split('_')[0] + '_' + str(nRows) + '_' + atOldName.split('_')[-1]
			at.Name = atNewName
		schedules.append(schedule)

names = []

if IN[2]:
	ATs = sorted(sorted(sorted(sorted(ATs, key=HasSuffix), key=ByNMark), key=ByNRows), key=ByPrefix)
	prefixes = set([ByPrefix(at) for at in ATs])
	for prefix in prefixes:
		atsOfPrefix = [at for at in ATs if ByPrefix(at) == prefix]
		keys = []
		for at in atsOfPrefix:
			key = [ByNMark(at), ByNRows(at)]
			if key not in keys:
				keys.append(key)
		renamedAtIds = []
		for i, key in enumerate(keys):
			for at in atsOfPrefix:
				if at.Id.IntegerValue not in renamedAtIds and ByNMark(at) == key[0] and ByNRows(at) == key[1]:
					atOldName = at.Parameter[BuiltInParameter.ALL_MODEL_TYPE_NAME].AsString()
					atNewName = str(atOldName.split('_')[0] + '_' + prefix + '-' + str(i+1) + GetSuffix(at))
					names.append(['Было: ' + atOldName, 'Стало: ' + atNewName])
					renamedAtIds.append(at.Id.IntegerValue)
					at.Name = atNewName
				
TransactionManager.Instance.TransactionTaskDone()

OUT = names
# ----------------------------------------
names = Output(создание_спецификаций_по_сборкам)  # Старые и новые имена сборок (работает в положении IN[2] = True)
