# Dynamo custom node УдалениеДубликатовВКонтейнере.dyf (Dynamo 2.12.0.5650)
# category: 1П.Отладка
# Удаляет дублирующиеся стержни внутри арматурного контейнера

rebarsOrRebarContainers = Input(rebarsOrRebarContainers: var[]..[])  # Список арматурных контейнеров
number = DoubleInput(1)
параметрыАрматуры = Custom[ПараметрыАрматуры](rebarsOrRebarContainers=rebarsOrRebarContainers, distribToken=number)  # Сведения и методы, связанные с арматурными стержнями и арматурными контейнерами
удаление_дубликатов = Python(IN[0]=параметрыАрматуры.rebarContainerParameters)  # IronPython2
# ---------- удаление_дубликатов.python (50 lines) ----------
import sys
import clr
clr.AddReference('RevitAPI')
from Autodesk.Revit.DB import *
from Autodesk.Revit.DB.Structure import *
clr.AddReference('RevitServices')
from RevitServices.Persistence import DocumentManager
from RevitServices.Transactions import TransactionManager

def LinesAreEqual(line1, line2):
	for i in range(2):
		if not line1.GetEndPoint(i).IsAlmostEqualTo(line2.GetEndPoint(i)):
			return False
	else:
		return True
		
def RPsAreEqual(rp1, rp2):
	if rp1.Lines.Count == rp2.Lines.Count:
		for i in range(rp1.Lines.Count):
			if not LinesAreEqual(rp1.Lines[i], rp2.Lines[i]):
				return False
		else:
			return True
	else:
		return False
	
doc = DocumentManager.Instance.CurrentDBDocument
RCPs = IN[0]	

duplicateRPs = []
for rcp in RCPs:
	duplicateRPs.append([])
	ids = []
	for rp1 in rcp.RPs:
		for rp2 in rcp.RPs:
			if rp1 != rp2 and RPsAreEqual(rp1, rp2) and rp2.RCI.ItemIndex not in ids:
				duplicateRPs[-1].append([rp1, rp2])
				ids += [rp1.RCI.ItemIndex, rp2.RCI.ItemIndex]

TransactionManager.Instance.EnsureInTransaction(doc)

for i, rpSet in enumerate(duplicateRPs):
	rcp = RCPs[i]
	for pairRP in rpSet:	
		rcp.RPs.remove(pairRP[-1])
		rcp.Elem.RemoveItem(pairRP[-1].RCI)
		
TransactionManager.Instance.TransactionTaskDone()

OUT = RCPs
# ----------------------------------------
rebarContainerParameters = Output(удаление_дубликатов)  # Список параметров контейнеров
