# Dynamo custom node ФильтрацияЖБК.dyf (Dynamo 2.13.1.3887)
# category: 1П.Фильтрация
# Фильтрация железобетонных конструкций, изделий в пределах активного документа Revit

имя_материала_начинается_с = StringInput("Бетон")
имя_параметра_материала = StringInput("1П_Материал")
фильтрация_железобетонных = Python(IN[0]=имя_материала_начинается_с, IN[1]=имя_параметра_материала)  # "Фильтрация железобетонных элементов"; IronPython2
# ---------- фильтрация_железобетонных.python (49 lines) ----------
import clr
clr.AddReference('System')
from System.Collections.Generic import List
clr.AddReference('RevitAPI')
from Autodesk.Revit.DB import *
from Autodesk.Revit.DB.Structure import *
clr.AddReference('RevitServices')
from RevitServices.Persistence import DocumentManager

doc = DocumentManager.Instance.CurrentDBDocument
	
def GetMaterialNames(elem):
	if elem.GetType() == Floor or elem.GetType() == Wall:
		cs = doc.GetElement(elem.GetTypeId()).GetCompoundStructure()
		layers = cs.GetLayers() if cs else []
		materials = [doc.GetElement(layer.MaterialId) for layer in layers]
	else:
		materials = [doc.GetElement(elem.Symbol.Parameter[BuiltInParameter.STRUCTURAL_MATERIAL_PARAM].AsElementId())] if elem.Symbol.Parameter[BuiltInParameter.STRUCTURAL_MATERIAL_PARAM] else []
		if not materials and elem.Symbol.GetParameters(IN[1]):
			materials = [doc.GetElement(elem.Symbol.GetParameters(IN[1])[0].AsElementId())]
		elif not materials and elem.Parameter[BuiltInParameter.STRUCTURAL_MATERIAL_PARAM]:
			materials = [doc.GetElement(elem.Parameter[BuiltInParameter.STRUCTURAL_MATERIAL_PARAM].AsElementId())]
		elif not materials and elem.GetParameters(IN[1]):
			materials = [doc.GetElement(elem.GetParameters(IN[1])[0].AsElementId())]
	return [material.Name for material in materials if material]
		
filters = []
filters.append(LogicalAndFilter(ElementClassFilter(Floor), ElementCategoryFilter(BuiltInCategory.OST_Floors)))
filters.append(LogicalAndFilter(ElementClassFilter(FamilyInstance), ElementCategoryFilter(BuiltInCategory.OST_StructuralColumns)))
filters.append(ElementClassFilter(Wall))
filters.append(LogicalAndFilter(ElementClassFilter(FamilyInstance), ElementCategoryFilter(BuiltInCategory.OST_StructuralFraming)))
filters.append(LogicalAndFilter(ElementClassFilter(FamilyInstance), ElementCategoryFilter(BuiltInCategory.OST_Stairs)))
filters.append(LogicalAndFilter(ElementCategoryFilter(BuiltInCategory.OST_StructuralFoundation), LogicalOrFilter(ElementClassFilter(Floor), ElementClassFilter(FamilyInstance))))
filters.append(LogicalAndFilter(ElementClassFilter(FamilyInstance), ElementCategoryFilter(BuiltInCategory.OST_GenericModel)))
comFilter = LogicalOrFilter(filters)

allElems = FilteredElementCollector(doc).WherePasses(comFilter).WhereElementIsNotElementType().ToElements()

concreteIds = []
for elem in allElems:
	materialNames = GetMaterialNames(elem)
	for name in materialNames:
		if name.find(IN[0]) == 0:
			concreteIds.append(elem.Id)
			break

groupedElemIds = [FilteredElementCollector(doc, List[ElementId](concreteIds)).WherePasses(filter).ToElementIds() for filter in filters] + [concreteIds]

OUT = groupedElemIds
# ----------------------------------------
number = DoubleInput(0)
getItemAtIndex = List.GetItemAtIndex(list=фильтрация_железобетонных, index=number)
floorIds = Output(getItemAtIndex)  # Список ID плит
number_2 = DoubleInput(1)
getItemAtIndex_2 = List.GetItemAtIndex(list=фильтрация_железобетонных, index=number_2)
structuralColumnIds = Output(getItemAtIndex_2)  # Список ID несущих колонн
number_3 = DoubleInput(2)
getItemAtIndex_3 = List.GetItemAtIndex(list=фильтрация_железобетонных, index=number_3)
wallIds = Output(getItemAtIndex_3)  # Список ID стен
number_4 = DoubleInput(3)
getItemAtIndex_4 = List.GetItemAtIndex(list=фильтрация_железобетонных, index=number_4)
structuralFramingIds = Output(getItemAtIndex_4)  # Список ID каркаса несущего
number_5 = DoubleInput(4)
getItemAtIndex_5 = List.GetItemAtIndex(list=фильтрация_железобетонных, index=number_5)
stairsIds = Output(getItemAtIndex_5)  # Список ID лестниц
number_6 = DoubleInput(5)
getItemAtIndex_6 = List.GetItemAtIndex(list=фильтрация_железобетонных, index=number_6)
foundationIds = Output(getItemAtIndex_6)  # Список ID фундаментов
number_7 = DoubleInput(6)
getItemAtIndex_7 = List.GetItemAtIndex(list=фильтрация_железобетонных, index=number_7)
genericModelConcreteIds = Output(getItemAtIndex_7)  # Список ID обобщенных моделей
number_8 = DoubleInput(7)
getItemAtIndex_8 = List.GetItemAtIndex(list=фильтрация_железобетонных, index=number_8)
allConcreteIds = Output(getItemAtIndex_8)  # Список ID всех ЖБ элементов
