# Dynamo custom node ФильтрацияОсей.dyf (Dynamo 2.13.1.3887)
# category: 1П.Фильтрация
# Фильтрация всех осей в пределах активного документа

views = Input(views: var[]..[])  # Список видов
python_script = Python(IN[0]=views)  # IronPython2
# ---------- python_script.python (13 lines) ----------
import clr
clr.AddReference('RevitAPI')
from Autodesk.Revit.DB import *
clr.AddReference('RevitServices')
from RevitServices.Persistence import DocumentManager

doc = DocumentManager.Instance.CurrentDBDocument
views = UnwrapElement(IN[0])

allGridIds = FilteredElementCollector(doc).OfClass(Grid).ToElementIds()
viewGridSets = [FilteredElementCollector(doc, view.Id).OfClass(Grid).ToElements() for view in views]

OUT = allGridIds, viewGridSets
# ----------------------------------------
firstItem = List.FirstItem(list=python_script)
allGrids = Output(firstItem)
lastItem = List.LastItem(list=python_script)
viewGridSets = Output(lastItem)
